# Grasshopper definition 写入分区0306.gh (Grasshopper 1.0.7)
# plug-ins: Human, MultiAgent

# ---- group: 旋转调整
九龙湖 = Curve(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)
九龙湖road = Curve([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])
九龙湖rect = Rectangle(九龙湖)
c_script = CSharpScript(boundry=九龙湖, rectRef=九龙湖rect)  # -> out, A, B; inputs boundry: Polyline, rectRef: Rectangle3d
# ---------- c_script: C# ----------
    Vector3d ax = rectRef.Corner(1) - rectRef.Corner(0);
    Point3d p = rectRef.Corner(0);
    B = p;
    var var1 = Vector3d.Multiply(ax, new Vector3d(0, 1, 0)) / ax.Length;
    //var t = Math.PI * Math.Sqrt(2) / 2;
    double angle;
    angle = Math.Acos(Math.Abs(var1));
    if(angle > Math.PI / 2){
      angle = Math.PI - angle;
    }
    if(angle > Math.PI / 4){
      angle = angle - Math.PI / 2;
    }
    A = angle;
# ---------- end c_script ----------
rotate = Rotate(Geometry=九龙湖, Angle=c_script.A, Plane=c_script.B)  # -> Geometry, Transform
rotate_2 = Rotate(Geometry=九龙湖road, Angle=c_script.A, Plane=PlaneXY(0, 0, 0))  # -> Geometry, Transform

# ---- group: 求点
# 点不能太多 影响求解时间
number_slider = Slider(0, range=0..1)
offset_curve = OffsetCurve(Curve=rotate.Geometry, Distance=expr("-X", number_slider), Plane=PlaneXY(0, 0, 0), Corners=1)
c_script_2 = CSharpScript(siteEdge=offset_curve)  # -> out, points_inside, points_outside; inputs siteEdge: Polyline
# ---------- c_script_2: C# ----------
    var bdBox = siteEdge.BoundingBox;
    var corner1 = bdBox.Corner(true, true, true);
    var corner2 = bdBox.Corner(false, false, false);

    var frame = new Rectangle3d(Plane.WorldXY,
      new Point3d((int) (corner1.X), (int) (corner1.Y), 0),
      new Point3d(Math.Ceiling(corner2.X) - 1, Math.Ceiling(corner2.Y) - 1, 0));
    List<Point3d> inside = new List<Point3d>();
    List<Point3d> outside = new List<Point3d>();

    var origin = new Point3d((int) (corner1.X ), (int) (corner1.Y), 0);

    for(int i = 0;i <= (int) frame.Width;i++){
      for(int j = 0;j <= (int) frame.Height;j++)
      {
        var p = origin + new Vector3d(i, j, 0);
        var site = siteEdge.ToPolylineCurve();
        var isInside = site.Contains(p, Plane.WorldXY, 0.01) == PointContainment.Inside;

        Print(isInside.ToString());
        if(!isInside){
          outside.Add(p);
        }else{
          inside.Add(p);

        }
      }
    }
    //Frame = frame;
    points_inside = inside;
    points_outside = outside;
# ---------- end c_script_2 ----------

# ---- group: 九龙湖
outsidepoint = Point(c_script_2.points_outside)
road = Line(rotate_2.Geometry)
九龙湖_2 = Curve(rotate.Geometry)

# ---- group: 南工职大
南工职大trans_轮廓 = Curve(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)
南工职大_轮廓 = Curve(<curve referenced from the Rhino model>)
roadwidth = Number([1, 0.6, 0.3, 0.6])
building = Rectangle([{Plane=PlaneXY(-1.5, 35, 0), Size=Domain2(u=-6.5..6.5, v=-7..7)}, {Plane=PlaneXY(-1.5, 19.5, 0), Size=Domain2(u=-6.5..6.5, v=-4.5..4.5)}, {Plane=PlaneXY(-1.5, -0.5, 0), Size=Domain2(u=-6.5..6.5, v=-5.5..5.5)}, {Plane=PlaneXY(15, -1, 0), Size=Domain2(u=-8..8, v=-5..5)}, {Plane=PlaneXY(35, -1, 0), Size=Domain2(u=-10..10, v=-5..5)}])
minus1 = Rectangle({Plane=PlaneXY(14.9565, 47.554, 0), Size=Domain2(u=-8.8205..8.8205, v=-5.369..5.369)})
entrance = Point([Point(24.30770696, 5.15272947, 0), Point(3.54692383, 24.88828874, 0), Point(22.5135652, 47.31506063, 0), Point(46.3500199, 25.65720663, 0), Point(25, 22, 0)])
nature = Curve(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)
river = Rectangle([{Plane=PlaneXY(25.6945, 22.243, 0), Size=Domain2(u=-5.7525..5.7525, v=-8.437..8.437)}, {Plane=PlaneXY(25.311, 13.039, 0), Size=Domain2(u=-24.311..24.311, v=-0.767..0.767)}, {Plane=PlaneXY(24.544, 9.5875, 0), Size=Domain2(u=-1.534..1.534, v=-2.6845..2.6845)}])
cutter = Line(Line((6.136, 42.185, 0), (48.02868096, 42.185, 0)))
road_2 = Line([Line((2.987377828, 6.235352355, 0), (47.32274192, 6.235352355, 0)), Line((45.51889565, 4.055872156, 0), (45.51889565, 54.37247468, 0)), Line((47.7274564, 42.86645935, 0), (2.710834217, 42.86645935, 0)), Line((5.655525119, 53.4906912, 0), (5.655525119, -0.2699200005, 0))])
file_path = FilePath("G:\grasshopper_C#\南工职大\site3.csv")

# ----
cutter_2 = Line(Line((23.777, 50.923, 0), (41.49415506, 52.84794079, 0)))
road_3 = Line([Line((3, 6, 0), (50, 6, 0)), Line((48, 5, 0), (42, 56, 0)), Line((0.7482694332, 42.55744625, 0), (49.62830357, 42.55744625, 0))])

# ---- group: 山东师范
roadwidth_2 = Number([0, 2.3, 2.3, 5])
minus1_2 = Rectangle({Plane=PlaneXY(46.62521858, 11.76394952, 0), Size=Domain2(u=-7.358420744..7.358420744, v=-10.9151436..10.9151436)})
山东师范 = Curve(<curve referenced from the Rhino model>)
cutter_3 = Line(Line((27.82000507, 36.06219969, 0), (56.70001831, 30.64129872, 0)))
entrance_2 = Point([Point(25.22474979, 1.86675182, 0), Point(53.99240323, 26.93053397, 0), Point(25.15373308, 33.9625494, 0), Point(6.783045749, 18.84956035, 0)])
file_path_2 = FilePath("E:\grasshopper_C#\山东师范职业技术\Site1_road.csv")

# ----
cutter_4 = Line(Line((27.82000507, 36.06219969, 0), (56.70001831, 30.64129872, 0)))
road_4 = Line([Line((5.416325985, 42.19627884, 0), (5.664811006, -3.257223456, 0)), Line((0.2842243847, 1.25430534, 0), (63.72764806, 1.292901033, 0)), Line((56.46980446, -7.142712361, 0), (56.29536261, 43.88015194, 0))])

boundary = Curve(山东师范)
roadwidth_3 = Number(roadwidth_2)
minus = Rectangle(minus1_2)
entrance_3 = Point(entrance_2)
road_5 = Line([cutter_4, road_4])
file_path_3 = FilePath(file_path_2)

# ----
# display  SITE
road_6 = CustomPreviewLineweights(
    Geometry=road_5,
    Shader={diffuse=RGB(129, 129, 129), emission=RGB(0, 0, 0), shine=0, specular=RGB(255, 255, 255), transparency=0},
    Thickness=expr("x*0.5", roadwidth_3),
    Absolute=True)
linetype_table = LinetypeTable(Update=True)  # -> Linetypes, LinetypePattern
minus_2 = BoundarySurfaces(Edges=minus)
custom_preview = CustomPreview(
    Geometry=minus_2,
    Material={diffuse=RGB(225, 225, 225), emission=RGB(76, 76, 76), shine=0.5, specular=RGB(255, 255, 255), transparency=0})
dot_display = DotDisplay(Point=entrance_3, Colour=RGB(0, 0, 0), Size=0.5)
list_item = ListItem(List=flatten(linetype_table.Linetypes), Index=1, Wrap=True)
multiplication = Multiplication(A=list_item, B=Slider(0.88, range=0..2))
dash_pattern = DashPattern(Curve=boundary, Pattern=multiplication)  # -> Dashes, Gaps
custom_preview_lineweights = CustomPreviewLineweights(
    Geometry=dash_pattern.Dashes,
    Shader={diffuse=RGB(0, 0, 0), emission=RGB(0, 0, 0), shine=0.5, specular=RGB(255, 255, 255), transparency=0},
    Thickness=3,
    Absolute=False)

blocks = Rectangle()
buildings = BoundarySurfaces(Edges=blocks)
nature_2 = Curve(<curve referenced from the Rhino model>)
nature_3 = BoundarySurfaces(Edges=nature_2)
trigger = Trigger(Interval=-1000, TimerInterval=1000, Target=site2csv)  # disabled
custom_preview_2 = CustomPreview(
    Geometry=buildings,
    Material={diffuse=RGB(185, 185, 185), emission=RGB(0, 0, 0), shine=0, specular=RGB(255, 255, 255), transparency=0})
custom_preview_3 = CustomPreview(
    Geometry=nature_3,
    Material={diffuse=RGB(192, 227, 255), emission=RGB(0, 0, 0), shine=0, specular=RGB(255, 255, 255), transparency=0})  # disabled
# set  SITE
site2csv = CSharpScript(
    boundry=boundary,
    minus=minus,
    blocks=blocks,
    edge=nature_2,
    road=road_5,
    roadWidth=roadwidth_3,
    entrance=entrance_3,
    fileName=file_path_3)  # -> out, A, B; inputs boundry: Polyline, minus: list of Rectangle3d, blocks: list of Rectangle3d, edge: list of Curve, road: list of Line, roadWidth: list of Double, entrance: list of Point3d, fileName: String; disabled
# ---------- site2csv: C# usings ----------
using System.IO;
# ---------- site2csv: C# ----------
    var oob = boundry.BoundingBox;
    frame = new Rectangle3d(Plane.WorldXY, oob.Corner(false, false, false), oob.Corner(true, true, false));
    B = frame;
    int digit = 2;//保留位数
    ToMinus(minus, blocks);
    A = minus;

    if (minus.Count > 0 && fileName != null)
    {
      FileStream fs = new FileStream(fileName, FileMode.Create, FileAccess.Write);
      StreamWriter sw = new StreamWriter(fs, System.Text.Encoding.UTF8);

      var strLine = string.Empty;
      var index = 0;

      //写入Boundry
      sw.WriteLine("Boundry");
      foreach(Point3d p in boundry){
        strLine += "(" + Math.Round(p.X, digit) + ";" +
          Math.Round(p.Y, digit) + "),";
      }
      sw.WriteLine(strLine);

      //写入Frame
      sw.WriteLine("Frame");
      sw.WriteLine("(" + Math.Round(frame.Corner(0).X, digit) + ";" +
        Math.Round(frame.Corner(0).Y, digit) + ";" +
        Math.Round(frame.Corner(2).X, digit) + ";" +
        Math.Round(frame.Corner(2).Y, digit) + ")");

      //写入Minus
      WriteRects("Minus", sw, minus, digit);
      //写入block
      if(blocks != null)
        WriteRects("Block", sw, blocks, digit);


      //写入entrance
      WritePoints("Entrance", sw, entrance, digit);

      //写入outsidePoints
      if(edge != null){
        List<Point3d> inside = new List<Point3d>();

        var origin = new Point3d((int) (frame.Corner(0).X ), (int) (frame.Corner(0).Y), 0);

        for(int i = 0;i <= (int) frame.Width;i++){
          for(int j = 0;j <= (int) frame.Height;j++)
          {
            foreach(Curve e in edge){
              var p = origin + new Vector3d(i, j, 0);
              var isInside = e.Contains(p, Plane.WorldXY, 0.01) == PointContainment.Inside;
              Print(isInside.ToString());
              if(isInside){
                inside.Add(p);

              }
            }
          }
        }
        WritePoints("OutsidePoints", sw, inside, digit);
      }

      //写入Road
      sw.WriteLine("Road");
      strLine = "";
      index = 0;

      foreach(Line l in road){

        strLine += "(" + Math.Round(l.FromX, digit) + ";"
          + Math.Round(l.FromY, digit)
          + ";" + Math.Round(l.ToX, digit) + ";" +
          Math.Round(l.ToY, digit) + ")" + roadWidth[index] + ";";

        ///与场地是否相交
        var bo = Rhino.Geometry.Intersect.Intersection.
          CurveLine(boundry.ToPolylineCurve(), l, 0, 0);
        var bo1 = Rhino.Geometry.Intersect.Intersection.
          CurveLine(frame.ToNurbsCurve(), l, 0, 0);
        string strTemp = "";
        if(bo.Count == 2){
          Print("道路" + index + "与场地相交");
          strTemp = "2";
          //for(int i = 0;i < bo.Count;i++){
          strTemp += "(" + Math.Round(bo[0].PointA.X, digit)
            + ";" + Math.Round(bo[0].PointA.Y, digit)
            + ";" + Math.Round(bo[0].PointA.X, digit)
            + ";" + Math.Round(bo[0].PointA.Y, digit) + ")";
          //strTemp += "(" +bo[i].PointB.X +";" + bo[i].PointB.Y+")";
          //}
          //Print(strTemp);

        }else if(bo.Count != 2 && bo1.Count == 2){
          var x1 = l.FromX;
          var x2 = l.ToX;
          var y1 = l.FromY;
          var y2 = l.ToY;
          double a,b,c;
          a = (y2 - y1) / (x2 - x1);
          b = -1;
          c = -b * y1 - a * x1;
          var center = boundry.CenterPoint();
          if(a * center.X + b * center.Y + c < 0)
            strTemp = "-1";//线在点下方，去除下方
          if(a * center.X + b * center.Y + c > 0)
            strTemp = "1";//线在点上方，去除上方
        }else{
          strTemp = "0";
        }
        strLine += strTemp + ",";
        index++;
      }
      sw.WriteLine(strLine);

      sw.Close();
      fs.Close();
    }
# ---------- site2csv: C# additional code ----------
  Rectangle3d frame;

  public void WritePoints(string name, StreamWriter sw, List<Point3d> points, int digit){
    sw.WriteLine(name);
    var strLine = "";
    foreach(Point3d p in points){
      strLine += "(" + Math.Round(p.X, digit) + ";"
        + Math.Round(p.Y, digit) + "),";
    }
    sw.WriteLine(strLine);
  }

  public void WriteLines(string name, StreamWriter sw, List<Line> lines, int digit){

  }
  public void WriteRects(string name, StreamWriter sw, List<Rectangle3d> rects, int digit){
    sw.WriteLine(name);
    var strLine = "";
    foreach(Rectangle3d r in rects){
      double x1 = Math.Round(r.Corner(0).X, digit);
      double y1 = Math.Round(r.Corner(0).Y, digit);
      double x2 = Math.Round(r.Corner(2).X, digit);
      double y2 = Math.Round(r.Corner(2).Y, digit);
      double temp;
      if(x1 > x2){
        temp = x1;
        x1 = x2;
        x2 = temp;
      }
      if(y1 > y2){
        temp = y1;
        y1 = y2;
        y2 = temp;
      }
      strLine += "(" + x1 + ";" + y1 + ";" + x2 + ";" + y2 + "),";
    }
    sw.WriteLine(strLine);
  }

  //与场地相交的block列入minus
  private void ToMinus(List<Rectangle3d> minus, List<Rectangle3d>blocks){

    List<Point3d> points;
    foreach(Rectangle3d rect in blocks){
      var region = Curve.CreateBooleanIntersection
        (rect.ToNurbsCurve(), frame.ToNurbsCurve(), 0.1);

      if(region.Length > 0){
        var a = region[0].ToPolyline(0.1, 0.1, 0.1, 100);
        points = new List<Point3d>();
        for(int i = 0;i < a.PointCount;i++){
          points.Add(a.Point(i));
        }
        var r = Rectangle3d.CreateFromPolyline(points);
        minus.Add(r);
      }
    }
  }
# ---------- end site2csv ----------

# ----
# get  Districts
number_slider_2 = Slider(1, range=1..5)
resultpath = FilePath("G:\grasshopper_C#\山东师范职业技术\产业\location_new9.csv")
c_script_3 = CSharpScript(file=resultpath, result=number_slider_2)  # -> out, DistrictNames, Districts, Color, Elements, info; inputs file: String, result: Int32
# ---------- c_script_3: C# ----------
    var fs = new FileStream(file, FileMode.Open, FileAccess.Read);
    var sr = new StreamReader(fs);
    string strLine = " ";
    var nameList = new List<string>();
    var infoList = new List<string>();
    var resultList = new List<string>();
    bool IsFirst = true;
    while ((strLine = sr.ReadLine()) != null){
      Print(strLine.ToString());
      if (IsFirst == true)
      {
        IsFirst = false;

      }else{
        string[] str = strLine.Split(',');
        nameList.Add(str[0]);

        resultList.Add(str[result]);
      }
    }
    List<int> color = new List<int>();
    int temp = 0;
    color.Add(temp);
    for(int i = 1;i < nameList.Count;i++){
      if(nameList[i] != nameList[i - 1]){
        temp++;
      }
      color.Add(temp);
    }
    Color = color;
    DistrictNames = nameList;
    //Districts = resultList;

    var districts = new List<Rectangle3d>();
    foreach(string str in resultList){
      string[] strArray = str.Split(new char[3] { '(',';', ')' });
      //strArray = Skip(1).Take(4).ToArray();

      double x = double.Parse(strArray[1]);
      double y = double.Parse(strArray[2]);
      double w = double.Parse(strArray[3]) - double.Parse(strArray[1]);
      double h = double.Parse(strArray[4]) - double.Parse(strArray[2]);

      Point3d p3d = new Point3d(x, y, 0);
      Plane p = new Plane(p3d, new Vector3d(0, 0, 1));

      districts.Add(new Rectangle3d(p, w, h));

      try{
        double buildingArea = double.Parse(strArray[7]);
        string area = strArray[6];
        infoList.Add("建筑面积" + Math.Round(buildingArea, 0).ToString() + "\r\n" + "用地面积" + area);
      }catch{
        infoList.Add("");
      }
    }
    Districts = districts;
    info = infoList;
# ---------- end c_script_3 ----------

road_widths = Road_widths([0.3, 0.3, 0.5])
trigger_2 = Trigger(Interval=20, TimerInterval=20, Target=multiagent)  # disabled

list_item_2 = ListItem(List=c_script_3.Color, Index=-1, Wrap=True)
# Display Districts
分区结果 = Curve(c_script_3.Districts)
number_slider_3 = Slider(0.55, range=0..1)
area = Area(Geometry=分区结果)  # -> Area, Centroid
remap_numbers = RemapNumbers(Value=c_script_3.Color, Source=list_item_2, Target=Domain(0, 0.9))  # -> Mapped, Clipped
fillet = Fillet(Curve=分区结果, Radius=0.5)  # -> graft(Curve)
move = Move(Geometry=area.Centroid, Motion=Vector(-0.0003979058363, 0.6541441323, 0))  # -> Geometry, Transform
colour_hsl = ColourHSL(Alpha=0.9, Hue=remap_numbers.Mapped, Saturation=0.6, Luminance=0.6)
boundary_surfaces = BoundarySurfaces(Edges=fillet)  # -> flatten(Surfaces)
text_tag_3d = TextTag3D(Location=area.Centroid, Text=c_script_3.info, Size=expr("x*0.75", number_slider_3), Colour=RGB(0, 0, 0), Justification=5)
text_tag_3d_2 = TextTag3D(Location=move.Geometry, Text=c_script_3.DistrictNames, Size=number_slider_3, Colour=RGB(0, 0, 0), Justification=5)
custom_preview_lineweights_2 = CustomPreviewLineweights(
    Geometry=fillet,
    Shader={diffuse=RGB(255, 255, 255), emission=RGB(0, 0, 0), shine=0, specular=RGB(255, 255, 255), transparency=0},
    Thickness=0.4,
    Absolute=True)  # disabled
custom_preview_4 = CustomPreview(Geometry=boundary_surfaces, Material=colour_hsl)

site = Curve(boundary)
rectangle = Rectangle(c_script_3.Districts)
minus_3 = Curve(<curve referenced from the Rhino model>)
curve = Curve([<curve referenced from the Rhino model> x3])

list_length = ListLength(List=rectangle)
series = Series(Start=Slider(0.7, range=0..10), Step=0, Count=list_length)  # -> simplify(Series)

number = Number(series)

custom_preview_lineweights_3 = CustomPreviewLineweights(
    Geometry=curve,
    Shader={diffuse=RGB(185, 185, 185), emission=RGB(0, 0, 0), shine=0, specular=RGB(255, 255, 255), transparency=0},
    Thickness=expr("20*x", road_widths),
    Absolute=False)
multiagent = MultiAgent(
    Rects=rectangle,
    Site=site,
    Minus=minus_3,
    Roads=curve,
    Road_widths=road_widths,
    Radius=number,
    Random=Toggle(False),
    Packing=Toggle(False),
    Resistance=Slider(0.95, range=0..1),
    Run=Toggle(True),
    Reset=Button())  # -> PointsTree, PointsList

subtraction = Subtraction(A=list_length, B=1)  # disabled
range = Range(Domain=Domain(0, 0.9), Steps=subtraction)  # disabled
colour_hsl_2 = ColourHSL(Alpha=1, Hue=range, Saturation=0.7, Luminance=0.8)  # -> simplify(graft(Colour)); disabled
dot_display_2 = DotDisplay(Point=multiagent.PointsTree, Colour=colour_hsl_2, Size=expr("0*x", graft(series)))  # disabled

circle = Circle(Plane=multiagent.PointsTree, Radius=graft(series))

# ---- group: 提取轮廓线
delaunay_mesh = DelaunayMesh(Points=multiagent.PointsTree, Plane=PlaneXY(0, 0, 0))
face_boundaries = FaceBoundaries(Mesh=delaunay_mesh)  # -> simplify(Boundaries)
number_2 = Number(graft(series))
c_script_4 = CSharpScript(
    polylines=face_boundaries,
    k=Slider(3.75, range=0..6),
    radius=number_2,
    tolerance=Slider(0.14, range=0..0.5),
    Reference=["E:\ONEDRIVE - STU.XMU.EDU.CN\二次布局\ToPmesh\bin\Debug\net48\Plankton.dll", "E:\GRASSHOPPER_C#\Plankton-master\bin\Debug\Plankton.gha"])  # -> out, A, B; inputs polylines: list of Polyline, k: Double, radius: Double, tolerance: Double
# ---------- c_script_4: C# usings ----------
using Plankton;
using PlanktonGh;
# ---------- c_script_4: C# ----------
    pmesh = new PlanktonMesh();
    pVertices = new List<PlanktonXYZ> ();
    List<List<int>> faces = new List<List<int>>();

    int index = 0;
    foreach (Polyline pl in polylines)
    {
      List<int> face = new List<int>();

      double length = pl.SegmentAt(0).Length;
      for(int i = 0;i < pl.GetSegments().Length;i++){
        if(pl.SegmentAt(i).Length > length)
          length = pl.SegmentAt(i).Length;
      }
      if(length > k * radius){
        continue;
      }
      index++;


      for(int j = 0;j < pl.Count - 1;j++)
      {
        var p = pl[j];
        PlanktonXYZ xYZ = new PlanktonXYZ((float) p.X, (float) p.Y, 0);
        if (!pVertices.Contains(xYZ))
        {
          pVertices.Add(xYZ);
        }
        face.Add(pVertices.IndexOf(xYZ));

      }
      faces.Add(face);
    }

    pmesh.Vertices.AddVertices(pVertices);
    pmesh.Faces.AddFaces(faces);

    //取出边缘
    var mesh = pmesh.ToRhinoMesh();
    var bound = mesh.GetNakedEdges()[0];


    bound.MergeColinearSegments(tolerance, true);
    bound.DeleteShortSegments(1);
    var boundry = bound.ToPolylineCurve();
    boundry.ClosedCurveOrientation();
    
    B = boundry.Offset(new Point3d(0,0,0),new Vector3d(0,0,1), radius, 0.1, CurveOffsetCornerStyle.Round);
    //B = Curve.CreateFilletCornersCurve(boundry, radius, 0.1, 0.1);
    
    A = bound;
    //B = boundry;
# ---------- c_script_4: C# additional code ----------
  PlanktonMesh pmesh;
  List<PlanktonXYZ> pVertices;
# ---------- end c_script_4 ----------

# ---- group: 恢复尺寸
curve_2 = Curve(flatten(c_script_4.B))
area_2 = Area(Geometry=curve_2)  # -> Area, Centroid
area_3 = Area(Geometry=rectangle)  # -> Area, Centroid
division = Division(A=area_3.Area, B=area_2.Area)  # -> simplify(Result)
power = Power(A=division, B=0.5)
scale = Scale(Geometry=flatten(curve_2), Center=flatten(area_2.Centroid), Factor=power)  # -> Geometry, Transform
