# Grasshopper definition 写入分区0318(1).gh (Grasshopper 1.0.7)
# plug-ins: Human, MultiAgent

# ---- group: 旋转调整
九龙湖 = Curve(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)
九龙湖road = Curve([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])
九龙湖rect = Rectangle(九龙湖)
c_script = CSharpScript(boundry=九龙湖, rectRef=九龙湖rect)  # -> out, A, B; inputs boundry: Polyline, rectRef: Rectangle3d
# ---------- c_script: C# ----------
    Vector3d ax = rectRef.Corner(1) - rectRef.Corner(0);
    Point3d p = rectRef.Corner(0);
    B = p;
    var var1 = Vector3d.Multiply(ax, new Vector3d(0, 1, 0)) / ax.Length;
    //var t = Math.PI * Math.Sqrt(2) / 2;
    double angle;
    angle = Math.Acos(Math.Abs(var1));
    if(angle > Math.PI / 2){
      angle = Math.PI - angle;
    }
    if(angle > Math.PI / 4){
      angle = angle - Math.PI / 2;
    }
    A = angle;
# ---------- end c_script ----------
rotate = Rotate(Geometry=九龙湖, Angle=c_script.A, Plane=c_script.B)  # -> Geometry, Transform
rotate_2 = Rotate(Geometry=九龙湖road, Angle=c_script.A, Plane=PlaneXY(0, 0, 0))  # -> Geometry, Transform

# ---- group: 求点
# 点不能太多 影响求解时间
number_slider = Slider(0, range=0..1)
offset_curve = OffsetCurve(Curve=rotate.Geometry, Distance=expr("-X", number_slider), Plane=PlaneXY(0, 0, 0), Corners=1)
c_script_2 = CSharpScript(siteEdge=offset_curve)  # -> out, points_inside, points_outside; inputs siteEdge: Polyline
# ---------- c_script_2: C# ----------
    var bdBox = siteEdge.BoundingBox;
    var corner1 = bdBox.Corner(true, true, true);
    var corner2 = bdBox.Corner(false, false, false);

    var frame = new Rectangle3d(Plane.WorldXY,
      new Point3d((int) (corner1.X), (int) (corner1.Y), 0),
      new Point3d(Math.Ceiling(corner2.X) - 1, Math.Ceiling(corner2.Y) - 1, 0));
    List<Point3d> inside = new List<Point3d>();
    List<Point3d> outside = new List<Point3d>();

    var origin = new Point3d((int) (corner1.X ), (int) (corner1.Y), 0);

    for(int i = 0;i <= (int) frame.Width;i++){
      for(int j = 0;j <= (int) frame.Height;j++)
      {
        var p = origin + new Vector3d(i, j, 0);
        var site = siteEdge.ToPolylineCurve();
        var isInside = site.Contains(p, Plane.WorldXY, 0.01) == PointContainment.Inside;

        Print(isInside.ToString());
        if(!isInside){
          outside.Add(p);
        }else{
          inside.Add(p);

        }
      }
    }
    //Frame = frame;
    points_inside = inside;
    points_outside = outside;
# ---------- end c_script_2 ----------

# ----
boundary = Curve(<curve referenced from the Rhino model>)
c_script_3 = CSharpScript(boundry=boundary)  # -> out, A, B; inputs boundry: Polyline; disabled
# ---------- c_script_3: C# usings ----------
using rd = Rhino.NodeInCode;
using Rhino.Geometry.Intersect;
# ---------- c_script_3: C# ----------
    //Flip
    double area = 0;
    for(int i = 0;i < boundry.Count - 1;i++){
      area += boundry[i].X * boundry[i + 1].Y - boundry[i].Y * boundry[i + 1].X;
    }
    if(area < 0){
      Print("Flip");
      var Func = rd.Components.FindComponent("FlipCurve");
      var Func1 = Func.Delegate as dynamic;
      var dry = Func1(boundry, null)[0][0];
      var boundry1 = new Polyline();
      dry.TryGetPolyline(out boundry);

    }
    //oob
    var oob = boundry.BoundingBox;
    var frame = new Rectangle3d(Plane.WorldXY, oob.Corner(false, false, false), oob.Corner(true, true, false));
    A = frame;


    //connexHull
    var pts = new List<Point3d >();
    foreach(Point3d p in boundry){
      pts.Add(p);
    }
    var com = rd.Components.FindComponent("ConvexHull");
    var com1 = com.Delegate as dynamic;
    var convexHull = com1(pts, Plane.WorldXY)[0][0];
    var conH = convexHull.ToPolyline();
    pts.Clear();

    if(conH.Count == boundry.Count){
      Print("凸多边形");
    }else{
      Print("凹多边形");
      GetMinus(boundry, conH, frame);
    }
    B = minus;
# ---------- c_script_3: C# additional code ----------
  List<Rectangle3d> minus = new List<Rectangle3d>();

  void GetMinus(Polyline boundry, Polyline conH, Rectangle3d frame){
    var inside = new List<int>();

    for(int i = 0;i < boundry.Count - 1;i++){
      if(!conH.Contains(boundry[i])){
        inside.Add(i);
      }
    }
    foreach(int i in inside){
      var p1 = boundry[(i - 1 + boundry.Count - 1) % (boundry.Count - 1)];
      var p2 = boundry[(i + 1) % (boundry.Count - 1)];
      Point3d corner = new Point3d();
      for(int j = 0;j < 4;j++){
        corner = frame.Corner(j);
        var line = new Line(corner, boundry[i]);
        var Func = rd.Components.FindComponent("Curve|Line");
        var Func1 = Func.Delegate as dynamic;
        var pt = Func1(boundry.ToPolylineCurve(), line);
        if(pt == null)
          break;
      }


      minus.Add(new Rectangle3d(Plane.WorldXY, boundry[i], corner));

    }
  }
# ---------- end c_script_3 ----------
c_script_4 = CSharpScript()  # -> out
# ---------- c_script_4: C# usings ----------
using rd = Rhino.NodeInCode;
# ---------- c_script_4: C# ----------
    var a = Rhino.NodeInCode.Components.NodeInCodeFunctions.
      GetDynamicMemberNames();
    foreach(string s in a){
      Print(s);
    }
# ---------- end c_script_4 ----------
九龙湖_2 = Curve(<curve referenced from the Rhino model>)
nature = Curve(<curve referenced from the Rhino model>)
boundary_2 = Curve(<curve referenced from the Rhino model>)
_3 = Curve(<curve referenced from the Rhino model>)
road = Line([Line((8.903308015, 26.21939279, 0), (70.9584151, 26.21939279, 0)), Line((62.20637386, 17.74267093, 0), (61.73097677, 76.55086686, 0)), Line((61.73097677, 76.55086686, 0), (25.60906152, 76.55086686, 0)), Line((41.75551246, 76.5276315, 0), (41.77617833, 58.76756066, 0)), Line((68.13463104, 58.88271129, 0), (19.86686994, 58.88271129, 0)), Line((21.17597021, 59.54567656, 0), (21.92250591, 14.32479567, 0))])
roadwidth = Number([1, 1.8, 1.8, 0.6, 1.2, 1.2])
blocks = Rectangle([{Plane=PlaneXY(0.7576661001, 7.370788082, 0), Size=Domain2(u=-3.666487693..3.666487693, v=-5.13308277..5.13308277)}, {Plane=PlaneXY(0.4289465138, 25.77908491, 0), Size=Domain2(u=-3.438912594..3.438912594, v=-7.307689263..7.307689263)}, {Plane=PlaneXY(1.000532946, -3.787419659, 0), Size=Domain2(u=-3.38440583..3.38440583, v=-3.799161446..3.799161446)}, {Plane=PlaneXY(14.62110739, -3.820600108, 0), Size=Domain2(u=-7.747634914..7.747634914, v=-3.699620098..3.699620098)}, {Plane=PlaneXY(34.57999726, -4.049851676, 0), Size=Domain2(u=-5.018030914..5.018030914, v=-3.768643625..3.768643625)}, {Plane=PlaneXY(48.01603106, -4.213705747, 0), Size=Domain2(u=-6.779462174..6.779462174, v=-3.68671659..3.68671659)}])
nature_2 = Curve(<curve referenced from the Rhino model>)

# ----
# 1.Set  SITE
boundary_3 = Curve(<curve referenced from the Rhino model>)
roadwidth_2 = Number([1, 1, 2, 1, 3])
road_2 = Line([Line((56.04005526, 31.45309614, 0), (38.18973546, 34.96078357, 0)), Line((38.1927517, 34.9608598, 0), (1.108533826, 34.04062115, 0)), Line((5.386482585, 37.8160106, 0), (5.671277412, -1.002712247, 0)), Line((2.114958996, 1.260336241, 0), (64.31618969, 1.310832978, 0)), Line((56.38561268, -5.007626741, 0), (56.24474499, 39.92662619, 0))])
entrance = Point([Point(25.72036511, -0.2369978985, 0), Point(55.51391928, 26.82907675, 0), Point(27.64489105, 35.38678529, 0), Point(3.594230188, 14.00395102, 0)])
minus = Rectangle({Plane=PlaneXY(46.62521858, 11.76394952, 0), Size=Domain2(u=-7.358420744..7.358420744, v=-10.9151436..10.9151436)})
file_path = FilePath("G:\grasshopper_C#\test\4.2\site with entrance.csv")
trigger = Trigger(Interval=-1000, TimerInterval=1000, Target=site2csv)  # disabled
site2csv = CSharpScript(
    boundry=boundary_3,
    minus=minus,
    edge=nature_2,
    road=road_2,
    roadWidth=roadwidth_2,
    entrance=entrance,
    fileName=file_path)  # -> out, A, B; inputs boundry: Polyline, minus: list of Rectangle3d, blocks: list of Rectangle3d, edge: list of Curve, road: list of Line, roadWidth: list of Double, entrance: list of Point3d, fileName: String; disabled
# ---------- site2csv: C# usings ----------
using System.IO;
# ---------- site2csv: C# ----------
    var oob = boundry.BoundingBox;
    frame = new Rectangle3d(Plane.WorldXY, oob.Corner(false, false, false), oob.Corner(true, true, false));
    B = frame;
    int digit = 2;//保留位数
    ToMinus(minus, blocks);
    A = minus;

    if ( fileName != null)
    {
      FileStream fs = new FileStream(fileName, FileMode.Create, FileAccess.Write);
      StreamWriter sw = new StreamWriter(fs, System.Text.Encoding.UTF8);

      var strLine = string.Empty;
      var index = 0;

      //写入Boundry
      sw.WriteLine("Boundry");
      foreach(Point3d p in boundry){
        strLine += "(" + Math.Round(p.X, digit) + ";" +
          Math.Round(p.Y, digit) + "),";
      }
      sw.WriteLine(strLine);

      //写入Frame
      sw.WriteLine("Frame");
      sw.WriteLine("(" + Math.Round(frame.Corner(0).X, digit) + ";" +
        Math.Round(frame.Corner(0).Y, digit) + ";" +
        Math.Round(frame.Corner(2).X, digit) + ";" +
        Math.Round(frame.Corner(2).Y, digit) + ")");

      //写入Minus
      WriteRects("Minus", sw, minus, digit);
      //写入block
      if(blocks != null)
        WriteRects("Block", sw, blocks, digit);


      //写入entrance
      WritePoints("Entrance", sw, entrance, digit);

      //写入outsidePoints
      List<Point3d> inside = new List<Point3d>();

      var origin = new Point3d((int) (frame.Corner(0).X ), (int) (frame.Corner(0).Y), 0);
      for(int i = 0;i <= (int) frame.Width;i++){
        for(int j = 0;j <= (int) frame.Height;j++)
        {
          var isInside = false;
          var p = origin + new Vector3d(i, j, 0);
          if(edge != null){
            foreach(Curve e in edge){
              if( e.Contains(p, Plane.WorldXY, 0.01) == PointContainment.Inside){
                isInside = true;
                break;
              }
            }
          }
          var boun = boundry.ToPolylineCurve();
          if(boun.Contains(p) == PointContainment.Outside && road == null)
            isInside = true;
          if(minus != null){

            foreach(Rectangle3d r in minus){
              var minusCur = r.ToNurbsCurve();
              if(minusCur.Contains(p) == PointContainment.Inside)
              {
                isInside = false;
                break;
              }
            }
          }
          if(isInside)
            inside.Add(p);

        }
      }

      WritePoints("OutsidePoints", sw, inside, digit);


      //写入Road
      sw.WriteLine("Road");
      strLine = "";
      index = 0;

      foreach(Line l in road){

        strLine += "(" + Math.Round(l.FromX, digit) + ";"
          + Math.Round(l.FromY, digit)
          + ";" + Math.Round(l.ToX, digit) + ";" +
          Math.Round(l.ToY, digit) + ")" + roadWidth[index] + ";";

        ///与场地是否相交
        var bo = Rhino.Geometry.Intersect.Intersection.
          CurveLine(boundry.ToPolylineCurve(), l, 0, 0);
        var bo1 = Rhino.Geometry.Intersect.Intersection.
          CurveLine(frame.ToNurbsCurve(), l, 0, 0);
        string strTemp = "";
        if(bo.Count == 2){
          Print("道路" + index + "与场地相交");
          strTemp = "2";
          //for(int i = 0;i < bo.Count;i++){
          strTemp += "(" + Math.Round(bo[0].PointA.X, digit)
            + ";" + Math.Round(bo[0].PointA.Y, digit)
            + ";" + Math.Round(bo[0].PointA.X, digit)
            + ";" + Math.Round(bo[0].PointA.Y, digit) + ")";
          //strTemp += "(" +bo[i].PointB.X +";" + bo[i].PointB.Y+")";
          //}
          //Print(strTemp);

        }else if(bo.Count != 2 && bo1.Count == 2){
          var x1 = l.FromX;
          var x2 = l.ToX;
          var y1 = l.FromY;
          var y2 = l.ToY;
          double a,b,c;
          a = (y2 - y1) / (x2 - x1);
          b = -1;
          c = -b * y1 - a * x1;
          var center = boundry.CenterPoint();
          if(a * center.X + b * center.Y + c < 0)
            strTemp = "-1";//线在点下方，去除下方
          if(a * center.X + b * center.Y + c > 0)
            strTemp = "1";//线在点上方，去除上方
        }else{
          strTemp = "0";
        }
        strLine += strTemp + ",";
        index++;
      }
      sw.WriteLine(strLine);

      sw.Close();
      fs.Close();

      B = inside;
    }
# ---------- site2csv: C# additional code ----------
  Rectangle3d frame;

  public void WritePoints(string name, StreamWriter sw, List<Point3d> points, int digit){
    sw.WriteLine(name);
    var strLine = "";
    foreach(Point3d p in points){
      strLine += "(" + Math.Round(p.X, digit) + ";"
        + Math.Round(p.Y, digit) + "),";
    }
    sw.WriteLine(strLine);
  }

  public void WriteLines(string name, StreamWriter sw, List<Line> lines, int digit){

  }
  public void WriteRects(string name, StreamWriter sw, List<Rectangle3d> rects, int digit){
    sw.WriteLine(name);
    var strLine = "";
    foreach(Rectangle3d r in rects){
      double x1 = Math.Round(r.Corner(0).X, digit);
      double y1 = Math.Round(r.Corner(0).Y, digit);
      double x2 = Math.Round(r.Corner(2).X, digit);
      double y2 = Math.Round(r.Corner(2).Y, digit);
      double temp;
      if(x1 > x2){
        temp = x1;
        x1 = x2;
        x2 = temp;
      }
      if(y1 > y2){
        temp = y1;
        y1 = y2;
        y2 = temp;
      }
      strLine += "(" + x1 + ";" + y1 + ";" + x2 + ";" + y2 + "),";
    }
    sw.WriteLine(strLine);
  }

  //与场地相交的block列入minus
  private void ToMinus(List<Rectangle3d> minus, List<Rectangle3d>blocks){

    List<Point3d> points;
    foreach(Rectangle3d rect in blocks){
      var region = Curve.CreateBooleanIntersection
        (rect.ToNurbsCurve(), frame.ToNurbsCurve(), 0.1);

      if(region.Length > 0){
        var a = region[0].ToPolyline(0.1, 0.1, 0.1, 100);
        points = new List<Point3d>();
        for(int i = 0;i < a.PointCount;i++){
          points.Add(a.Point(i));
        }
        var r = Rectangle3d.CreateFromPolyline(points);
        minus.Add(r);
      }
    }
  }
# ---------- end site2csv ----------

# ----
# 2.Get  Districts
resultpath = FilePath("G:\grasshopper_C#\山东师范职业技术\产业\results\location_new5.csv")
读取分区 = CSharpScript(file=resultpath, grid=20, result=Slider(1, range=1..5))  # -> out, DistrictNames, Districts, Color, Core_Groups, Roads_Axis, Widths, info, Layers, FloorAreas; inputs file: String, grid: Double, result: Int32
# ---------- 读取分区: C# ----------
    floorArea = new DataTree<double>();
    layer = new DataTree<int>();
    nameList = new List<string>();
    infoList = new List<string>();
    buildings = new DataTree<Box>();
    groups = new List<Rectangle3d>();

    var fs = new FileStream(file, FileMode.Open, FileAccess.Read);
    var sr = new StreamReader(fs);
    string strLine = " ";
    var resultList = new List<string>();


    //读取分区
    sr.ReadLine();
    while ((strLine = sr.ReadLine()) != null){
      if(strLine.Contains("Rectangle")){
        break;
      }
      Print(strLine.ToString());
      string[] str = strLine.Split(',');
      nameList.Add(str[0]);
      resultList.Add(str[result]);
    }
    var districts = ExportDistrict(resultList, grid);


    //读取矩形结构
    while ((strLine = sr.ReadLine()) != null && strLine.Contains("Rectangle")){
      Print(strLine.ToString());
      string[] str = strLine.Split(',');
      var strArray = str[result].Split(new char[3] { '(',';', ')' });
      groups.Add(ReadRectangle(strArray));
      Print("GroupTrue");
    }

    List<double> widthList = new List<double>();
    List<Line> lines = new List<Line>();
    while ((strLine = sr.ReadLine()) != null){
      if(strLine == "Roads"){
        strLine = sr.ReadLine();
      }
      if(strLine == "Axis"){
        break;
      }
      Print(strLine.ToString());
      string[] str = strLine.Split(',');
      widthList.Add(double.Parse(str[0]));
      var strArray = str[result].Split(new char[3] { '(',';', ')' });
      //lines.Add(ReadLine(strArray));
      double x1 = double.Parse(strArray[1]);
      double y1 = double.Parse(strArray[2]);
      double x2 = double.Parse(strArray[3]);
      double y2 = double.Parse(strArray[4]);
      var line = new Line(x1, y1, 0, x2, y2, 0);
      lines.Add(line);

    }

    //color Num
    List<int> color = new List<int>();
    int temp = 0;
    color.Add(temp);
    for(int i = 1;i < nameList.Count;i++){
      if(nameList[i] != nameList[i - 1]){
        temp++;
      }
      color.Add(temp);
    }
    Color = color;



    Districts = districts;
    DistrictNames = nameList;
    Layers = layer;
    FloorAreas = floorArea;
    info = infoList;
    //Buildings = buildings;
    Core_Groups = groups;
    Roads_Axis = lines;
    Widths = widthList;
# ---------- 读取分区: C# additional code ----------
  DataTree<double> floorArea;
  DataTree<int> layer;
  List<string> nameList;
  List<string> infoList;
  DataTree<Box> buildings;
  List<Rectangle3d> groups;

  public List<Rectangle3d> ExportDistrict(List<string> resultList, double grid){
    var districts = new List<Rectangle3d>();
    int index = 0;
    foreach(string str in resultList){


      string[] strArray = str.Split(new char[3] { '(',';', ')' });
      var rect = ReadRectangle(strArray);
      districts.Add(rect);

      try{
        double buildingArea = double.Parse(strArray[7]);
        string area = strArray[6];
        //infoList.Add("建筑面积" + Math.Round(buildingArea, 0).ToString() +
        //"\r\n" + "用地面积" + area);
        infoList.Add(nameList[index]+": " + area);
      }catch{
        infoList.Add("");
      }

      //建筑信息和绘制建筑
      var path = new GH_Path(index);

      if((strArray.Length - 8) > 0){
        int i = 8;
        double height = 4 / grid;
        double deta = 0.4;

        while(i + 1 < strArray.Length){
          int floor = int.Parse(strArray[i + 1]);
          var f_area = double.Parse(strArray[i]);
          var h1 = f_area / (rect.Width - deta * 2) / grid / grid;

          floorArea.Add(f_area, path);
          layer.Add(floor, path);
          i += 2;

        }

      }else{
        layer.Add(0, path);
        floorArea.Add(0, path);
      }
      index++;
    }
    return districts;
  }

  public Rectangle3d ReadRectangle(string[] strArray){

    double x = double.Parse(strArray[1]);
    double y = double.Parse(strArray[2]);
    double w = double.Parse(strArray[3]) - double.Parse(strArray[1]);
    double h = double.Parse(strArray[4]) - double.Parse(strArray[2]);
    Point3d p3d = new Point3d(x, y, 0);
    Plane p = new Plane(p3d, new Vector3d(0, 0, 1));

    return new Rectangle3d(p, w, h);
  }
# ---------- end 读取分区 ----------

list_item = ListItem(List=读取分区.Core_Groups, Index=0, Wrap=True)

# ---- group: infoList
list_length = ListLength(List=读取分区.info)
series = Series(Start=0, Step=Slider(1.03, range=0..10), Count=list_length)
unit_y = UnitY(Factor=expr("-x", series))
point = Point(Point(41.89817509, 21.62772979, 0))
move = Move(Geometry=point, Motion=unit_y)  # -> Geometry, Transform

# ---- group: structure
dash_pattern = DashPattern(Curve=读取分区.Core_Groups, Pattern=expr("0.8*x", 0.704))  # -> Dashes, Gaps
custom_preview_lineweights = CustomPreviewLineweights(
    Geometry=dash_pattern.Dashes,
    Shader={diffuse=RGB(129, 129, 129), emission=RGB(0, 0, 0), shine=0, specular=RGB(255, 255, 255), transparency=0},
    Thickness=0.3,
    Absolute=True)  # disabled
custom_preview_lineweights_2 = CustomPreviewLineweights(
    Geometry=读取分区.Roads_Axis,
    Shader={diffuse=RGB(255, 0, 0), emission=RGB(0, 0, 0), shine=0, specular=RGB(255, 255, 255), transparency=0},
    Thickness=读取分区.Widths,
    Absolute=True)  # disabled

# ----
line = Line([Line((6.786509099, 14.12015467, 0), (17.73675419, 14.12015467, 0)), Line((25.09947523, 2.505675261, 0), (25.09947523, 9.934878252, 0))])  # disabled
rectangle = Rectangle({Plane=PlaneXY(30.08460499, 26.75076306, 0), Size=Domain2(u=-8.799391539..8.799391539, v=-5.73019683..5.73019683)})

linetype_table = LinetypeTable(Update=True)  # -> Linetypes, LinetypePattern
road_3 = CustomPreviewLineweights(
    Geometry=road_2,
    Shader={diffuse=RGB(129, 129, 129), emission=RGB(0, 0, 0), shine=0, specular=RGB(255, 255, 255), transparency=0},
    Thickness=expr("x*0.6", roadwidth_2),
    Absolute=True)
list_item_2 = ListItem(List=flatten(linetype_table.Linetypes), Index=1, Wrap=True)
dot_display = DotDisplay(Point=entrance, Colour=RGB(0, 0, 0), Size=0.5)
multiplication = Multiplication(A=list_item_2, B=Slider(0.88, range=0..2))
minus_2 = BoundarySurfaces(Edges=minus)
nature_3 = BoundarySurfaces(Edges=nature_2)
buildings = BoundarySurfaces(Edges=blocks)
dash_pattern_2 = DashPattern(Curve=boundary_3, Pattern=multiplication)  # -> Dashes, Gaps
custom_preview = CustomPreview(
    Geometry=minus_2,
    Material={diffuse=RGB(225, 225, 225), emission=RGB(76, 76, 76), shine=0.5, specular=RGB(255, 255, 255), transparency=0})  # disabled
custom_preview_2 = CustomPreview(
    Geometry=buildings,
    Material={diffuse=RGB(225, 225, 225), emission=RGB(0, 0, 0), shine=0, specular=RGB(255, 255, 255), transparency=0})
custom_preview_3 = CustomPreview(
    Geometry=nature_3,
    Material={diffuse=RGB(192, 227, 255), emission=RGB(0, 0, 0), shine=0, specular=RGB(255, 255, 255), transparency=0})
custom_preview_lineweights_3 = CustomPreviewLineweights(
    Geometry=dash_pattern_2.Dashes,
    Shader={diffuse=RGB(0, 0, 0), emission=RGB(0, 0, 0), shine=0.5, specular=RGB(255, 255, 255), transparency=0},
    Thickness=3,
    Absolute=False)

# ----
# 1-1.Display  SITE
road_4 = CustomPreviewLineweights(
    Geometry=road_2,
    Shader={diffuse=RGB(210, 22, 22), emission=RGB(0, 0, 0), shine=0, specular=RGB(255, 255, 255), transparency=0},
    Thickness=expr("x*0.6", 0.2),
    Absolute=True)
# 2-1.Transform
fillet = Fillet(Curve=读取分区.Districts, Radius=0)  # -> graft(Curve)
rectangle_2 = Rectangle(读取分区.Core_Groups)
boolean = Boolean([False, False, False, False])
road_widths = Road_widths([1, 1, 1, 1])
trigger_2 = Trigger(Interval=20, TimerInterval=20, Target=multiagent)  # disabled
minus_3 = BoundarySurfaces(Edges=<geometry referenced from the Rhino model>)
custom_preview_4 = CustomPreview(
    Geometry=minus_3,
    Material={diffuse=RGB(199, 233, 189), emission=RGB(0, 0, 0), shine=0, specular=RGB(255, 255, 255), transparency=0})
panel = Panel(读取分区.DistrictNames)
dot_display_2 = DotDisplay(Colour=RGB(21, 148, 194), Size=0)  # disabled

# ---- group: districtLine
linetype_table_2 = LinetypeTable(Update=True)  # -> Linetypes, LinetypePattern
list_item_3 = ListItem(List=flatten(linetype_table_2.Linetypes), Index=1, Wrap=True)
multiplication_2 = Multiplication(A=list_item_3, B=Slider(0.261, range=0..2))

# ----
integer = Integer(读取分区.Color)
list_item_4 = ListItem(List=integer, Index=-1, Wrap=True)
remap_numbers = RemapNumbers(Value=integer, Source=list_item_4, Target=Domain(0, 0.9))  # -> Mapped, Clipped
colour_hsl = ColourHSL(Alpha=0.9, Hue=remap_numbers.Mapped, Saturation=0.6, Luminance=0.9)

number_slider_2 = Slider(0.8, range=0..1)
site = Curve(boundary_3)
rectangle_3 = Rectangle(读取分区.Districts)
list_length_2 = ListLength(List=rectangle_3)
series_2 = Series(Start=Slider(0.4, range=0..1), Step=0, Count=list_length_2)  # -> simplify(Series)
curve = Curve([<curve referenced from the Rhino model> x4])
minus_4 = Curve([<curve referenced from the Rhino model> x2])
number = Number(series_2)

multiagent = MultiAgent(
    Rects=rectangle_3,
    Site=site,
    Minus=minus_4,
    Roads=curve,
    Road_widths=road_widths,
    Cutters=boolean,
    Radius=number,
    Packing=Toggle(False),
    Resistance=Slider(0.92, range=0..1),
    Run=Toggle(True),
    Reset=Button())  # -> PointsTree, PointsList
road_5 = CustomPreviewLineweights(
    Geometry=curve,
    Shader={diffuse=RGB(217, 0, 0), emission=RGB(0, 0, 0), shine=0, specular=RGB(255, 255, 255), transparency=0},
    Thickness=expr("x*0.2", road_widths),
    Absolute=True)
road_6 = CustomPreviewLineweights(
    Geometry=curve,
    Shader={diffuse=RGB(185, 185, 185), emission=RGB(0, 0, 0), shine=0, specular=RGB(255, 255, 255), transparency=0},
    Thickness=expr("0.8", road_widths),
    Absolute=True)

circle = Circle(Plane=multiagent.PointsTree, Radius=graft(series_2))

custom_preview_lineweights_4 = CustomPreviewLineweights(
    Geometry=multiagent.PointsTree,
    Shader={diffuse=RGB(93, 154, 206), emission=RGB(0, 0, 0), shine=0, specular=RGB(255, 255, 255), transparency=0},
    Thickness=3,
    Absolute=False)  # disabled
buildings_2 = BoundarySurfaces(Edges=minus_4)  # disabled

# ---- group: 提取轮廓线
number_2 = Number(simplify(graft(series_2)))
提取轮廓线 = CSharpScript(
    points=multiagent.PointsTree,
    k=Slider(5.29, range=0..6),
    radius=number_2,
    tolerance=Slider(0.18, range=0..0.5),
    deleteMin=Slider(0.69, range=0..1),
    fillet=Toggle(True),
    Reference=["E:\ONEDRIVE - STU.XMU.EDU.CN\二次布局\ToPmesh\bin\Debug\net48\Plankton.dll", "E:\GRASSHOPPER_C#\Plankton-master\bin\Debug\Plankton.gha"])  # -> out, simplify(C), Boundry, simplify(DistrictCur); inputs points: list of Point3d, k: Double, radius: Double, tolerance: Double, deleteMin: Double, fillet: Boolean
# ---------- 提取轮廓线: C# usings ----------
using Plankton;
using PlanktonGh;
using rd = Rhino.NodeInCode;
# ---------- 提取轮廓线: C# ----------
    //从点建立mesh
    var func = rd.Components.FindComponent("DelaunayMesh");
    var func1 = func.Delegate as dynamic;
    var initialMesh = func1(points, Plane.WorldXY);

    func = rd.Components.FindComponent("FaceBoundaries");
    func1 = func.Delegate as dynamic;
    var polylines = func1(initialMesh);
    C = polylines;

    //建立Pmesh
    pmesh = new PlanktonMesh();
    pVertices = new List<PlanktonXYZ> ();
    List<List<int>> faces = new List<List<int>>();

    int index = 0;
    foreach (PolylineCurve plC in polylines)
    {
      Polyline pl;
      plC.TryGetPolyline(out pl);
      List<int> face = new List<int>();

      double length = pl.SegmentAt(0).Length;
      for(int i = 0;i < pl.GetSegments().Length;i++){
        if(pl.SegmentAt(i).Length > length)
          length = pl.SegmentAt(i).Length;
      }
      if(length > k * radius){
        continue;
      }
      index++;


      for(int j = 0;j < pl.Count - 1;j++)
      {
        var p = pl[j];
        PlanktonXYZ xYZ = new PlanktonXYZ((float) p.X, (float) p.Y, 0);
        if (!pVertices.Contains(xYZ))
        {
          pVertices.Add(xYZ);
        }
        face.Add(pVertices.IndexOf(xYZ));

      }
      faces.Add(face);
    }

    pmesh.Vertices.AddVertices(pVertices);
    pmesh.Faces.AddFaces(faces);

    //取出边缘
    var mesh = pmesh.ToRhinoMesh();
    var bound = mesh.GetNakedEdges()[0];
    Boundry = bound;

    bound.MergeColinearSegments(tolerance, true);
    bound.DeleteShortSegments(deleteMin);
    var boundry = bound.ToPolylineCurve();
    boundry.ClosedCurveOrientation();

    if(fillet){
      DistrictCur = boundry.Offset(new Point3d(0, 0, 0),
        new Vector3d(0, 0, 1), radius, 0.1, CurveOffsetCornerStyle.Round);
    }else{
      DistrictCur = boundry.Offset(new Point3d(0, 0, 0),
        new Vector3d(0, 0, 1), radius, 0.1, CurveOffsetCornerStyle.Sharp);
    }
# ---------- 提取轮廓线: C# additional code ----------
  PlanktonMesh pmesh;
  List<PlanktonXYZ> pVertices;
# ---------- end 提取轮廓线 ----------

# ----
# 3.Display Districts
分区结果 = Curve(simplify(提取轮廓线.DistrictCur))

boundary_surfaces = BoundarySurfaces(Edges=分区结果)
custom_preview_5 = CustomPreview(Geometry=flatten(boundary_surfaces), Material=colour_hsl)

# ---- group: building
显示体量 = CSharpScript(districtCur=分区结果, height=4.8, layers=读取分区.Layers, floorAreas=读取分区.FloorAreas, grid=20)  # -> Center, Layer, A, B; inputs districtCur: Curve, height: Double, layers: list of Int32, floorAreas: list of Double, grid: Double
# ---------- 显示体量: C# usings ----------
using rd = Rhino.NodeInCode;
[ObsoleteAttribute("Use version that takes tolerance as input")]
# ---------- 显示体量: C# ----------
    var func = rd.Components.FindComponent("Area");
    var func1 = func.Delegate as dynamic;

    var area = func1(districtCur)[0][0];
    var center = func1(districtCur)[1][0];

    double floorAll = 0;
    double l = 0;
    for(int i = 0; i < floorAreas.Count;i++){
      floorAll += floorAreas[i];

    }
    for(int i = 0; i < floorAreas.Count;i++){
      l += layers[i] * floorAreas[i] / floorAll;

    }
    int layer = (int) l;
    if(floorAll > 0){
      double k = Math.Sqrt(floorAll / grid / grid / area);
      var a = Transform.Scale(center, k);
      districtCur.Transform(a);


      func = rd.Components.FindComponent("Extrude");
      func1 = func.Delegate as dynamic;
      var breps = func1(districtCur, new Vector3d(0, 0, l * height / grid));


      if(breps != null){

        func = rd.Components.FindComponent("CapHoles");
        func1 = func.Delegate as dynamic;
        var building = func1(breps[0]);
        B = building;
      }
      A = districtCur;
      func = rd.Components.FindComponent("LinearArray");
      func1 = func.Delegate as dynamic;
      var vec = new Vector3d(0, 0, height / grid);
      var curs = func1(districtCur, vec, layer+1)[0];
      A = curs;

    }
    Center = center;
    Layer = layer;
# ---------- end 显示体量 ----------
custom_preview_lineweights_5 = CustomPreviewLineweights(
    Geometry=显示体量.A,
    Shader={diffuse=RGB(185, 185, 185), emission=RGB(0, 0, 0), shine=0, specular=RGB(255, 255, 255), transparency=0},
    Thickness=0.5,
    Absolute=False)
custom_preview_6 = CustomPreview(Geometry=flatten(显示体量.B), Material=colour_hsl)

# ---- group: districtLine (continued)
dash_pattern_3 = DashPattern(Curve=分区结果, Pattern=multiplication_2)  # -> Dashes, Gaps
custom_preview_lineweights_6 = CustomPreviewLineweights(
    Geometry=dash_pattern_3.Dashes,
    Shader={diffuse=RGB(0, 0, 0), emission=RGB(0, 0, 0), shine=0.5, specular=RGB(255, 255, 255), transparency=0},
    Thickness=0.15,
    Absolute=True)

# ---- group: Highlight
highlight = Index([0, 1, 2, 12])  # disabled
highlight_2 = Index([7, 6, 8, 13, 11])  # disabled
highlight_3 = Index([14, 15, 16, 17, 18])  # disabled
list_item_5 = ListItem(List=flatten(分区结果), Index=highlight, Wrap=True)  # disabled
list_item_6 = ListItem(List=flatten(分区结果), Index=highlight_2, Wrap=True)  # disabled
list_item_7 = ListItem(List=flatten(分区结果), Index=highlight_3, Wrap=True)  # disabled
boundary_surfaces_2 = BoundarySurfaces(Edges=list_item_5)  # disabled
boundary_surfaces_3 = BoundarySurfaces(Edges=list_item_6)  # disabled
boundary_surfaces_4 = BoundarySurfaces(Edges=list_item_7)  # disabled
custom_preview_7 = CustomPreview(
    Geometry=flatten(boundary_surfaces_2),
    Material={diffuse=RGB(203, 199, 249), emission=RGB(0, 0, 0), shine=0, specular=RGB(255, 255, 255), transparency=0})  # disabled
custom_preview_8 = CustomPreview(
    Geometry=flatten(boundary_surfaces_3),
    Material={diffuse=RGB(244, 187, 159), emission=RGB(0, 0, 0), shine=0, specular=RGB(255, 255, 255), transparency=0})  # disabled
custom_preview_9 = CustomPreview(
    Geometry=flatten(boundary_surfaces_4),
    Material={diffuse=RGB(146, 222, 145), emission=RGB(0, 0, 0), shine=0, specular=RGB(255, 255, 255), transparency=0})  # disabled

# ----
area = Area(Geometry=分区结果)  # -> Area, Centroid

# ---- group: 恢复尺寸
curve_2 = Curve(flatten(提取轮廓线.DistrictCur))
area_2 = Area(Geometry=rectangle_3)  # -> Area, Centroid
area_3 = Area(Geometry=curve_2)  # -> Area, Centroid
division = Division(A=area_2.Area, B=area_3.Area)  # -> simplify(Result)
power = Power(A=division, B=0.5)
scale = Scale(Geometry=flatten(curve_2), Center=flatten(area_3.Centroid), Factor=power)  # -> Geometry, Transform

# ----
subtraction = Subtraction(A=list_length_2, B=1)  # disabled
range = Range(Domain=Domain(0, 0.9), Steps=subtraction)  # disabled
colour_hsl_2 = ColourHSL(Alpha=1, Hue=range, Saturation=0.7, Luminance=0.8)  # -> simplify(graft(Colour)); disabled
dot_display_3 = DotDisplay(Colour=colour_hsl_2, Size=expr("0*x", graft(series_2)))  # disabled

multiplication_3 = Multiplication(A=area.Area, B=400)
custom_preview_10 = CustomPreview(
    Geometry=buildings_2,
    Material={diffuse=RGB(198, 227, 250), emission=RGB(0, 0, 0), shine=0, specular=RGB(255, 255, 255), transparency=0})  # disabled
integer_2 = Integer(multiplication_3)
merge = Merge(Data1=simplify(graft(panel)), Data2=simplify(graft(integer_2)))
text_join = TextJoin(Text=merge)  # -> flatten(Result)

point_2 = Point(flatten(显示体量.Center))
number_slider_3 = Slider(0.84, range=0..2)
move_2 = Move(Geometry=point_2, Motion=Vector(-0.0003979058363, 0.6541441323, 0))  # -> Geometry, Transform
text_tag_3d = TextTag3D(Location=point_2, Text=读取分区.DistrictNames, Size=expr("0.7*x", number_slider_3), Colour=RGB(0, 0, 0), Justification=5)
text_tag_3d_2 = TextTag3D(Location=move.Geometry, Text=text_join, Size=expr("x*0.75", number_slider_3), Colour=RGB(0, 0, 0), Justification=7)
