# Grasshopper definition 写入分区0430.gh (Grasshopper 1.0.7)
# plug-ins: Human, MultiAgent

area = Area(Geometry=<brep referenced from the Rhino model>)  # -> Area, Centroid
area_2 = Area(Geometry=[<curve referenced from the Rhino model> x3])  # -> Area, Centroid
mass_addition = MassAddition(Input=area_2.Area)  # -> Result, PartialResults
division = Division(A=area_2.Area, B=Slider(201, range=0..1000))
multiplication = Multiplication(A=division, B=area.Area)
division_2 = Division(A=multiplication, B=area_2.Area)
square_root = SquareRoot(Value=division_2)

_3 = Curve(<curve referenced from the Rhino model>)
offset_curve = OffsetCurve(Curve=_3, Distance=-0.1, Plane=PlaneXY(0, 0, 0), Corners=1)
explode = Explode(Curve=offset_curve, Recursive=True)  # -> Segments, Vertices
line = Line(Line((127.6370177, 27.18905721, 0), (161.226118, 31.34274374, 0)))
line_2 = Line(explode.Segments)
_3_2 = Curve(<curve referenced from the Rhino model>)
merge = Merge(Data1=flatten(line_2), Data2=line)
提取凹部矩形 = CSharpScript(boundry=_3)  # -> out, A, B; inputs boundry: Polyline
# ---------- 提取凹部矩形: C# usings ----------
using rd = Rhino.NodeInCode;
using Rhino.Geometry.Intersect;
# ---------- 提取凹部矩形: C# ----------
    //Flip
    double area = 0;
    for(int i = 0;i < boundry.Count - 1;i++){
      area += boundry[i].X * boundry[i + 1].Y - boundry[i].Y * boundry[i + 1].X;
    }
    if(area < 0){
      Print("Flip");
      var Func = rd.Components.FindComponent("FlipCurve");
      var Func1 = Func.Delegate as dynamic;
      var dry = Func1(boundry, null)[0][0];
      var boundry1 = new Polyline();
      dry.TryGetPolyline(out boundry);

    }
    //oob
    var oob = boundry.BoundingBox;
    var frame = new Rectangle3d(Plane.WorldXY, oob.Corner(false, false, false), oob.Corner(true, true, false));
    A = frame;


    //connexHull
    var pts = new List<Point3d >();
    foreach(Point3d p in boundry){
      pts.Add(p);
    }
    var com = rd.Components.FindComponent("ConvexHull");
    var com1 = com.Delegate as dynamic;
    var convexHull = com1(pts, Plane.WorldXY)[0][0];
    var conH = convexHull.ToPolyline();
    pts.Clear();

    if(conH.Count == boundry.Count){
      Print("凸多边形");
    }else{
      Print("凹多边形");
      GetMinus(boundry, conH, frame);
    }
    B = minus;
    //C = lines;
# ---------- 提取凹部矩形: C# additional code ----------
  List<Rectangle3d> minus = new List<Rectangle3d>();
  List<Line> lines = new List<Line>();

  void GetMinus(Polyline boundry, Polyline conH, Rectangle3d frame){
    var inside = new List<int>();

    for(int i = 0;i < boundry.Count - 1;i++){
      if(!conH.Contains(boundry[i])){
        inside.Add(i);
      }
    }
    foreach(int i in inside){
      var p1 = boundry[(i - 1 + boundry.Count - 1) % (boundry.Count - 1)];
      var p2 = boundry[(i + 1) % (boundry.Count - 1)];

      Point3d corner = new Point3d();//角点
      for(int j = 0;j < 4;j++){
        corner = frame.Corner(j);
        var line = new Line(corner, boundry[i]);
        lines.Add(line);
        var Func = rd.Components.FindComponent("Curve|Curve");
        var Func1 = Func.Delegate as dynamic;
        var pt = Func1(boundry.ToPolylineCurve(),line);
        Print(pt[0].Count.ToString());
        if(pt[0].Count <2){
          var tempMinus = new Rectangle3d(Plane.WorldXY, boundry[i], corner);
          if(Func1(boundry.ToPolylineCurve(), tempMinus)[0].Count < 2){
            minus.Add(new Rectangle3d(Plane.WorldXY, boundry[i], corner));
            break;
          }
        }
      }
    }
  }
# ---------- end 提取凹部矩形 ----------
file_path = FilePath("G:\grasshopper_C#\test\4.1\site3N.csv")
site2csv = CSharpScript(boundry=_3, minus=提取凹部矩形.B, road=merge, roadWidth=[0, 0, 0, 0, 0, 0, 0, 0, 0.6], fileName=file_path)  # -> out, A, B; inputs boundry: Polyline, minus: list of Rectangle3d, blocks: list of Rectangle3d, edge: list of Curve, road: list of Line, roadWidth: list of Double, entrance: list of Point3d, fileName: String; disabled
# ---------- site2csv: C# usings ----------
using System.IO;
# ---------- site2csv: C# ----------
    var oob = boundry.BoundingBox;
    frame = new Rectangle3d(Plane.WorldXY, oob.Corner(false, false, false), oob.Corner(true, true, false));
    B = frame;
    int digit = 2;//保留位数
    ToMinus(minus, blocks);
    A = minus;

    if (fileName != null)
    {
      FileStream fs = new FileStream(fileName, FileMode.Create, FileAccess.Write);
      StreamWriter sw = new StreamWriter(fs, System.Text.Encoding.UTF8);

      var strLine = string.Empty;
      var index = 0;

      //写入Boundry
      sw.WriteLine("Boundry");
      foreach(Point3d p in boundry){
        strLine += "(" + Math.Round(p.X, digit) + ";" +
          Math.Round(p.Y, digit) + "),";
      }
      sw.WriteLine(strLine);

      //写入Frame
      sw.WriteLine("Frame");
      sw.WriteLine("(" + Math.Round(frame.Corner(0).X, digit) + ";" +
        Math.Round(frame.Corner(0).Y, digit) + ";" +
        Math.Round(frame.Corner(2).X, digit) + ";" +
        Math.Round(frame.Corner(2).Y, digit) + ")");

      //写入Minus
      WriteRects("Minus", sw, minus, digit);
      //写入block
      if(blocks != null)
        WriteRects("Block", sw, blocks, digit);


      //写入entrance
      WritePoints("Entrance", sw, entrance, digit);

      //写入outsidePoints
      if(edge != null){
        List<Point3d> inside = new List<Point3d>();

        var origin = new Point3d((int) (frame.Corner(0).X ), (int) (frame.Corner(0).Y), 0);

        for(int i = 0;i <= (int) frame.Width;i++){
          for(int j = 0;j <= (int) frame.Height;j++)
          {
            foreach(Curve e in edge){
              var p = origin + new Vector3d(i, j, 0);
              var isInside = e.Contains(p, Plane.WorldXY, 0.01) == PointContainment.Inside;
              //Print(isInside.ToString());
              if(isInside){
                inside.Add(p);

              }
            }
          }
        }
        A = inside;
        WritePoints("OutsidePoints", sw, inside, digit);
      }

      //写入Road
      sw.WriteLine("Road");
      strLine = "";
      index = 0;

      var tempPoiList = new List<Point3d>();//
      foreach(Line l in road){

        strLine += "(" + Math.Round(l.FromX, digit) + ";"
          + Math.Round(l.FromY, digit)
          + ";" + Math.Round(l.ToX, digit) + ";" +
          Math.Round(l.ToY, digit) + ")" + roadWidth[index] + ";";

        ///直线与场地是否相交
        var bo = Rhino.Geometry.Intersect.Intersection.
          CurveLine(boundry.ToPolylineCurve(), l, 0, 0);
        var bo1 = Rhino.Geometry.Intersect.Intersection.
          CurveLine(frame.ToNurbsCurve(), l, 0, 0);

        //线段是否相交
        bool inter = false;
        int n = 5;
        var dx = (l.ToX - l.FromX) / n;
        var dy = (l.ToY - l.FromY) / n;
        for(int i = 0;i < n;i++){
          var p = new Point3d(l.FromX + i * dx, l.FromY + i * dy, l.FromZ);
          tempPoiList.Add(p);
          if(boundry.ToPolylineCurve().Contains(p) == PointContainment.Inside){
            inter = true;
            break;
          }
        }

        string strTemp = "";
        //完全不相交
        if(bo1.Count < 2){
          strTemp = "0";
        }
          //道路存在部分在边界内，需避开=2
        else if(bo.Count == 2 && inter ){

          Print("道路" + index + "与场地相交");
          strTemp = "2";
          strTemp += "(" + Math.Round(bo[0].PointA.X, digit)
            + ";" + Math.Round(bo[0].PointA.Y, digit)
            + ";" + Math.Round(bo[0].PointA.X, digit)
            + ";" + Math.Round(bo[0].PointA.Y, digit) + ")";
        }
        else{
          //道路切割一部分=+1/-1
          var x1 = l.FromX;
          var x2 = l.ToX;
          var y1 = l.FromY;
          var y2 = l.ToY;
          double a,b,c;
          if(x1 != x2){
            a = (y2 - y1) / (x2 - x1);
            b = -1;
          }else{
            b = 0;
            a = -1;
          }
          c = -b * y1 - a * x1;

          //直线相交但线段不相交的情况,做切割线
          //找最近点
          Point3d testPoi = boundry.CenterPoint();
          if(bo.Count == 2){
            var mid = new Point3d((l.FromX + l.ToX) / 2, (l.FromY + l.ToY) / 2, l.ToZ);
            testPoi = boundry.ClosestPoint(mid);
          }
          //判断在上or下
          if(a * testPoi.X + b * testPoi.Y + c < 0){
            strTemp = "-1";//线在点上方，去除下方
            Print("道路" + index + "=-1");
          }
          if(a * testPoi.X + b * testPoi.Y + c > 0){
            strTemp = "1";//线在点下方，去除上方
            Print("道路" + index + "=1");
          }
        }

        strLine += strTemp + ",";
        index++;
      }
      sw.WriteLine(strLine);

      sw.Close();
      fs.Close();
      //A = tempPoiList;
    }
# ---------- site2csv: C# additional code ----------
  Rectangle3d frame;

  public void WritePoints(string name, StreamWriter sw, List<Point3d > points, int digit){
    sw.WriteLine(name);
    var strLine = "";
    foreach(Point3d p in points){
      strLine += "(" + Math.Round(p.X, digit) + ";"
        + Math.Round(p.Y, digit) + "),";
    }
    sw.WriteLine(strLine);
  }

  public void WriteLines(string name, StreamWriter sw, List<Line > lines, int digit){

  }
  public void WriteRects(string name, StreamWriter sw, List<Rectangle3d > rects, int digit){
    sw.WriteLine(name);
    var strLine = "";
    foreach(Rectangle3d r in rects){
      double x1 = Math.Round(r.Corner(0).X, digit);
      double y1 = Math.Round(r.Corner(0).Y, digit);
      double x2 = Math.Round(r.Corner(2).X, digit);
      double y2 = Math.Round(r.Corner(2).Y, digit);
      double temp;
      if(x1 > x2){
        temp = x1;
        x1 = x2;
        x2 = temp;
      }
      if(y1 > y2){
        temp = y1;
        y1 = y2;
        y2 = temp;
      }
      strLine += "(" + x1 + ";" + y1 + ";" + x2 + ";" + y2 + "),";
    }
    sw.WriteLine(strLine);
  }

  //与场地相交的block列入minus
  private void ToMinus(List < Rectangle3d > minus, List<Rectangle3d> blocks){

    List<Point3d> points;
    foreach(Rectangle3d rect in blocks){
      var region = Curve.CreateBooleanIntersection
        (rect.ToNurbsCurve(), frame.ToNurbsCurve(), 0.1);

      if(region.Length > 0){
        var a = region[0].ToPolyline(0.1, 0.1, 0.1, 100);
        points = new List<Point3d>();
        for(int i = 0;i < a.PointCount;i++){
          points.Add(a.Point(i));
        }
        var r = Rectangle3d.CreateFromPolyline(points);
        minus.Add(r);
      }
    }
  }
# ---------- end site2csv ----------
panel = Panel(site2csv.out)

# ---- group: 旋转调整
九龙湖 = Curve(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)
九龙湖road = Curve([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])
九龙湖rect = Rectangle(九龙湖)
c_script = CSharpScript(boundry=九龙湖, rectRef=九龙湖rect)  # -> out, A, B; inputs boundry: Polyline, rectRef: Rectangle3d
# ---------- c_script: C# ----------
    Vector3d ax = rectRef.Corner(1) - rectRef.Corner(0);
    Point3d p = rectRef.Corner(0);
    B = p;
    var var1 = Vector3d.Multiply(ax, new Vector3d(0, 1, 0)) / ax.Length;
    //var t = Math.PI * Math.Sqrt(2) / 2;
    double angle;
    angle = Math.Acos(Math.Abs(var1));
    if(angle > Math.PI / 2){
      angle = Math.PI - angle;
    }
    if(angle > Math.PI / 4){
      angle = angle - Math.PI / 2;
    }
    A = angle;
# ---------- end c_script ----------
rotate = Rotate(Geometry=九龙湖, Angle=c_script.A, Plane=c_script.B)  # -> Geometry, Transform
rotate_2 = Rotate(Geometry=九龙湖road, Angle=c_script.A, Plane=PlaneXY(0, 0, 0))  # -> Geometry, Transform

# ---- group: 求点
# 点不能太多 影响求解时间
number_slider = Slider(0, range=0..1)
offset_curve_2 = OffsetCurve(Curve=rotate.Geometry, Distance=expr("-X", number_slider), Plane=PlaneXY(0, 0, 0), Corners=1)
c_script_2 = CSharpScript(siteEdge=offset_curve_2)  # -> out, points_inside, points_outside; inputs siteEdge: Polyline
# ---------- c_script_2: C# ----------
    var bdBox = siteEdge.BoundingBox;
    var corner1 = bdBox.Corner(true, true, true);
    var corner2 = bdBox.Corner(false, false, false);

    var frame = new Rectangle3d(Plane.WorldXY,
      new Point3d((int) (corner1.X), (int) (corner1.Y), 0),
      new Point3d(Math.Ceiling(corner2.X) - 1, Math.Ceiling(corner2.Y) - 1, 0));
    List<Point3d> inside = new List<Point3d>();
    List<Point3d> outside = new List<Point3d>();

    var origin = new Point3d((int) (corner1.X ), (int) (corner1.Y), 0);

    for(int i = 0;i <= (int) frame.Width;i++){
      for(int j = 0;j <= (int) frame.Height;j++)
      {
        var p = origin + new Vector3d(i, j, 0);
        var site = siteEdge.ToPolylineCurve();
        var isInside = site.Contains(p, Plane.WorldXY, 0.01) == PointContainment.Inside;

        Print(isInside.ToString());
        if(!isInside){
          outside.Add(p);
        }else{
          inside.Add(p);

        }
      }
    }
    //Frame = frame;
    points_inside = inside;
    points_outside = outside;
# ---------- end c_script_2 ----------

# ----
c_script_3 = CSharpScript()  # -> out
# ---------- c_script_3: C# usings ----------
using rd = Rhino.NodeInCode;
# ---------- c_script_3: C# ----------
    var a = Rhino.NodeInCode.Components.NodeInCodeFunctions.
      GetDynamicMemberNames();
    foreach(string s in a){
      Print(s);
    }
# ---------- end c_script_3 ----------
road = CustomPreviewLineweights(
    Geometry=line,
    Shader={diffuse=RGB(210, 22, 22), emission=RGB(0, 0, 0), shine=0, specular=RGB(255, 255, 255), transparency=0},
    Thickness=1,
    Absolute=True)
file_path_2 = FilePath(["E:\grasshopper_C#\test\4.3\locationC21.csv", "E:\grasshopper_C#\test\4.3\locationC22.csv", "E:\grasshopper_C#\test\4.3\locationC23.csv", "E:\grasshopper_C#\test\4.3\locationC24.csv", "E:\grasshopper_C#\test\4.3\locationC25.csv"])

resultpath = FilePath("E:\grasshopper_C#\test\4.3\locationAT2.csv")
读取分区 = CSharpScript(file=resultpath, grid=20, result=Slider(1, range=1..5))  # -> out, DistrictNames, Districts, Color, Core_Groups, Roads_Axis, Widths, flatten(BuildingArea), Layers, FloorAreas; inputs file: String, grid: Double, result: Int32
# ---------- 读取分区: C# ----------
    floorArea = new DataTree<double>();
    layer = new DataTree<int>();
    nameList = new List<string>();
    infoList = new List<double>();
    buildings = new DataTree<Box>();
    groups = new List<Rectangle3d>();

    var fs = new FileStream(file, FileMode.Open, FileAccess.Read);
    var sr = new StreamReader(fs);
    string strLine = " ";
    var resultList = new List<string>();


    //读取分区
    sr.ReadLine();
    while ((strLine = sr.ReadLine()) != null){
      if(strLine.Contains("Rectangle")){
        break;
      }
      Print(strLine.ToString());
      string[] str = strLine.Split(',');
      nameList.Add(str[0]);
      resultList.Add(str[result]);
    }
    var districts = ExportDistrict(resultList, grid);


    //读取矩形结构
    while ((strLine = sr.ReadLine()) != null && strLine.Contains("Rectangle")){
      Print(strLine.ToString());
      string[] str = strLine.Split(',');
      var strArray = str[result].Split(new char[3] { '(',';', ')' });
      groups.Add(ReadRectangle(strArray));
      Print("GroupTrue");
    }

    List<double> widthList = new List<double>();
    List<Line> lines = new List<Line>();
    while ((strLine = sr.ReadLine()) != null){
      if(strLine == "Roads"){
        strLine = sr.ReadLine();
      }
      if(strLine == "Axis"){
        break;
      }
      Print(strLine.ToString());
      string[] str = strLine.Split(',');
      widthList.Add(double.Parse(str[0]));
      var strArray = str[result].Split(new char[3] { '(',';', ')' });
      //lines.Add(ReadLine(strArray));
      double x1 = double.Parse(strArray[1]);
      double y1 = double.Parse(strArray[2]);
      double x2 = double.Parse(strArray[3]);
      double y2 = double.Parse(strArray[4]);
      var line = new Line(x1, y1, 0, x2, y2, 0);
      lines.Add(line);

    }

    //color Num
    List<int> color = new List<int>();
    int temp = 0;
    color.Add(temp);
    for(int i = 1;i < nameList.Count;i++){
      if(nameList[i] != nameList[i - 1]){
        temp++;
      }
      color.Add(temp);
    }
    Color = color;



    Districts = districts;
    DistrictNames = nameList;
    Layers = layer;
    FloorAreas = floorArea;
    BuildingArea = infoList;
    //Buildings = buildings;
    Core_Groups = groups;
    Roads_Axis = lines;
    Widths = widthList;
# ---------- 读取分区: C# additional code ----------
  DataTree<double> floorArea;
  DataTree<int> layer;
  List<string> nameList;
  List<double> infoList;
  DataTree<Box> buildings;
  List<Rectangle3d> groups;

  public List<Rectangle3d> ExportDistrict(List<string> resultList, double grid){
    var districts = new List<Rectangle3d>();
    int index = 0;
    foreach(string str in resultList){


      string[] strArray = str.Split(new char[3] { '(',';', ')' });
      var rect = ReadRectangle(strArray);
      districts.Add(rect);

      try{
        double buildingArea = double.Parse(strArray[7]);
        string area = strArray[6];
        infoList.Add(Math.Round(buildingArea, 0));
      }catch{
        infoList.Add(-1);
      }

      //建筑信息和绘制建筑
      var path = new GH_Path(index);

      if((strArray.Length - 8) > 0){
        int i = 8;
        double height = 4 / grid;
        double deta = 0.4;

        //double y1 = y + deta;
        while(i + 1 < strArray.Length){
          int floor = int.Parse(strArray[i + 1]);
          //double z = 0;
          var f_area = double.Parse(strArray[i]);
          var h1 = f_area / (rect.Width - deta * 2) / grid / grid;

          //for(int f = 0;f < floor;f++){
          //var xRange = new Interval(x + deta, x + w - deta);
          //var yRange = new Interval(y1, y1 + h1);
          //var zRange = new Interval(z, z + height);
          //buildings.Add(new Box(Plane.WorldXY, xRange, yRange, zRange), path);
          //z += height;
          //}
          floorArea.Add(f_area, path);
          layer.Add(floor, path);
          i += 2;
          //y1 += h1 / 2;
        }

      }else{
        layer.Add(0, path);
        floorArea.Add(0, path);
      }
      index++;
    }
    return districts;
  }

  public Rectangle3d ReadRectangle(string[] strArray){

    double x = double.Parse(strArray[1]);
    double y = double.Parse(strArray[2]);
    double w = double.Parse(strArray[3]) - double.Parse(strArray[1]);
    double h = double.Parse(strArray[4]) - double.Parse(strArray[2]);
    Point3d p3d = new Point3d(x, y, 0);
    Plane p = new Plane(p3d, new Vector3d(0, 0, 1));

    return new Rectangle3d(p, w, h);
  }
# ---------- end 读取分区 ----------

text = Text(simplify(graft(读取分区.DistrictNames)))
九龙湖_2 = Curve(<curve referenced from the Rhino model>)
boundary = Curve(<curve referenced from the Rhino model>)
nature = Curve(<curve referenced from the Rhino model>)
road_2 = Line([Line((8.903308015, 26.21939279, 0), (70.9584151, 26.21939279, 0)), Line((62.20637386, 17.74267093, 0), (61.73097677, 76.55086686, 0)), Line((61.73097677, 76.55086686, 0), (25.60906152, 76.55086686, 0)), Line((41.75551246, 76.5276315, 0), (41.77617833, 58.76756066, 0)), Line((68.13463104, 58.88271129, 0), (19.86686994, 58.88271129, 0)), Line((21.17597021, 59.54567656, 0), (21.92250591, 14.32479567, 0))])
roadwidth = Number([1, 1.8, 1.8, 0.6, 1.2, 1.2])
nature_2 = Curve(nature)

road_3 = Line([Line((-9.76027351, 34.04062115, 0), (38.1927517, 34.9608598, 0)), Line((38.1927517, 34.9608598, 0), (56.28115355, 31.45419307, 0)), Line((5.386482585, 49.55549606, 0), (5.671277412, -14.32994029, 0)), Line((-10.88879264, 1.260336241, 0), (70.59163202, 1.310832978, 0)), Line((56.38561268, -12.90045112, 0), (56.24474499, 46.91371662, 0))])
# 1.Set  SITE
boundary_2 = Curve(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)
roadwidth_2 = Number([1, 1, 2, 1, 3])
trigger = Trigger(Interval=-1000, TimerInterval=1000, Target=site2csv_2)  # disabled
minus = Rectangle({Plane=PlaneXY(46.62521858, 11.76394952, 0), Size=Domain2(u=-7.358420744..7.358420744, v=-10.9151436..10.9151436)})
entrance = Point([Point(56.00339657, 26.78511244, 0), Point(25.69108445, -0.8588725468, 0), Point(3.225052394, 13.3583896, 0), Point(26.14992169, 36.7223315, 0)])
file_path_3 = FilePath("E:\grasshopper_C#\test\4.2\site with entrance.csv")

# ----
# 2.Get  Districts
file_path_4 = FilePath("E:\grasshopper_C#\test\4.2\location1-1.csv")
blocks = Rectangle([{Plane=PlaneXY(0.4289465138, 25.77908491, 0), Size=Domain2(u=-3.438912594..3.438912594, v=-7.307689263..7.307689263)}, {Plane=PlaneXY(0.7576661001, 7.370788082, 0), Size=Domain2(u=-3.666487693..3.666487693, v=-5.13308277..5.13308277)}, {Plane=PlaneXY(0.7606682111, -3.909227376, 0), Size=Domain2(u=-3.624270565..3.624270565, v=-3.760741122..3.760741122)}, {Plane=PlaneXY(14.62110739, -3.980828149, 0), Size=Domain2(u=-7.747634914..7.747634914, v=-3.699620098..3.699620098)}, {Plane=PlaneXY(34.57999726, -4.049851676, 0), Size=Domain2(u=-5.018030914..5.018030914, v=-3.768643625..3.768643625)}, {Plane=PlaneXY(48.01603106, -3.967924641, 0), Size=Domain2(u=-6.779462174..6.779462174, v=-3.68671659..3.68671659)}])
list_item = ListItem(List=file_path_2, Index=Slider(3, range=0..4), Wrap=True)
site2csv_2 = CSharpScript(
    boundry=boundary_2,
    minus=minus,
    blocks=blocks,
    edge=nature_2,
    road=road_3,
    roadWidth=roadwidth_2,
    entrance=entrance,
    fileName=file_path_3)  # -> out, A, B; inputs boundry: Polyline, minus: list of Rectangle3d, blocks: list of Rectangle3d, edge: list of Curve, road: list of Line, roadWidth: list of Double, entrance: list of Point3d, fileName: String; disabled; same code as site2csv
line_3 = Line([Line((6.433782926, 14.0582479, 0), (16.7411913, 14.0582479, 0)), Line((27.16573647, 11.48656727, 0), (27.16573647, 2.051951746, 0))])  # disabled
line_4 = Line(读取分区.Roads_Axis)
panel_2 = Panel(site2csv_2.B)
dash_pattern = DashPattern(Curve=[line_4, line_3], Pattern=expr("0.8*x", 0.704))  # -> Dashes, Gaps
dash_pattern_2 = DashPattern(Curve=读取分区.Core_Groups, Pattern=expr("0.8*x", 0.704))  # -> Dashes, Gaps
# 1-1.Display  SITE
road_4 = CustomPreviewLineweights(
    Geometry=road_3,
    Shader={diffuse=RGB(105, 105, 105), emission=RGB(0, 0, 0), shine=0, specular=RGB(255, 255, 255), transparency=0},
    Thickness=expr("x*0.6", 0.2),
    Absolute=True)
custom_preview_lineweights = CustomPreviewLineweights(
    Geometry=dash_pattern.Dashes,
    Shader={diffuse=RGB(217, 0, 0), emission=RGB(0, 0, 0), shine=0, specular=RGB(255, 255, 255), transparency=0},
    Thickness=0.3,
    Absolute=True)
custom_preview_lineweights_2 = CustomPreviewLineweights(
    Geometry=dash_pattern_2.Dashes,
    Shader={diffuse=RGB(217, 0, 0), emission=RGB(0, 0, 0), shine=0, specular=RGB(255, 255, 255), transparency=0},
    Thickness=0.3,
    Absolute=True)
nature_3 = Curve(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)

linetype_table = LinetypeTable(Update=True)  # -> Linetypes, LinetypePattern
road_5 = CustomPreviewLineweights(
    Geometry=road_3,
    Shader={diffuse=RGB(129, 129, 129), emission=RGB(0, 0, 0), shine=0, specular=RGB(255, 255, 255), transparency=0},
    Thickness=expr("x*0.6", roadwidth_2),
    Absolute=True)
nature_4 = BoundarySurfaces(Edges=nature_3)
minus_2 = BoundarySurfaces(Edges=minus)
buildings = BoundarySurfaces(Edges=blocks)
list_item_2 = ListItem(List=flatten(linetype_table.Linetypes), Index=1, Wrap=True)
multiplication_2 = Multiplication(A=list_item_2, B=Slider(0.88, range=0..2))
custom_preview = CustomPreview(
    Geometry=minus_2,
    Material={diffuse=RGB(225, 225, 225), emission=RGB(76, 76, 76), shine=0.5, specular=RGB(255, 255, 255), transparency=0})  # disabled
custom_preview_2 = CustomPreview(
    Geometry=buildings,
    Material={diffuse=RGB(225, 225, 225), emission=RGB(0, 0, 0), shine=0, specular=RGB(255, 255, 255), transparency=0})
custom_preview_3 = CustomPreview(
    Geometry=nature_4,
    Material={diffuse=RGB(192, 227, 255), emission=RGB(0, 0, 0), shine=0, specular=RGB(255, 255, 255), transparency=0})
dash_pattern_3 = DashPattern(Curve=boundary_2, Pattern=multiplication_2)  # -> Dashes, Gaps
custom_preview_lineweights_3 = CustomPreviewLineweights(
    Geometry=dash_pattern_3.Dashes,
    Shader={diffuse=RGB(139, 0, 0), emission=RGB(0, 0, 0), shine=0.5, specular=RGB(255, 255, 255), transparency=0},
    Thickness=0.24,
    Absolute=True)

dash_pattern_4 = DashPattern(Curve=_3, Pattern=multiplication_2)  # -> Dashes, Gaps
custom_preview_lineweights_4 = CustomPreviewLineweights(
    Geometry=dash_pattern_4.Dashes,
    Shader={diffuse=RGB(0, 0, 0), emission=RGB(0, 0, 0), shine=0.5, specular=RGB(255, 255, 255), transparency=0},
    Thickness=4,
    Absolute=False)

point = Point(entrance)
move = Move(Geometry=point, Motion=Vector(0, 0.9854719628, 0))  # -> Geometry, Transform
item_index = ItemIndex(List=point, Item=point)
text_tag_3d = TextTag3D(Location=move.Geometry, Text=item_index, Size=1.5, Colour=RGB(0, 0, 0), Justification=7)  # disabled
dot_display = DotDisplay(Point=point, Colour=RGB(0, 0, 0), Size=0.5)

curve = Curve(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)
curve_2 = Curve(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)
curve_3 = Curve(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)
road_widths = Road_widths([1.2, 1.5, 1.5, 1])
boolean = Boolean([False, False, False, False])
trigger_2 = Trigger(Interval=20, TimerInterval=20, Target=[multiagent, multiagent_2])  # disabled

# ---- group: infoList
row_spacing = Slider(0.84, range=0..10)
size = Slider(0.67, range=0..2)
coldist2 = Slider(4.9, range=0..10)
coldist1 = Slider(3.9, range=0..20)
point_2 = Point(Point(43.1420272, 20.53258809, 0))
unit_x = UnitX(Factor=coldist1)
merge_2 = Merge(Data2=simplify(graft(text)))
unit_x_2 = UnitX(Factor=coldist2)
text_join = TextJoin(Text=merge_2)  # -> flatten(Result)
merge_3 = Merge(Data1="Gross Area", Data2=读取分区.BuildingArea)

# ---- group: districtLine
linetype_table_2 = LinetypeTable(Update=True)  # -> Linetypes, LinetypePattern
list_item_3 = ListItem(List=flatten(linetype_table_2.Linetypes), Index=1, Wrap=True)
multiplication_3 = Multiplication(A=list_item_3, B=Slider(0.261, range=0..2))

# ---- group: districtColor
integer = Integer(读取分区.Color)
list_item_4 = ListItem(List=integer, Index=-1, Wrap=True)
remap_numbers = RemapNumbers(Value=integer, Source=list_item_4, Target=Domain(0, 0.9))  # -> Mapped, Clipped
colour_hsl = ColourHSL(Alpha=0.9, Hue=remap_numbers.Mapped, Saturation=0.6, Luminance=0.9)

# ---- group: infoList (continued)
list_length = ListLength(List=integer)
c_script_4 = CSharpScript(index=integer)  # -> out, Indexes; inputs index: list of Int32
# ---------- c_script_4: C# ----------
    List<String> output = new List<String>();
    int index2 = 0;
    int last = index[0];
    output.Add(index[0].ToString());
    for(int i = 1;i < index.Count;i++){
      if(index[i] == last){
        index2++;
        output.Add(index[i] + "-" + index2);
      }
      else{
        index2 = 0;
        last = index[i];
        output.Add(index[i].ToString());
      }
    }
    Indexes = output;
# ---------- end c_script_4 ----------
series = Series(Start=0, Step=row_spacing, Count=expr("x+1", list_length))
unit_y = UnitY(Factor=expr("-x", series))
move_2 = Move(Geometry=point_2, Motion=unit_y)  # -> Geometry, Transform
move_3 = Move(Geometry=move_2.Geometry, Motion=unit_x)  # -> simplify(Geometry), Transform
move_4 = Move(Geometry=move_3.Geometry, Motion=unit_x_2)  # -> simplify(flatten(Geometry)), Transform
merge_4 = Merge(Data1="Index", Data2=flatten(c_script_4.Indexes))
text_tag_3d_2 = TextTag3D(Location=move_4.Geometry, Text=merge_3, Size=size, Colour=RGB(0, 0, 0), Justification=8)  # disabled
text_tag_3d_3 = TextTag3D(Location=move_2.Geometry, Text=merge_4, Size=size, Colour=RGB(0, 0, 0), Justification=8)  # disabled

# ----
blue = Index(graft([7, 9, 4]))  # disabled
yellow = Index(graft([10, 11, 13]))  # disabled
purple = Index(graft([0, 1, 2, 8]))  # disabled
orange = Index(graft([7, 9, 4, 6, 8]))  # disabled
lightblue = Index(graft(3))  # disabled
green = Index(graft([10, 11, 13, 12, 14]))  # disabled

number_slider_2 = Slider(0.6, range=0..1)
number_slider_3 = Slider(0.98, range=0..1)
boolean_toggle = BooleanToggle(False)
boolean_toggle_2 = BooleanToggle(True)
curve_4 = Curve(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)
button = Button()
minus_3 = Curve([nature_3, curve, curve_3])
site = Curve(boundary_2)
rectangle = Rectangle(读取分区.Districts)
list_length_2 = ListLength(List=rectangle)
series_2 = Series(Start=Slider(0.4, range=0..1), Step=0, Count=list_length_2)  # -> simplify(Series)
number = Number(series_2)

fillet = Fillet(Curve=读取分区.Districts, Radius=number)  # -> graft(Curve)
# 2-1.Transform
merge_5 = Merge(Data1=读取分区.Core_Groups, Data2=读取分区.Roads_Axis, Data3=curve_4)  # -> flatten(Result)
multiagent = MultiAgent(
    Rects=rectangle,
    Site=site,
    Minus=[minus_3, curve_2],
    Roads=merge_5,
    Road_widths=road_widths,
    Cutters=boolean,
    Radius=number,
    Packing=boolean_toggle,
    Resistance=number_slider_3,
    Run=boolean_toggle_2,
    Reset=button,
    Spacing=number_slider_2)  # -> PointsTree, PointsList

multiagent_2 = MultiAgent(
    Rects=rectangle,
    Site=site,
    Minus=minus_3,
    Roads=merge_5,
    Road_widths=road_widths,
    Cutters=boolean,
    Radius=number,
    Packing=boolean_toggle,
    Resistance=number_slider_3,
    Run=boolean_toggle_2,
    Reset=button,
    Spacing=number_slider_2)  # -> PointsTree, PointsList

curve_5 = Curve([<curve referenced from the Rhino model> x2])
subtraction = Subtraction(A=list_length_2, B=1)
dash_pattern_5 = DashPattern(Curve=curve_4, Pattern=0.88)  # -> Dashes, Gaps
boundary_surfaces = BoundarySurfaces(Edges=curve)
range = Range(Domain=Domain(0, 0.9), Steps=subtraction)
circle = Circle(Plane=multiagent_2.PointsTree, Radius=graft(series_2))
road_6 = CustomPreviewLineweights(
    Geometry=dash_pattern_5.Dashes,
    Shader={diffuse=RGB(129, 129, 129), emission=RGB(0, 0, 0), shine=0, specular=RGB(255, 255, 255), transparency=0},
    Thickness=expr("0.35", road_widths),
    Absolute=True)
colour_hsl_2 = ColourHSL(Alpha=1, Hue=range, Saturation=0.7, Luminance=0.8)  # -> simplify(graft(Colour))
custom_preview_4 = CustomPreview(
    Geometry=boundary_surfaces,
    Material={diffuse=RGB(199, 233, 189), emission=RGB(0, 0, 0), shine=0, specular=RGB(255, 255, 255), transparency=0})
custom_preview_lineweights_5 = CustomPreviewLineweights(
    Geometry=circle,
    Shader={diffuse=RGB(93, 154, 206), emission=RGB(0, 0, 0), shine=0, specular=RGB(255, 255, 255), transparency=0},
    Thickness=2,
    Absolute=False)
dot_display_2 = DotDisplay(Colour=colour_hsl_2, Size=expr("0*x", graft(series_2)))

dot_display_3 = DotDisplay(Point=multiagent_2.PointsTree, Colour=RGB(21, 148, 194), Size=0.06)  # disabled

# ---- group: 提取轮廓线
number_2 = Number(simplify(graft(series_2)))
提取轮廓线 = CSharpScript(
    rect=graft(rectangle),
    grid=20,
    points=multiagent_2.PointsTree,
    k=Slider(5.32, range=0..6),
    radius=number_2,
    tolerance=Slider(0.25, range=0..0.5),
    deleteMin=Slider(0.67, range=0.5..1),
    fillet=Toggle(True),
    scale=Toggle(False),
    Reference=["E:\ONEDRIVE - STU.XMU.EDU.CN\二次布局\ToPmesh\bin\Debug\net48\Plankton.dll", "E:\GRASSHOPPER_C#\Plankton-master\bin\Debug\Plankton.gha"])  # -> out, A, simplify(DistrictCur), simplify(Area); inputs rect: Rectangle3d, grid: Double, points: list of Point3d, k: Double, radius: Double, tolerance: Double, deleteMin: Double, fillet: Boolean, scale: Boolean
# ---------- 提取轮廓线: C# usings ----------
using Plankton;
using PlanktonGh;
using rd = Rhino.NodeInCode;
# ---------- 提取轮廓线: C# ----------
    //从点建立mesh
    var func = rd.Components.FindComponent("DelaunayMesh");
    var func1 = func.Delegate as dynamic;
    var initialMesh = func1(points, Plane.WorldXY);

    func = rd.Components.FindComponent("FaceBoundaries");
    func1 = func.Delegate as dynamic;
    var polylines = func1(initialMesh);
    //C = polylines;

    //建立Pmesh
    pmesh = new PlanktonMesh();
    pVertices = new List<PlanktonXYZ> ();
    List<List<int>> faces = new List<List<int>>();

    int index = 0;
    foreach (PolylineCurve plC in polylines)
    {
      Polyline pl;
      plC.TryGetPolyline(out pl);
      List<int> face = new List<int>();

      double length = pl.SegmentAt(0).Length;
      for(int i = 0;i < pl.GetSegments().Length;i++){
        if(pl.SegmentAt(i).Length > length)
          length = pl.SegmentAt(i).Length;
      }
      if(length > k * radius){
        continue;
      }
      index++;


      for(int j = 0;j < pl.Count - 1;j++)
      {
        var p = pl[j];
        PlanktonXYZ xYZ = new PlanktonXYZ((float) p.X, (float) p.Y, 0);
        if (!pVertices.Contains(xYZ))
        {
          pVertices.Add(xYZ);
        }
        face.Add(pVertices.IndexOf(xYZ));

      }
      faces.Add(face);
    }

    pmesh.Vertices.AddVertices(pVertices);
    pmesh.Faces.AddFaces(faces);

    //取出边缘
    var mesh = pmesh.ToRhinoMesh();
    A = mesh;

    var bound = new List<PolylineCurve>();
    var districtCurs = new List<PolyCurve>();
    foreach(Polyline p in mesh.GetNakedEdges()){
      p.MergeColinearSegments(tolerance, true);
      p.DeleteShortSegments(deleteMin);
      var boundry = p.ToPolylineCurve();
      boundry.ClosedCurveOrientation();
      bound.Add(boundry);
      var districtCur = new PolyCurve();
      if(fillet){
        districtCur = (PolyCurve) boundry.Offset(new Point3d(0, 0, 0),
          new Vector3d(0, 0, 1), radius, 0.1,
          CurveOffsetCornerStyle.Round)[0];
      }else{
        districtCur = (PolyCurve) boundry.Offset(new Point3d(0, 0, 0),
          new Vector3d(0, 0, 1), radius, 0.1, CurveOffsetCornerStyle.Sharp)[0];
      }
      districtCurs.Add(districtCur);
    }
    double area = 0;
    func = rd.Components.FindComponent("Area");
    func1 = func.Delegate as dynamic;
    var centers = new List<Point3d>();
    foreach(PolyCurve pc in districtCurs){

      //area+= (double)func1(pc)[0][0];
      area += (double) func1(pc)[0][0];
      centers.Add(func1(pc)[1][0]);
    }
    var areaOri = (double) func1(rect)[0][0];
    var sc = areaOri / area;
    if(scale){
      area = 0;
      for(int i = 0;i < centers.Count;i++){
        var trans = Transform.Scale(centers[i], sc);
        districtCurs[i].Transform(trans);
        area += (double) func1(districtCurs[i])[0][0];
      }
    }

    Area = Math.Round(area * grid * grid, 2);
    DistrictCur = districtCurs;
# ---------- 提取轮廓线: C# additional code ----------
  PlanktonMesh pmesh;
  List<PlanktonXYZ> pVertices;
# ---------- end 提取轮廓线 ----------

# ----
curve_6 = Curve(提取轮廓线.DistrictCur)
panel_3 = Panel(提取轮廓线.A)

# ----
# 3.Display Districts
分区结果 = Curve(simplify(curve_6))

# ---- group: districtName
area_3 = Area(Geometry=分区结果)  # -> Area, Centroid
text_tag_3d_4 = TextTag3D(Location=area_3.Centroid, Text=text, Size=Slider(0.6, range=0..1), Colour=RGB(0, 0, 0), Justification=5)  # disabled

# ---- group: infoList (continued)
area_4 = Area(Geometry=分区结果)  # -> Area, Centroid
multiplication_4 = Multiplication(A=area_4.Area, B=400)
integer_2 = Integer(simplify(flatten(multiplication_4)))
merge_6 = Merge(Data1="Site Area", Data2=integer_2)
text_tag_3d_5 = TextTag3D(Location=move_3.Geometry, Text=merge_6, Size=size, Colour=RGB(0, 0, 0), Justification=8)  # disabled

# ---- group: districtColor (continued)
boundary_surfaces_2 = BoundarySurfaces(Edges=分区结果)
custom_preview_5 = CustomPreview(Geometry=boundary_surfaces_2, Material=graft(colour_hsl))

# ---- group: building
显示体量 = CSharpScript(districtCur=graft(分区结果), height=4.8, layers=读取分区.Layers, floorAreas=读取分区.FloorAreas, grid=20)  # -> Center, Layer, simplify(A), B; inputs districtCur: Curve, height: Double, layers: list of Int32, floorAreas: list of Double, grid: Double
# ---------- 显示体量: C# usings ----------
using rd = Rhino.NodeInCode;
[ObsoleteAttribute("Use version that takes tolerance as input")]
# ---------- 显示体量: C# ----------
    var func = rd.Components.FindComponent("Area");
    var func1 = func.Delegate as dynamic;

    var area = func1(districtCur)[0][0];
    var center = func1(districtCur)[1][0];

    double floorAll = 0;
    double l = 0;
    for(int i = 0; i < floorAreas.Count;i++){
      floorAll += floorAreas[i];

    }
    if(floorAll > 0){
      for(int i = 0; i < floorAreas.Count;i++){
        l += layers[i] * floorAreas[i] / floorAll;
      }
    }

    int layer = (int) l;
    Layer = layer;

    if(floorAll > 0){
      double k = Math.Sqrt(floorAll / grid / grid / area);
      var a = Transform.Scale(center, k);
      districtCur.Transform(a);


      func = rd.Components.FindComponent("Extrude");
      func1 = func.Delegate as dynamic;
      var breps = func1(districtCur, new Vector3d(0, 0, l * height / grid));


      if(breps != null){

        func = rd.Components.FindComponent("CapHoles");
        func1 = func.Delegate as dynamic;
        var building = func1(breps[0]);
        B = building;
      }
      A = districtCur;
      func = rd.Components.FindComponent("LinearArray");
      func1 = func.Delegate as dynamic;
      var vec = new Vector3d(0, 0, height / grid);
      var curs = func1(districtCur, vec, layer + 1)[0];
      A = curs;

    }
    Center = center;
# ---------- end 显示体量 ----------
custom_preview_6 = CustomPreview(Geometry=flatten(显示体量.B), Material=colour_hsl)
custom_preview_lineweights_6 = CustomPreviewLineweights(
    Geometry=显示体量.A,
    Shader={diffuse=RGB(74, 80, 88), emission=RGB(0, 0, 0), shine=0, specular=RGB(255, 255, 255), transparency=0},
    Thickness=1,
    Absolute=False)

# ----
unit_z = UnitZ(Factor=expr("4.8*x/20", 显示体量.Layer))
move_5 = Move(Geometry=area_3.Centroid, Motion=unit_z)  # -> Geometry, Transform
text_tag_3d_6 = TextTag3D(Location=move_5.Geometry, Text=graft(读取分区.Color), Size=1.2, Colour=RGB(0, 0, 0), Justification=5)

# ---- group: districtLine (continued)
dash_pattern_6 = DashPattern(Curve=分区结果, Pattern=multiplication_3)  # -> Dashes, Gaps
custom_preview_lineweights_7 = CustomPreviewLineweights(
    Geometry=dash_pattern_6.Dashes,
    Shader={diffuse=RGB(0, 0, 0), emission=RGB(0, 0, 0), shine=0.5, specular=RGB(255, 255, 255), transparency=0},
    Thickness=0.18,
    Absolute=True)

# ----
highlight = HighLight(relay=分区结果, integer=读取分区.Color, second_number=yellow)  # disabled
highlight_2 = HighLight(relay=分区结果, integer=读取分区.Color, second_number=green)  # disabled
highlight_3 = HighLight(relay=分区结果, integer=读取分区.Color, second_number=purple)  # disabled
highlight_4 = HighLight(relay=分区结果, integer=读取分区.Color, second_number=blue)  # disabled
highlight_5 = HighLight(relay=分区结果, integer=读取分区.Color, second_number=lightblue)  # disabled
highlight_6 = HighLight(relay=分区结果, integer=读取分区.Color, second_number=orange)  # disabled
custom_preview_7 = CustomPreview(
    Geometry=flatten(highlight_4),
    Material={diffuse=RGB(147, 203, 228), emission=RGB(0, 0, 0), shine=0, specular=RGB(255, 255, 255), transparency=0})  # disabled
custom_preview_8 = CustomPreview(
    Geometry=flatten(highlight_2),
    Material={diffuse=RGB(147, 222, 145), emission=RGB(0, 0, 0), shine=0, specular=RGB(255, 255, 255), transparency=0})  # disabled
custom_preview_9 = CustomPreview(
    Geometry=flatten(highlight_5),
    Material={diffuse=RGB(178, 213, 228), emission=RGB(0, 0, 0), shine=0, specular=RGB(255, 255, 255), transparency=0})  # disabled
custom_preview_10 = CustomPreview(
    Geometry=flatten(highlight_6),
    Material={diffuse=RGB(244, 188, 159), emission=RGB(0, 0, 0), shine=0, specular=RGB(255, 255, 255), transparency=0})  # disabled
custom_preview_11 = CustomPreview(
    Geometry=flatten(highlight),
    Material={diffuse=RGB(236, 182, 47), emission=RGB(0, 0, 0), shine=0, specular=RGB(255, 255, 255), transparency=0})  # disabled
custom_preview_12 = CustomPreview(
    Geometry=flatten(highlight_3),
    Material={diffuse=RGB(204, 200, 250), emission=RGB(0, 0, 0), shine=0, specular=RGB(255, 255, 255), transparency=0})  # disabled

# ==== cluster HighLight
integer = ClusterInput()
relay = ClusterInput()
integer_2 = Integer(integer)
second_number = ClusterInput()
equality = Equality(FirstNumber=integer_2, SecondNumber=second_number)  # -> Equality, Inequality
item_index = ItemIndex(List=integer_2, Item=integer_2)
dispatch = Dispatch(List=item_index, DispatchPattern=equality.Equality)  # -> ListA, ListB
list_item = ListItem(List=flatten(relay), Index=flatten(dispatch.ListA), Wrap=True)
boundary_surfaces = BoundarySurfaces(Edges=list_item)
surfaces = ClusterOutput(boundary_surfaces)
