# Grasshopper definition 写入分区forTest.gh (Grasshopper 1.0.7)
# plug-ins: Human

area = Area(Geometry=<brep referenced from the Rhino model>)  # -> Area, Centroid
area_2 = Area(Geometry=[<curve referenced from the Rhino model> x3])  # -> Area, Centroid
mass_addition = MassAddition(Input=area_2.Area)  # -> Result, PartialResults
division = Division(A=area_2.Area, B=Slider(201, range=0..1000))
multiplication = Multiplication(A=division, B=area.Area)
division_2 = Division(A=multiplication, B=area_2.Area)
square_root = SquareRoot(Value=division_2)

# ---- group: 旋转调整
九龙湖 = Curve(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)
九龙湖road = Curve([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])
九龙湖rect = Rectangle(九龙湖)
# 凸多边形是且，凹多边形是或
c_script = CSharpScript(boundry=九龙湖, rectRef=九龙湖rect)  # -> out, A, B; inputs boundry: Polyline, rectRef: Rectangle3d
# ---------- c_script: C# ----------
    Vector3d ax = rectRef.Corner(1) - rectRef.Corner(0);
    Point3d p = rectRef.Corner(0);
    B = p;
    var var1 = Vector3d.Multiply(ax, new Vector3d(0, 1, 0)) / ax.Length;
    //var t = Math.PI * Math.Sqrt(2) / 2;
    double angle;
    angle = Math.Acos(Math.Abs(var1));
    if(angle > Math.PI / 2){
      angle = Math.PI - angle;
    }
    if(angle > Math.PI / 4){
      angle = angle - Math.PI / 2;
    }
    A = angle;
# ---------- end c_script ----------
rotate = Rotate(Geometry=九龙湖, Angle=c_script.A, Plane=c_script.B)  # -> Geometry, Transform
rotate_2 = Rotate(Geometry=九龙湖road, Angle=c_script.A, Plane=PlaneXY(0, 0, 0))  # -> Geometry, Transform

# ----
_3 = Curve(<curve referenced from the Rhino model>)
提取凹部矩形 = CSharpScript(boundry=_3)  # -> out, A, Minus, C; inputs boundry: Polyline
# ---------- 提取凹部矩形: C# usings ----------
using rd = Rhino.NodeInCode;
using Rhino.Geometry.Intersect;
# ---------- 提取凹部矩形: C# ----------
    minus = new List<Rectangle3d>();
    lines = new List<Line>();
    //Flip
    double area = 0;
    for(int i = 0;i < boundry.Count - 1;i++){
      area += boundry[i].X * boundry[i + 1].Y - boundry[i].Y * boundry[i + 1].X;
    }
    if(area < 0){
      Print("Flip");
      var Func = rd.Components.FindComponent("FlipCurve");
      var Func1 = Func.Delegate as dynamic;
      var dry = Func1(boundry, null)[0][0];
      var boundry1 = new Polyline();
      dry.TryGetPolyline(out boundry);

    }
    //oob
    var oob = boundry.BoundingBox;
    var frame = new Rectangle3d(Plane.WorldXY, oob.Corner(false, false, false), oob.Corner(true, true, false));
    A = frame;


    //connexHull
    var pts = new List<Point3d >();
    foreach(Point3d p in boundry){
      pts.Add(p);
    }
    var com = rd.Components.FindComponent("ConvexHull");
    var com1 = com.Delegate as dynamic;
    var convexHull = com1(pts, Plane.WorldXY)[0][0];
    var conH = convexHull.ToPolyline();
    pts.Clear();

    if(conH.Count == boundry.Count){
      Print("凸多边形");
    }else{
      Print("凹多边形");
      GetMinus(boundry, conH, frame);
    }
    Minus = minus;
    C = lines;
# ---------- 提取凹部矩形: C# additional code ----------
  List<Rectangle3d> minus;
  List<Line> lines;


  void GetMinus(Polyline boundry, Polyline conH, Rectangle3d frame){
    var inside = new List<int>();

    for(int i = 0;i < boundry.Count - 1;i++){
      if(!conH.Contains(boundry[i])){
        inside.Add(i);
        Print("inside" + i.ToString());
      }
    }
    foreach(int i in inside){
      var p1 = boundry[(i - 1 + boundry.Count - 1) % (boundry.Count - 1)];
      var p2 = boundry[(i + 1) % (boundry.Count - 1)];

      Point3d corner = new Point3d();//角点
      for(int j = 0;j < 4;j++){
        corner = frame.Corner(j);
        var line = new Line(corner, boundry[i]);
        lines.Add(line);
        //var Func = rd.Components.FindComponent("Curve|Curve");
        //var Func1 = Func.Delegate as dynamic;
        var pt = Intersection.CurveLine(boundry.ToPolylineCurve(), line, 0, 0);
        Print(pt.Count.ToString());
        if(pt.Count < 3){
          var tempMinus = new Rectangle3d(Plane.WorldXY, boundry[i], corner);

          if(Intersection.CurveCurve(boundry.ToPolylineCurve(), tempMinus.ToNurbsCurve(), 0, 0).Count < 2){
            minus.Add(new Rectangle3d(Plane.WorldXY, boundry[i], corner));
            break;
          }else minus.Add(new Rectangle3d(Plane.WorldXY, p1, p2));
        }
      }
    }
  }
# ---------- end 提取凹部矩形 ----------

curve = Curve(提取凹部矩形.Minus)
panel = Panel(curve)
c_script_2 = CSharpScript()  # -> out
# ---------- c_script_2: C# usings ----------
using rd = Rhino.NodeInCode;
# ---------- c_script_2: C# ----------
    var a = Rhino.NodeInCode.Components.NodeInCodeFunctions.
      GetDynamicMemberNames();
    foreach(string s in a){
      Print(s);
    }
# ---------- end c_script_2 ----------
file_path = FilePath(["E:\grasshopper_C#\test\4.1\location1N.csv", "E:\grasshopper_C#\test\4.1\location1N-1.csv", "E:\grasshopper_C#\test\4.1\location1N-2.csv", "E:\grasshopper_C#\test\4.1\location4N.csv", "E:\grasshopper_C#\test\4.1\location4N-1.csv", "E:\grasshopper_C#\test\4.1\location4N-2.csv"])
boundary = Curve(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)
minus = Rectangle({Plane=PlaneXY(46.62521858, 11.76394952, 0), Size=Domain2(u=-7.358420744..7.358420744, v=-10.9151436..10.9151436)})
blocks = Rectangle([{Plane=PlaneXY(0.4289465138, 25.77908491, 0), Size=Domain2(u=-3.438912594..3.438912594, v=-7.307689263..7.307689263)}, {Plane=PlaneXY(0.7576661001, 7.370788082, 0), Size=Domain2(u=-3.666487693..3.666487693, v=-5.13308277..5.13308277)}, {Plane=PlaneXY(0.7606682111, -3.909227376, 0), Size=Domain2(u=-3.624270565..3.624270565, v=-3.760741122..3.760741122)}, {Plane=PlaneXY(14.62110739, -3.980828149, 0), Size=Domain2(u=-7.747634914..7.747634914, v=-3.699620098..3.699620098)}, {Plane=PlaneXY(34.57999726, -4.049851676, 0), Size=Domain2(u=-5.018030914..5.018030914, v=-3.768643625..3.768643625)}, {Plane=PlaneXY(48.01603106, -3.967924641, 0), Size=Domain2(u=-6.779462174..6.779462174, v=-3.68671659..3.68671659)}])
nature = Curve()
road = Line([Line((-9.76027351, 34.04062115, 0), (38.1927517, 34.9608598, 0)), Line((38.1927517, 34.9608598, 0), (56.28115355, 31.45419307, 0)), Line((5.386482585, 49.55549606, 0), (5.671277412, -14.32994029, 0)), Line((-10.88879264, 1.260336241, 0), (70.59163202, 1.310832978, 0)), Line((56.38561268, -12.90045112, 0), (56.24474499, 46.91371662, 0))])
roadwidth = Number([1, 1, 2, 1, 3])
entrance = Point([Point(56.00339657, 26.78511244, 0), Point(25.69108445, -0.8588725468, 0), Point(3.225052394, 13.3583896, 0), Point(26.14992169, 36.7223315, 0)])
# 2.Get  Districts
list_item = ListItem(List=file_path, Index=Slider(4, range=0..5), Wrap=True)

读取分区 = CSharpScript(file=list_item, grid=20, result=Slider(1, range=1..5))  # -> out, DistrictNames, Districts, Color, Core_Groups, Roads_Axis, Widths, flatten(BuildingArea), Layers, FloorAreas; inputs file: String, grid: Double, result: Int32
# ---------- 读取分区: C# usings ----------
using System.IO;
# ---------- 读取分区: C# ----------
    floorArea = new DataTree<double>();
    layer = new DataTree<int>();
    nameList = new List<string>();
    infoList = new List<double>();
    buildings = new DataTree<Box>();
    groups = new List<Rectangle3d>();

    var fs = new FileStream(file, FileMode.Open, FileAccess.Read);
    var sr = new StreamReader(fs);
    string strLine = " ";
    var resultList = new List<string>();


    //读取分区
    sr.ReadLine();
    while ((strLine = sr.ReadLine()) != null){
      if(strLine.Contains("Rectangle")){
        break;
      }
      Print(strLine.ToString());
      string[] str = strLine.Split(',');
      nameList.Add(str[0]);
      resultList.Add(str[result]);
    }
    var districts = ExportDistrict(resultList, grid);


    //读取矩形结构
    while ((strLine = sr.ReadLine()) != null && strLine.Contains("Rectangle")){
      Print(strLine.ToString());
      string[] str = strLine.Split(',');
      var strArray = str[result].Split(new char[3] { '(',';', ')' });
      groups.Add(ReadRectangle(strArray));
      Print("GroupTrue");
    }

    List<double> widthList = new List<double>();
    List<Line> lines = new List<Line>();
    while ((strLine = sr.ReadLine()) != null){
      if(strLine == "Roads"){
        strLine = sr.ReadLine();
      }
      if(strLine == "Axis"){
        break;
      }
      Print(strLine.ToString());
      string[] str = strLine.Split(',');
      widthList.Add(double.Parse(str[0]));
      var strArray = str[result].Split(new char[3] { '(',';', ')' });
      //lines.Add(ReadLine(strArray));
      double x1 = double.Parse(strArray[1]);
      double y1 = double.Parse(strArray[2]);
      double x2 = double.Parse(strArray[3]);
      double y2 = double.Parse(strArray[4]);
      var line = new Line(x1, y1, 0, x2, y2, 0);
      lines.Add(line);

    }

    //color Num
    List<int> color = new List<int>();
    int temp = 0;
    color.Add(temp);
    for(int i = 1;i < nameList.Count;i++){
      if(nameList[i] != nameList[i - 1]){
        temp++;
      }
      color.Add(temp);
    }
    Color = color;



    Districts = districts;
    DistrictNames = nameList;
    Layers = layer;
    FloorAreas = floorArea;
    BuildingArea = infoList;
    //Buildings = buildings;
    Core_Groups = groups;
    Roads_Axis = lines;
    Widths = widthList;
# ---------- 读取分区: C# additional code ----------
  DataTree<double> floorArea;
  DataTree<int> layer;
  List<string> nameList;
  List<double> infoList;
  DataTree<Box> buildings;
  List<Rectangle3d> groups;

  public List<Rectangle3d> ExportDistrict(List<string> resultList, double grid){
    var districts = new List<Rectangle3d>();
    int index = 0;
    foreach(string str in resultList){


      string[] strArray = str.Split(new char[3] { '(',';', ')' });
      var rect = ReadRectangle(strArray);
      districts.Add(rect);

      try{
        double buildingArea = double.Parse(strArray[7]);
        string area = strArray[6];
        infoList.Add(Math.Round(buildingArea, 0));
      }catch{
        infoList.Add(-1);
      }

      //建筑信息和绘制建筑
      var path = new GH_Path(index);

      if((strArray.Length - 8) > 0){
        int i = 8;
        double height = 4 / grid;
        double deta = 0.4;

        //double y1 = y + deta;
        while(i + 1 < strArray.Length){
          int floor = int.Parse(strArray[i + 1]);
          //double z = 0;
          var f_area = double.Parse(strArray[i]);
          var h1 = f_area / (rect.Width - deta * 2) / grid / grid;

          //for(int f = 0;f < floor;f++){
          //var xRange = new Interval(x + deta, x + w - deta);
          //var yRange = new Interval(y1, y1 + h1);
          //var zRange = new Interval(z, z + height);
          //buildings.Add(new Box(Plane.WorldXY, xRange, yRange, zRange), path);
          //z += height;
          //}
          floorArea.Add(f_area, path);
          layer.Add(floor, path);
          i += 2;
          //y1 += h1 / 2;
        }

      }else{
        layer.Add(0, path);
        floorArea.Add(0, path);
      }
      index++;
    }
    return districts;
  }

  public Rectangle3d ReadRectangle(string[] strArray){

    double x = double.Parse(strArray[1]);
    double y = double.Parse(strArray[2]);
    double w = double.Parse(strArray[3]) - double.Parse(strArray[1]);
    double h = double.Parse(strArray[4]) - double.Parse(strArray[2]);
    Point3d p3d = new Point3d(x, y, 0);
    Plane p = new Plane(p3d, new Vector3d(0, 0, 1));

    return new Rectangle3d(p, w, h);
  }
# ---------- end 读取分区 ----------

text = Text(simplify(graft(读取分区.DistrictNames)))
area_3 = Area(Geometry=<curve referenced from the Rhino model>)  # -> Area, Centroid
mass_addition_2 = MassAddition(Input=area_3.Area)  # -> Result, PartialResults

trigger = Trigger(Interval=-1000, TimerInterval=1000, Target=site2csv)  # disabled
# 1.Set  SITE
boundary_2 = Curve(<curve referenced from the Rhino model>)
minus_2 = Rectangle([{Plane=PlaneXY(33.81205565, 91.10015085, 0), Size=Domain2(u=-12.46537955..12.46537955, v=-4.482242301..4.482242301)}, {Plane=PlaneXY(64.86878323, 90.37984984, 0), Size=Domain2(u=-7.783586155..7.783586155, v=-5.202543314..5.202543314)}, {Plane=PlaneXY(68.34371605, 59.30520787, 0), Size=Domain2(u=-4.308653332..4.308653332, v=-1.973041403..1.973041403)}])
road_2 = Line([Line((28.75208952, 86.61790855, 0), (25.04938281, 71.97503751, 0)), Line((36.94840518, 57.33216647, 0), (64.03506272, 61.27824927, 0))])
roadwidth_2 = Number([0, 0])
entrance_2 = Point()
file_path_2 = FilePath("E:\grasshopper_C#\test\4.1\111")

blocks_2 = Rectangle()
nature_2 = Curve()
site2csv = CSharpScript(
    boundry=boundary_2,
    minus=minus_2,
    blocks=blocks_2,
    edge=nature_2,
    road=road_2,
    roadWidth=roadwidth_2,
    entrance=entrance_2,
    fileName=file_path_2)  # -> out, A, B; inputs boundry: Polyline, minus: list of Rectangle3d, blocks: list of Rectangle3d, edge: list of Curve, road: list of Line, roadWidth: list of Double, entrance: list of Point3d, fileName: String
# ---------- site2csv: C# ----------
    var oob = boundry.BoundingBox;
    frame = new Rectangle3d(Plane.WorldXY, oob.Corner(false, false, false), oob.Corner(true, true, false));
    B = frame;
    int digit = 2;//保留位数
    ToMinus(minus, blocks);
    A = minus;

    if (fileName != null)
    {
      FileStream fs = new FileStream(fileName, FileMode.Create, FileAccess.Write);
      StreamWriter sw = new StreamWriter(fs, System.Text.Encoding.UTF8);

      var strLine = string.Empty;
      var index = 0;

      //写入Boundry
      sw.WriteLine("Boundry");
      foreach(Point3d p in boundry){
        strLine += "(" + Math.Round(p.X, digit) + ";" +
          Math.Round(p.Y, digit) + "),";
      }
      sw.WriteLine(strLine);

      //写入Frame
      sw.WriteLine("Frame");
      sw.WriteLine("(" + Math.Round(frame.Corner(0).X, digit) + ";" +
        Math.Round(frame.Corner(0).Y, digit) + ";" +
        Math.Round(frame.Corner(2).X, digit) + ";" +
        Math.Round(frame.Corner(2).Y, digit) + ")");

      //写入Minus
      WriteRects("Minus", sw, minus, digit);
      //写入block
      if(blocks != null)
        WriteRects("Block", sw, blocks, digit);


      //写入entrance
      WritePoints("Entrance", sw, entrance, digit);

      //写入outsidePoints
      if(edge != null){
        List<Point3d> inside = new List<Point3d>();

        var origin = new Point3d((frame.Corner(0).X + 0.5), (frame.Corner(0).Y + 0.5), 0);

        for(int i = 0;i <= (int) (frame.Width + 0.5);i++){
          for(int j = 0;j <= (int) (frame.Height + 0.5);j++)
          {
            foreach(Curve e in edge){
              var p = origin + new Vector3d(i, j, 0);
              var isInside = e.Contains(p, Plane.WorldXY, 0.01) == PointContainment.Inside;
              double t;
              e.ClosestPoint(p, out t);
              var dist = p.DistanceTo(e.PointAt(t));

              //Print(isInside.ToString());
              if(isInside & dist > 0.25){
                inside.Add(p);

              }
            }
          }
        }
        A = inside;
        WritePoints("OutsidePoints", sw, inside, digit);
      }

      //写入Road
      sw.WriteLine("Road");
      strLine = "";
      index = 0;

      var tempPoiList = new List<Point3d>();//
      foreach(Line l in road){

        strLine += "(" + Math.Round(l.FromX, digit) + ";"
          + Math.Round(l.FromY, digit)
          + ";" + Math.Round(l.ToX, digit) + ";" +
          Math.Round(l.ToY, digit) + ")" + roadWidth[index] + ";";

        ///直线与场地是否相交
        var bo = Rhino.Geometry.Intersect.Intersection.
          CurveCurve(boundry.ToPolylineCurve(), l.ToNurbsCurve(), 0, 0);//线段与边界
        var bo1 = Rhino.Geometry.Intersect.Intersection.
          CurveLine(frame.ToNurbsCurve(), l, 0, 0);//直线与boundingbox

        //线段是否相交
        bool inter = false;
        int n = 5;
        var dx = (l.ToX - l.FromX) / n;
        var dy = (l.ToY - l.FromY) / n;
        for(int i = 0;i < n;i++){
          var p = new Point3d(l.FromX + i * dx, l.FromY + i * dy, l.FromZ);
          tempPoiList.Add(p);
          if(boundry.ToPolylineCurve().Contains(p) == PointContainment.Inside){
            inter = true;
            break;
          }
        }

        string strTemp = "";
        //完全不相交
        if(bo1.Count < 2){
          strTemp = "0";
          Print("道路" + index + "不相交");
        }
          //道路存在部分在边界内，需避开=2
        else if(bo.Count == 2 && inter ){

          Print("道路" + index + "与场地相交");
          strTemp = "2";
          strTemp += "(" + Math.Round(bo[0].PointA.X, digit)
            + ";" + Math.Round(bo[0].PointA.Y, digit)
            + ";" + Math.Round(bo[0].PointA.X, digit)
            + ";" + Math.Round(bo[0].PointA.Y, digit) + ")";
        }
        else{
          //道路切割一部分=+1/-1
          var x1 = l.FromX;
          var x2 = l.ToX;
          var y1 = l.FromY;
          var y2 = l.ToY;
          double a,b,c;
          if(x1 != x2){
            a = (y2 - y1) / (x2 - x1);
            b = -1;
          }else{
            b = 0;
            a = -1;
          }
          c = -b * y1 - a * x1;

          //直线相交但线段不相交的情况,做切割线
          //找最近点
          Point3d testPoi = boundry.CenterPoint();
          if(bo.Count == 2){
            var mid = new Point3d((l.FromX + l.ToX) / 2, (l.FromY + l.ToY) / 2, l.ToZ);
            testPoi = boundry.ClosestPoint(mid);
          }
          //判断在上or下
          if(a * testPoi.X + b * testPoi.Y + c < 0){
            strTemp = "-1";//线在点上方，去除下方
            Print("道路" + index + "=-1");
          }
          if(a * testPoi.X + b * testPoi.Y + c > 0){
            strTemp = "1";//线在点下方，去除上方
            Print("道路" + index + "=1");
          }
        }

        strLine += strTemp + ",";
        index++;
      }
      sw.WriteLine(strLine);

      sw.Close();
      fs.Close();
      //A = tempPoiList;
    }
# ---------- site2csv: C# additional code ----------
  Rectangle3d frame;

  public void WritePoints(string name, StreamWriter sw, List<Point3d > points, int digit){
    sw.WriteLine(name);
    var strLine = "";
    foreach(Point3d p in points){
      strLine += "(" + Math.Round(p.X, digit) + ";"
        + Math.Round(p.Y, digit) + "),";
    }
    sw.WriteLine(strLine);
  }

  public void WriteLines(string name, StreamWriter sw, List<Line > lines, int digit){

  }
  public void WriteRects(string name, StreamWriter sw, List<Rectangle3d > rects, int digit){
    sw.WriteLine(name);
    var strLine = "";
    foreach(Rectangle3d r in rects){
      double x1 = Math.Round(r.Corner(0).X, digit);
      double y1 = Math.Round(r.Corner(0).Y, digit);
      double x2 = Math.Round(r.Corner(2).X, digit);
      double y2 = Math.Round(r.Corner(2).Y, digit);
      double temp;
      if(x1 > x2){
        temp = x1;
        x1 = x2;
        x2 = temp;
      }
      if(y1 > y2){
        temp = y1;
        y1 = y2;
        y2 = temp;
      }
      strLine += "(" + x1 + ";" + y1 + ";" + x2 + ";" + y2 + "),";
    }
    sw.WriteLine(strLine);
  }

  //与场地相交的block列入minus
  private void ToMinus(List < Rectangle3d > minus, List<Rectangle3d> blocks){

    List<Point3d> points;
    foreach(Rectangle3d rect in blocks){
      var region = Curve.CreateBooleanIntersection
        (rect.ToNurbsCurve(), frame.ToNurbsCurve(), 0.1);

      if(region.Length > 0){
        var a = region[0].ToPolyline(0.1, 0.1, 0.1, 100);
        points = new List<Point3d>();
        for(int i = 0;i < a.PointCount;i++){
          points.Add(a.Point(i));
        }
        var r = Rectangle3d.CreateFromPolyline(points);
        minus.Add(r);
      }
    }
  }
# ---------- end site2csv ----------
panel_2 = Panel(site2csv.out)
point = Point(site2csv.A)
dot_display = DotDisplay(Point=point, Colour=RGB(189, 17, 17), Size=0.4)
line = Line(读取分区.Roads_Axis)
dash_pattern = DashPattern(Curve=读取分区.Core_Groups, Pattern=expr("0.8*x", 0.704))  # -> Dashes, Gaps
dash_pattern_2 = DashPattern(Curve=line, Pattern=expr("0.8*x", 0.704))  # -> Dashes, Gaps

linetype_table = LinetypeTable(Update=True)  # -> Linetypes, LinetypePattern
road_3 = CustomPreviewLineweights(
    Geometry=road_2,
    Shader={diffuse=RGB(129, 129, 129), emission=RGB(0, 0, 0), shine=0, specular=RGB(255, 255, 255), transparency=0},
    Thickness=expr("x*0.6", roadwidth_2),
    Absolute=True)
minus_3 = BoundarySurfaces(Edges=minus_2)
nature_3 = BoundarySurfaces()
buildings = BoundarySurfaces(Edges=blocks_2)
list_item_2 = ListItem(List=flatten(linetype_table.Linetypes), Index=1, Wrap=True)
multiplication_2 = Multiplication(A=list_item_2, B=Slider(0.88, range=0..2))
custom_preview = CustomPreview(
    Geometry=minus_3,
    Material={diffuse=RGB(225, 225, 225), emission=RGB(76, 76, 76), shine=0.5, specular=RGB(255, 255, 255), transparency=0})  # disabled
custom_preview_2 = CustomPreview(
    Geometry=buildings,
    Material={diffuse=RGB(225, 225, 225), emission=RGB(0, 0, 0), shine=0, specular=RGB(255, 255, 255), transparency=0})
custom_preview_3 = CustomPreview(
    Geometry=nature_3,
    Material={diffuse=RGB(192, 227, 255), emission=RGB(0, 0, 0), shine=0, specular=RGB(255, 255, 255), transparency=0})
dash_pattern_3 = DashPattern(Curve=boundary_2, Pattern=multiplication_2)  # -> Dashes, Gaps
custom_preview_lineweights = CustomPreviewLineweights(
    Geometry=dash_pattern_3.Dashes,
    Shader={diffuse=RGB(139, 0, 0), emission=RGB(0, 0, 0), shine=0.5, specular=RGB(255, 255, 255), transparency=0},
    Thickness=0.24,
    Absolute=True)  # disabled

# ----
# 1-1.Display  SITE
road_4 = CustomPreviewLineweights(
    Geometry=road_2,
    Shader={diffuse=RGB(105, 105, 105), emission=RGB(0, 0, 0), shine=0, specular=RGB(255, 255, 255), transparency=0},
    Thickness=expr("x*0.6", 0.2),
    Absolute=True)
custom_preview_lineweights_2 = CustomPreviewLineweights(
    Geometry=dash_pattern.Dashes,
    Shader={diffuse=RGB(217, 0, 0), emission=RGB(0, 0, 0), shine=0, specular=RGB(255, 255, 255), transparency=0},
    Thickness=0.3,
    Absolute=True)
custom_preview_lineweights_3 = CustomPreviewLineweights(
    Geometry=dash_pattern_2.Dashes,
    Shader={diffuse=RGB(217, 0, 0), emission=RGB(0, 0, 0), shine=0, specular=RGB(255, 255, 255), transparency=0},
    Thickness=0.3,
    Absolute=True)
fillet = Fillet(Curve=读取分区.Districts, Radius=0.2)  # -> graft(Curve)
brep = Brep()

# ---- group: infoList
row_spacing = Slider(0.84, range=0..10)
size = Slider(0.67, range=0..2)
coldist2 = Slider(4.9, range=0..10)
coldist1 = Slider(3.9, range=0..20)
point_2 = Point(Point(43.1420272, 20.53258809, 0))
unit_x = UnitX(Factor=coldist1)
merge = Merge(Data2=simplify(graft(text)))
unit_x_2 = UnitX(Factor=coldist2)
text_join = TextJoin(Text=merge)  # -> flatten(Result)
merge_2 = Merge(Data1="Gross Area", Data2=读取分区.BuildingArea)

# ----
# 3.Display Districts
分区结果 = Curve(simplify(fillet))

# ---- group: districtName
area_4 = Area(Geometry=分区结果)  # -> Area, Centroid
text_tag_3d = TextTag3D(Location=area_4.Centroid, Text=text, Size=Slider(0.6, range=0..1), Colour=RGB(0, 0, 0), Justification=5)  # disabled

# ---- group: districtLine
linetype_table_2 = LinetypeTable(Update=True)  # -> Linetypes, LinetypePattern
list_item_3 = ListItem(List=flatten(linetype_table_2.Linetypes), Index=1, Wrap=True)
multiplication_3 = Multiplication(A=list_item_3, B=Slider(0.261, range=0..2))
dash_pattern_4 = DashPattern(Curve=分区结果, Pattern=multiplication_3)  # -> Dashes, Gaps
custom_preview_lineweights_4 = CustomPreviewLineweights(
    Geometry=dash_pattern_4.Dashes,
    Shader={diffuse=RGB(0, 0, 0), emission=RGB(0, 0, 0), shine=0.5, specular=RGB(255, 255, 255), transparency=0},
    Thickness=0.2,
    Absolute=True)

# ---- group: districtColor
integer = Integer(读取分区.Color)
list_item_4 = ListItem(List=integer, Index=-1, Wrap=True)
remap_numbers = RemapNumbers(Value=integer, Source=list_item_4, Target=Domain(0, 0.9))  # -> Mapped, Clipped
boundary_surfaces = BoundarySurfaces(Edges=分区结果)
colour_hsl = ColourHSL(Alpha=1, Hue=remap_numbers.Mapped, Saturation=0.7, Luminance=0.9)
custom_preview_4 = CustomPreview(Geometry=boundary_surfaces, Material=graft(colour_hsl))

# ---- group: infoList (continued)
list_length = ListLength(List=integer)
area_5 = Area(Geometry=分区结果)  # -> Area, Centroid
c_script_3 = CSharpScript(index=integer)  # -> out, Indexes; inputs index: list of Int32
# ---------- c_script_3: C# ----------
    List<String> output = new List<String>();
    int index2 = 0;
    int last = index[0];
    output.Add(index[0].ToString());
    for(int i = 1;i < index.Count;i++){
      if(index[i] == last){
        index2++;
        output.Add(index[i] + "-" + index2);
      }
      else{
        index2 = 0;
        last = index[i];
        output.Add(index[i].ToString());
      }
    }
    Indexes = output;
# ---------- end c_script_3 ----------
series = Series(Start=0, Step=row_spacing, Count=expr("x+1", list_length))
unit_y = UnitY(Factor=expr("-x", series))
multiplication_4 = Multiplication(A=area_5.Area, B=400)
move = Move(Geometry=point_2, Motion=unit_y)  # -> Geometry, Transform
move_2 = Move(Geometry=move.Geometry, Motion=unit_x)  # -> simplify(Geometry), Transform
integer_2 = Integer(simplify(flatten(multiplication_4)))
move_3 = Move(Geometry=move_2.Geometry, Motion=unit_x_2)  # -> simplify(flatten(Geometry)), Transform
merge_3 = Merge(Data1="Index", Data2=flatten(c_script_3.Indexes))
merge_4 = Merge(Data1="Site Area", Data2=integer_2)
text_tag_3d_2 = TextTag3D(Location=move_3.Geometry, Text=merge_2, Size=size, Colour=RGB(0, 0, 0), Justification=8)  # disabled
text_tag_3d_3 = TextTag3D(Location=move.Geometry, Text=merge_3, Size=size, Colour=RGB(0, 0, 0), Justification=8)  # disabled
text_tag_3d_4 = TextTag3D(Location=move_2.Geometry, Text=merge_4, Size=size, Colour=RGB(0, 0, 0), Justification=8)  # disabled

# ---- group: building
显示体量 = CSharpScript(districtCur=graft(分区结果), height=4.8, layers=读取分区.Layers, floorAreas=读取分区.FloorAreas, grid=20)  # -> Center, Layer, simplify(A), B; inputs districtCur: Curve, height: Double, layers: list of Int32, floorAreas: list of Double, grid: Double
# ---------- 显示体量: C# usings ----------
using rd = Rhino.NodeInCode;
[ObsoleteAttribute("Use version that takes tolerance as input")]
# ---------- 显示体量: C# ----------
    var func = rd.Components.FindComponent("Area");
    var func1 = func.Delegate as dynamic;

    var area = func1(districtCur)[0][0];
    var center = func1(districtCur)[1][0];

    double floorAll = 0;
    double l = 0;
    for(int i = 0; i < floorAreas.Count;i++){
      floorAll += floorAreas[i];

    }
    if(floorAll > 0){
      for(int i = 0; i < floorAreas.Count;i++){
        l += layers[i] * floorAreas[i] / floorAll;
      }
    }

    int layer = (int) l;
    Layer = layer;

    if(floorAll > 0){
      double k = Math.Sqrt(floorAll / grid / grid / area);
      var a = Transform.Scale(center, k);
      districtCur.Transform(a);


      func = rd.Components.FindComponent("Extrude");
      func1 = func.Delegate as dynamic;
      var breps = func1(districtCur, new Vector3d(0, 0, l * height / grid));


      if(breps != null){

        func = rd.Components.FindComponent("CapHoles");
        func1 = func.Delegate as dynamic;
        var building = func1(breps[0]);
        B = building;
      }
      A = districtCur;
      func = rd.Components.FindComponent("LinearArray");
      func1 = func.Delegate as dynamic;
      var vec = new Vector3d(0, 0, height / grid);
      var curs = func1(districtCur, vec, layer + 1)[0];
      A = curs;

    }
    Center = center;
# ---------- end 显示体量 ----------
custom_preview_5 = CustomPreview(Geometry=flatten(显示体量.B), Material=colour_hsl)
custom_preview_lineweights_5 = CustomPreviewLineweights(
    Geometry=显示体量.A,
    Shader={diffuse=RGB(74, 80, 88), emission=RGB(0, 0, 0), shine=0, specular=RGB(255, 255, 255), transparency=0},
    Thickness=1,
    Absolute=False)

# ----
unit_z = UnitZ(Factor=expr("4.8*x/20", 显示体量.Layer))
move_4 = Move(Geometry=area_4.Centroid, Motion=unit_z)  # -> Geometry, Transform
text_tag_3d_5 = TextTag3D(Location=move_4.Geometry, Text=graft(读取分区.Color), Size=2.5, Colour=RGB(0, 0, 0), Justification=5)
