# Grasshopper definition 写入分区forXA.gh (Grasshopper 1.0.7)
# plug-ins: Human, MultiAgent, Pufferfish

area = Area(Geometry=<brep referenced from the Rhino model>)  # -> Area, Centroid
area_2 = Area(Geometry=[<curve referenced from the Rhino model> x3])  # -> Area, Centroid
mass_addition = MassAddition(Input=area_2.Area)  # -> Result, PartialResults
division = Division(A=area_2.Area, B=Slider(201, range=0..1000))
multiplication = Multiplication(A=division, B=area.Area)
division_2 = Division(A=multiplication, B=area_2.Area)
square_root = SquareRoot(Value=division_2)

# ---- group: 旋转调整
九龙湖 = Curve(<curve referenced from the Rhino model>)
九龙湖road = Curve([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])
九龙湖rect = Rectangle(九龙湖)
# 凸多边形是且，凹多边形是或
c_script = CSharpScript(boundry=九龙湖, rectRef=九龙湖rect)  # -> out, A, B; inputs boundry: Polyline, rectRef: Rectangle3d
# ---------- c_script: C# ----------
    Vector3d ax = rectRef.Corner(1) - rectRef.Corner(0);
    Point3d p = rectRef.Corner(0);
    B = p;
    var var1 = Vector3d.Multiply(ax, new Vector3d(0, 1, 0)) / ax.Length;
    //var t = Math.PI * Math.Sqrt(2) / 2;
    double angle;
    angle = Math.Acos(Math.Abs(var1));
    if(angle > Math.PI / 2){
      angle = Math.PI - angle;
    }
    if(angle > Math.PI / 4){
      angle = angle - Math.PI / 2;
    }
    A = angle;
# ---------- end c_script ----------
rotate = Rotate(Geometry=九龙湖, Angle=c_script.A, Plane=c_script.B)  # -> Geometry, Transform
rotate_2 = Rotate(Geometry=九龙湖road, Angle=c_script.A, Plane=PlaneXY(0, 0, 0))  # -> Geometry, Transform

# ----
_3 = Curve(<curve referenced from the Rhino model>)
提取凹部矩形 = CSharpScript(boundry=_3)  # -> out, A, Minus, C; inputs boundry: Polyline
# ---------- 提取凹部矩形: C# usings ----------
using rd = Rhino.NodeInCode;
using Rhino.Geometry.Intersect;
# ---------- 提取凹部矩形: C# ----------
    minus = new List<Rectangle3d>();
    lines = new List<Line>();
    //Flip
    double area = 0;
    for(int i = 0;i < boundry.Count - 1;i++){
      area += boundry[i].X * boundry[i + 1].Y - boundry[i].Y * boundry[i + 1].X;
    }
    if(area < 0){
      Print("Flip");
      var Func = rd.Components.FindComponent("FlipCurve");
      var Func1 = Func.Delegate as dynamic;
      var dry = Func1(boundry, null)[0][0];
      var boundry1 = new Polyline();
      dry.TryGetPolyline(out boundry);

    }
    //oob
    var oob = boundry.BoundingBox;
    var frame = new Rectangle3d(Plane.WorldXY, oob.Corner(false, false, false), oob.Corner(true, true, false));
    A = frame;


    //connexHull
    var pts = new List<Point3d >();
    foreach(Point3d p in boundry){
      pts.Add(p);
    }
    var com = rd.Components.FindComponent("ConvexHull");
    var com1 = com.Delegate as dynamic;
    var convexHull = com1(pts, Plane.WorldXY)[0][0];
    var conH = convexHull.ToPolyline();
    pts.Clear();

    if(conH.Count == boundry.Count){
      Print("凸多边形");
    }else{
      Print("凹多边形");
      GetMinus(boundry, conH, frame);
    }
    Minus = minus;
    C = lines;
# ---------- 提取凹部矩形: C# additional code ----------
  List<Rectangle3d> minus;
  List<Line> lines;


  void GetMinus(Polyline boundry, Polyline conH, Rectangle3d frame){
    var inside = new List<int>();

    for(int i = 0;i < boundry.Count - 1;i++){
      if(!conH.Contains(boundry[i])){
        inside.Add(i);
        Print("inside" + i.ToString());
      }
    }
    foreach(int i in inside){
      var p1 = boundry[(i - 1 + boundry.Count - 1) % (boundry.Count - 1)];
      var p2 = boundry[(i + 1) % (boundry.Count - 1)];

      Point3d corner = new Point3d();//角点
      for(int j = 0;j < 4;j++){
        corner = frame.Corner(j);
        var line = new Line(corner, boundry[i]);
        lines.Add(line);
        //var Func = rd.Components.FindComponent("Curve|Curve");
        //var Func1 = Func.Delegate as dynamic;
        var pt = Intersection.CurveLine(boundry.ToPolylineCurve(), line, 0, 0);
        Print(pt.Count.ToString());
        if(pt.Count < 3){
          var tempMinus = new Rectangle3d(Plane.WorldXY, boundry[i], corner);

          if(Intersection.CurveCurve(boundry.ToPolylineCurve(), tempMinus.ToNurbsCurve(), 0, 0).Count < 2){
            minus.Add(new Rectangle3d(Plane.WorldXY, boundry[i], corner));
            break;
          }else minus.Add(new Rectangle3d(Plane.WorldXY, p1, p2));
        }
      }
    }
  }
# ---------- end 提取凹部矩形 ----------

curve = Curve(提取凹部矩形.Minus)
panel = Panel(curve)
c_script_2 = CSharpScript()  # -> out
# ---------- c_script_2: C# usings ----------
using rd = Rhino.NodeInCode;
# ---------- c_script_2: C# ----------
    var a = Rhino.NodeInCode.Components.NodeInCodeFunctions.
      GetDynamicMemberNames();
    foreach(string s in a){
      Print(s);
    }
# ---------- end c_script_2 ----------

# ---- group: CampusA
rectangle = Rectangle(simplify(flatten([{Plane=PlaneXY(23.60638413, 113.8320226, 0), Size=Domain2(u=-3.945..3.945, v=-6.65..6.65)}, {Plane=PlaneXY(41.61895345, 107.6078932, 0), Size=Domain2(u=-3.8..3.8, v=-7.6..7.6)}, {Plane=PlaneXY(40.64, 122.945, 0), Size=Domain2(u=0..9.22, v=0..8.49)}, {Plane=PlaneXY(33.34885111, 110.663829, 0), Size=Domain2(u=-3.95..3.95, v=-3.405..3.405)}, {Plane=PlaneXY(50.265, 122.95, 0), Size=Domain2(u=0..7.07, v=0..11.84)}, {Plane=PlaneXY(34.42070095, 104.2571247, 0), Size=Domain2(u=-1.5..1.5, v=-2.495..2.495)}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])))
circle = Circle(Tree({0}: [{Plane=PlaneXY(19.51812361, 106.98239, 0), Radius=0.4}, {Plane=PlaneXY(19.70472302, 107.8420787, 0), Radius=0.4}, {Plane=PlaneXY(19.49628054, 108.6964439, 0), Radius=0.4}, {Plane=PlaneXY(19.54537855, 109.574161, 0), Radius=0.4}, {Plane=PlaneXY(19.76785219, 110.4242709, 0), Radius=0.4}, {Plane=PlaneXY(19.40799225, 111.2244462, 0), Radius=0.4}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], {1}: [{Plane=PlaneXY(38.14039512, 100.9781473, 0), Radius=0.4}, {Plane=PlaneXY(37.28777628, 101.0962596, 0), Radius=0.4}, {Plane=PlaneXY(37.7123082, 101.8723346, 0), Radius=0.4}, {Plane=PlaneXY(37.52986975, 102.726858, 0), Radius=0.4}, {Plane=PlaneXY(38.09694647, 103.388957, 0), Radius=0.4}, {Plane=PlaneXY(38.22496086, 104.2469113, 0), Radius=0.4}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], {2}: [{Plane=PlaneXY(39.92279703, 123.0022468, 0), Radius=0.4}, {Plane=PlaneXY(40.23064805, 124.1704391, 0), Radius=0.4}, {Plane=PlaneXY(39.94618498, 124.9650618, 0), Radius=0.4}, {Plane=PlaneXY(40.24493971, 125.7749093, 0), Radius=0.4}, {Plane=PlaneXY(39.91998849, 126.565406, 0), Radius=0.4}, {Plane=PlaneXY(40.28618386, 127.2793059, 0), Radius=0.4}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], {3}: [{Plane=PlaneXY(31.04391444, 106.5525683, 0), Radius=0.4}, {Plane=PlaneXY(31.79463328, 106.9816704, 0), Radius=0.4}, {Plane=PlaneXY(31.04467521, 108.2092874, 0), Radius=0.4}, {Plane=PlaneXY(31.02922657, 109.004885, 0), Radius=0.4}, {Plane=PlaneXY(31.02203571, 109.8384047, 0), Radius=0.4}, {Plane=PlaneXY(31.03120959, 111.4945104, 0), Radius=0.4}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], {4}: [{Plane=PlaneXY(50.67314332, 123.5621628, 0), Radius=0.4}, {Plane=PlaneXY(51.21771962, 124.1185713, 0), Radius=0.4}, {Plane=PlaneXY(50.64523057, 124.4356677, 0), Radius=0.4}, {Plane=PlaneXY(50.66565981, 125.2211317, 0), Radius=0.4}, {Plane=PlaneXY(50.66026674, 126.0045871, 0), Radius=0.4}, {Plane=PlaneXY(50.66322937, 126.8378229, 0), Radius=0.4}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], {5}: [{Plane=PlaneXY(32.7222634, 101.9013758, 0), Radius=0.4}, {Plane=PlaneXY(33.10874233, 102.7043264, 0), Radius=0.4}, {Plane=PlaneXY(32.49470019, 103.3336686, 0), Radius=0.4}, {Plane=PlaneXY(31.41897655, 104.1708279, 0), Radius=0.4}, {Plane=PlaneXY(31.04574124, 103.3853204, 0), Radius=0.4}, {Plane=PlaneXY(33.16413429, 104.2119026, 0), Radius=0.4}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]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))

# ----
curve_2 = Curve(Tree({0}: [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], {1}: [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], {2}: [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], {3}: [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], {4}: [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], {5}: [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]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))

roadwidth = Number([0.5, 0.5, 1, 2, 2, 1, 1])
file_path = FilePath("E:\grasshopper_C#\中文投稿\雄安大学城资料\siteA.csv")
road = Line([Line((10.15662339, 157.6933585, 0), (16.72212189, 112.1123003, 0)), Line((16.72212189, 112.1123003, 0), (26.77295059, 90.69923423, 0)), Line((26.77295059, 90.69923423, 0), (36.66358831, 92.599906, 0)), Line((36.66358831, 92.599906, 0), (79.80273099, 125.4609505, 0)), Line((79.80273099, 125.4609505, 0), (53.49127099, 157.6933585, 0)), Line((7.418090417, 122.2517043, 0), (40.40499189, 122.2517043, 0)), Line((40.40499189, 122.2517043, 0), (61.22999154, 95.20870561, 0))])
boundary = Curve(<curve referenced from the Rhino model>)
minus = Rectangle({Plane=PlaneXY(13.47989362, 101.174773, 0), Size=Domain2(u=-3.242228267..3.242228267, v=-10.9375273..10.9375273)})

entrance = Point([Point(30, 88.27613144, 0), Point(54.74893905, 102.8819308, 0), Point(29.79807329, 160.8576387, 0), Point(7.418090417, 122.2517043, 0), Point(32.14292856, 107.7585729, 0)])

rectangle_2 = Rectangle([{Plane=PlaneXY(74.67, 73.89, 0), Size=Domain2(u=0..10.3, v=0..8.86)}, {Plane=PlaneXY(69.065, 83.255, 0), Size=Domain2(u=0..7.93, v=0..11.19)}, {Plane=PlaneXY(77.395, 83.255, 0), Size=Domain2(u=0..7.57, v=0..11.19)}, {Plane=PlaneXY(69.055, 73.89, 0), Size=Domain2(u=0..5.21001, v=0..8.86)}, {Plane=PlaneXY(85.37, 88.845, 0), Size=Domain2(u=0..10.26, v=0..7.15)}, {Plane=PlaneXY(67.16, 80.34, 0), Size=Domain2(u=-1.5..1.5, v=-2.415..2.415)}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])
curve_3 = Curve(Tree({0}: [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], {1}: [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], {2}: [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], {3}: [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], {4}: [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], {5}: [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]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))
curve_4 = Curve(Tree({0;0}: [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], {0;1}: [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], {0;2}: [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], {0;3}: [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], {0;4}: [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], {0;5}: [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]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))

file_path_2 = FilePath(["E:\grasshopper_C#\中文投稿\雄安大学城资料\location11-1.csv", "E:\grasshopper_C#\中文投稿\雄安大学城资料\location22-3.csv", "E:\grasshopper_C#\中文投稿\雄安大学城资料\location33-22.csv"])

roadwidth_2 = Number([0.5, 1, 1, 2])
entrance_2 = Point([Point(50.36775614, 80.91448938, 0), Point(64.01178043, 52.86843945, 0), Point(98.03761878, 82.51471445, 0), Point(58.78999336, 111.9925447, 0)])
road_2 = Line([Line((52.45565828, 86.53737806, 0), (43.76679563, 97.97700602, 0)), Line((43.76679563, 97.97700602, 0), (79.80273099, 125.4609505, 0)), Line((79.80273099, 125.4609505, 0), (95.83135142, 105.869832, 0)), Line((64.45973398, 55.5, 0), (64.45973398, 90.59587839, 0))])
boundary_2 = Curve(<curve referenced from the Rhino model>)
minus_2 = Rectangle({Plane=PlaneXY(48.12548368, 71.01868903, 0), Size=Domain2(u=-4.330174606..4.330174606, v=-15.51868903..15.51868903)})

rectangle_3 = Rectangle([{Plane=PlaneXY(61.41, 0.1999998, 0), Size=Domain2(u=0..8.48, v=0..15.3000002)}, {Plane=PlaneXY(42.9988562, 7.6399999, 0), Size=Domain2(u=-4.635..4.635, v=-7.4400001..7.4400001)}, {Plane=PlaneXY(70.295, 3.98, 0), Size=Domain2(u=0..9.45, v=0..9.62)}, {Plane=PlaneXY(82.16, 19.735, 0), Size=Domain2(u=-6.465..6.465, v=-3.235..3.235)}, {Plane=PlaneXY(80.145, 5.724999, 0), Size=Domain2(u=0..4.89, v=0..9.770001)}, {Plane=PlaneXY(42.04, 34.795, 0), Size=Domain2(u=0..8.3, v=0..11.93)}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])
curve_5 = Curve(Tree({0}: [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], {1}: [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], {2}: [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], {3}: [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], {4}: [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], {5}: [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]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))

resultpath = FilePath("E:\grasshopper_C#\test\4.3\locationAT2.csv")
nature = Curve(<curve referenced from the Rhino model>)
boundary_3 = Curve(<curve referenced from the Rhino model>)
roadwidth_3 = Number([0.5, 1, 1, 1, 1])
entrance_3 = Point([Point(24.60237251, 21.10961935, 0), Point(55.58788721, -2.701396975, 0), Point(95.09961736, 24.12498823, 0), Point(67.23344978, 57.60598062, 0), Point(62.71372394, 24.06029707, 0)])
# 2.Get  Districts
list_item = ListItem(List=file_path_2, Index=Slider(0, range=0..2), Wrap=True)

读取分区 = CSharpScript(file=list_item, grid=20, result=Slider(4, range=1..5))  # -> out, DistrictNames, Districts, Color, Core_Groups, Roads_Axis, Widths, flatten(BuildingArea), Layers, FloorAreas; inputs file: String, grid: Double, result: Int32
# ---------- 读取分区: C# usings ----------
using System.IO;
# ---------- 读取分区: C# ----------
    floorArea = new DataTree<double>();
    layer = new DataTree<int>();
    nameList = new List<string>();
    infoList = new List<double>();
    buildings = new DataTree<Box>();
    groups = new List<Rectangle3d>();

    var fs = new FileStream(file, FileMode.Open, FileAccess.Read);
    var sr = new StreamReader(fs);
    string strLine = " ";
    var resultList = new List<string>();


    //读取分区
    sr.ReadLine();
    while ((strLine = sr.ReadLine()) != null){
      if(strLine.Contains("Rectangle")){
        break;
      }
      Print(strLine.ToString());
      string[] str = strLine.Split(',');
      nameList.Add(str[0]);
      resultList.Add(str[result]);
    }
    var districts = ExportDistrict(resultList, grid);


    //读取矩形结构
    while ((strLine = sr.ReadLine()) != null && strLine.Contains("Rectangle")){
      Print(strLine.ToString());
      string[] str = strLine.Split(',');
      var strArray = str[result].Split(new char[3] { '(',';', ')' });
      groups.Add(ReadRectangle(strArray));
      Print("GroupTrue");
    }

    List<double> widthList = new List<double>();
    List<Line> lines = new List<Line>();
    while ((strLine = sr.ReadLine()) != null){
      if(strLine == "Roads"){
        strLine = sr.ReadLine();
      }
      if(strLine == "Axis"){
        break;
      }
      Print(strLine.ToString());
      string[] str = strLine.Split(',');
      widthList.Add(double.Parse(str[0]));
      var strArray = str[result].Split(new char[3] { '(',';', ')' });
      //lines.Add(ReadLine(strArray));
      double x1 = double.Parse(strArray[1]);
      double y1 = double.Parse(strArray[2]);
      double x2 = double.Parse(strArray[3]);
      double y2 = double.Parse(strArray[4]);
      var line = new Line(x1, y1, 0, x2, y2, 0);
      lines.Add(line);

    }

    //color Num
    List<int> color = new List<int>();
    int temp = 0;
    color.Add(temp);
    for(int i = 1;i < nameList.Count;i++){
      if(nameList[i] != nameList[i - 1]){
        temp++;
      }
      color.Add(temp);
    }
    Color = color;



    Districts = districts;
    DistrictNames = nameList;
    Layers = layer;
    FloorAreas = floorArea;
    BuildingArea = infoList;
    //Buildings = buildings;
    Core_Groups = groups;
    Roads_Axis = lines;
    Widths = widthList;
# ---------- 读取分区: C# additional code ----------
  DataTree<double> floorArea;
  DataTree<int> layer;
  List<string> nameList;
  List<double> infoList;
  DataTree<Box> buildings;
  List<Rectangle3d> groups;

  public List<Rectangle3d> ExportDistrict(List<string> resultList, double grid){
    var districts = new List<Rectangle3d>();
    int index = 0;
    foreach(string str in resultList){


      string[] strArray = str.Split(new char[3] { '(',';', ')' });
      var rect = ReadRectangle(strArray);
      districts.Add(rect);

      try{
        double buildingArea = double.Parse(strArray[7]);
        string area = strArray[6];
        infoList.Add(Math.Round(buildingArea, 0));
      }catch{
        infoList.Add(-1);
      }

      //建筑信息和绘制建筑
      var path = new GH_Path(index);

      if((strArray.Length - 8) > 0){
        int i = 8;
        double height = 4 / grid;
        double deta = 0.4;

        //double y1 = y + deta;
        while(i + 1 < strArray.Length){
          int floor = int.Parse(strArray[i + 1]);
          //double z = 0;
          var f_area = double.Parse(strArray[i]);
          var h1 = f_area / (rect.Width - deta * 2) / grid / grid;

          //for(int f = 0;f < floor;f++){
          //var xRange = new Interval(x + deta, x + w - deta);
          //var yRange = new Interval(y1, y1 + h1);
          //var zRange = new Interval(z, z + height);
          //buildings.Add(new Box(Plane.WorldXY, xRange, yRange, zRange), path);
          //z += height;
          //}
          floorArea.Add(f_area, path);
          layer.Add(floor, path);
          i += 2;
          //y1 += h1 / 2;
        }

      }else{
        layer.Add(0, path);
        floorArea.Add(0, path);
      }
      index++;
    }
    return districts;
  }

  public Rectangle3d ReadRectangle(string[] strArray){

    double x = double.Parse(strArray[1]);
    double y = double.Parse(strArray[2]);
    double w = double.Parse(strArray[3]) - double.Parse(strArray[1]);
    double h = double.Parse(strArray[4]) - double.Parse(strArray[2]);
    Point3d p3d = new Point3d(x, y, 0);
    Plane p = new Plane(p3d, new Vector3d(0, 0, 1));

    return new Rectangle3d(p, w, h);
  }
# ---------- end 读取分区 ----------

text = Text(simplify(graft(读取分区.DistrictNames)))
file_path_3 = FilePath("E:\grasshopper_C#\test\4.2\location1-1.csv")

roadwidth_4 = Number(roadwidth_3)
minus_3 = Rectangle()
entrance_4 = Point(entrance_3)
file_path_4 = FilePath("E:\grasshopper_C#\中文投稿\雄安大学城资料\siteC.csv")
# 1.Set  SITE
boundary_4 = Curve(boundary_3)
trigger = Trigger(Interval=-1000, TimerInterval=1000, Target=site2csv)  # disabled

road_3 = Line([Line((83.29006198, 0, 0), (95.8329805, 34.5356531, 0)), Line((51.03754842, 0, 0), (51.03754842, 21.64544538, 0)), Line((55.38323085, 38.29338196, 0), (62.10297078, 55.5, 0)), Line((29.32041808, 0, 0), (29.32041808, 55.5, 0))])
blocks = Rectangle()
nature_2 = Curve(nature)
unit_y = UnitY(Factor=-1.5)
site2csv = CSharpScript(
    boundry=boundary_4,
    minus=minus_3,
    blocks=blocks,
    edge=nature_2,
    road=road_3,
    roadWidth=roadwidth_4,
    entrance=entrance_4,
    fileName=file_path_4)  # -> out, A, B; inputs boundry: Polyline, minus: list of Rectangle3d, blocks: list of Rectangle3d, edge: list of Curve, road: list of Line, roadWidth: list of Double, entrance: list of Point3d, fileName: String; disabled
# ---------- site2csv: C# ----------
    var oob = boundry.BoundingBox;
    frame = new Rectangle3d(Plane.WorldXY, oob.Corner(false, false, false), oob.Corner(true, true, false));
    B = frame;
    int digit = 2;//保留位数
    ToMinus(minus, blocks);
    A = minus;

    if (fileName != null)
    {
      FileStream fs = new FileStream(fileName, FileMode.Create, FileAccess.Write);
      StreamWriter sw = new StreamWriter(fs, System.Text.Encoding.UTF8);

      var strLine = string.Empty;
      var index = 0;

      //写入Boundry
      sw.WriteLine("Boundry");
      foreach(Point3d p in boundry){
        strLine += "(" + Math.Round(p.X, digit) + ";" +
          Math.Round(p.Y, digit) + "),";
      }
      sw.WriteLine(strLine);

      //写入Frame
      sw.WriteLine("Frame");
      sw.WriteLine("(" + Math.Round(frame.Corner(0).X, digit) + ";" +
        Math.Round(frame.Corner(0).Y, digit) + ";" +
        Math.Round(frame.Corner(2).X, digit) + ";" +
        Math.Round(frame.Corner(2).Y, digit) + ")");

      //写入Minus
      WriteRects("Minus", sw, minus, digit);
      //写入block
      if(blocks != null)
        WriteRects("Block", sw, blocks, digit);


      //写入entrance
      WritePoints("Entrance", sw, entrance, digit);

      //写入outsidePoints
      if(edge != null){
        List<Point3d> inside = new List<Point3d>();

        var origin = new Point3d((frame.Corner(0).X + 0.5), (frame.Corner(0).Y + 0.5), 0);

        for(int i = 0;i <= (int) (frame.Width + 0.5);i++){
          for(int j = 0;j <= (int) (frame.Height + 0.5);j++)
          {
            foreach(Curve e in edge){
              var p = origin + new Vector3d(i, j, 0);
              var isInside = e.Contains(p, Plane.WorldXY, 0.01) == PointContainment.Inside;
              double t;
              e.ClosestPoint(p, out t);
              var dist = p.DistanceTo(e.PointAt(t));

              //Print(isInside.ToString());
              if(isInside & dist > 0.25){
                inside.Add(p);

              }
            }
          }
        }
        A = inside;
        WritePoints("OutsidePoints", sw, inside, digit);
      }

      //写入Road
      sw.WriteLine("Road");
      strLine = "";
      index = 0;

      var tempPoiList = new List<Point3d>();//
      foreach(Line l in road){

        strLine += "(" + Math.Round(l.FromX, digit) + ";"
          + Math.Round(l.FromY, digit)
          + ";" + Math.Round(l.ToX, digit) + ";" +
          Math.Round(l.ToY, digit) + ")" + roadWidth[index] + ";";

        string strTemp = "";//线段是否相交
        ///直线与场地是否相交
        Rhino.Geometry.Intersect.CurveIntersections bo;
        bool bo2;
        try{
          bo = Rhino.Geometry.Intersect.Intersection.
            CurveCurve(boundry.ToPolylineCurve(), l.ToNurbsCurve(), 0, 0);
          bo2 = bo[0].IsPoint;
          //Print(index + ":bo=" + bo.Count.ToString());
        }catch{
          bo = null;
          bo2 = false;
        }
        //var bo1 = Rhino.Geometry.Intersect.Intersection.CurveCurve(frame.ToNurbsCurve(),
        //l.ToNurbsCurve(), 0, 0);

        
        //线段与边界

        //Print(bo2.ToString());

        //完全不相交
        if(bo == null || bo.Count == 0){
          strTemp = "0";
          Print("道路" + index + "不相交");
        }
          //道路存在部分在边界内，需避开=2
        else if(bo2){
          Print("道路" + index + "与场地相交");
          strTemp = "2";
          strTemp += "(" + Math.Round(bo[0].PointA.X, digit)
            + ";" + Math.Round(bo[0].PointA.Y, digit)
            + ";" + Math.Round(bo[0].PointA.X, digit)
            + ";" + Math.Round(bo[0].PointA.Y, digit) + ")";
        }
        else{
          //道路切割一部分=+1/-1
          var x1 = l.FromX;
          var x2 = l.ToX;
          var y1 = l.FromY;
          var y2 = l.ToY;
          double a,b,c;
          if(x1 != x2){
            a = (y2 - y1) / (x2 - x1);
            b = -1;
          }else{
            b = 0;
            a = -1;
          }
          c = -b * y1 - a * x1;

          //直线相交但线段不相交的情况,做切割线
          //找最近点
          Point3d testPoi = boundry.CenterPoint();
          if(bo.Count == 1 & !bo2){
            //Print(bo.Count.ToString());
            var mid = new Point3d((l.FromX + l.ToX) / 2, (l.FromY + l.ToY) / 2, l.ToZ);
            testPoi = frame.ToPolyline().ClosestPoint(mid);

            //判断在上or下
            if(a * testPoi.X + b * testPoi.Y + c > 0){
              strTemp = "-1";//线在点上方，去除下方
              Print("道路" + index + "=-1");
            }
            if(a * testPoi.X + b * testPoi.Y + c < 0){
              strTemp = "1";//线在点下方，去除上方
              Print("道路" + index + "=1");
            }
          }

        }


        strLine += strTemp + ",";
        index++;
      }
      sw.WriteLine(strLine);

      sw.Close();
      fs.Close();
      //A = tempPoiList;
    }
# ---------- site2csv: C# additional code ----------
  Rectangle3d frame;

  public void WritePoints(string name, StreamWriter sw, List<Point3d > points, int digit){
    sw.WriteLine(name);
    var strLine = "";
    foreach(Point3d p in points){
      strLine += "(" + Math.Round(p.X, digit) + ";"
        + Math.Round(p.Y, digit) + "),";
    }
    sw.WriteLine(strLine);
  }

  public void WriteLines(string name, StreamWriter sw, List<Line > lines, int digit){

  }
  public void WriteRects(string name, StreamWriter sw, List<Rectangle3d > rects, int digit){
    sw.WriteLine(name);
    var strLine = "";
    foreach(Rectangle3d r in rects){
      double x1 = Math.Round(r.Corner(0).X, digit);
      double y1 = Math.Round(r.Corner(0).Y, digit);
      double x2 = Math.Round(r.Corner(2).X, digit);
      double y2 = Math.Round(r.Corner(2).Y, digit);
      double temp;
      if(x1 > x2){
        temp = x1;
        x1 = x2;
        x2 = temp;
      }
      if(y1 > y2){
        temp = y1;
        y1 = y2;
        y2 = temp;
      }
      strLine += "(" + x1 + ";" + y1 + ";" + x2 + ";" + y2 + "),";
    }
    sw.WriteLine(strLine);
  }

  //与场地相交的block列入minus
  private void ToMinus(List < Rectangle3d > minus, List<Rectangle3d> blocks){

    List<Point3d> points;
    foreach(Rectangle3d rect in blocks){
      var region = Curve.CreateBooleanIntersection
        (rect.ToNurbsCurve(), frame.ToNurbsCurve(), 0.1);

      if(region.Length > 0){
        var a = region[0].ToPolyline(0.1, 0.1, 0.1, 100);
        points = new List<Point3d>();
        for(int i = 0;i < a.PointCount;i++){
          points.Add(a.Point(i));
        }
        var r = Rectangle3d.CreateFromPolyline(points);
        minus.Add(r);
      }
    }
  }
# ---------- end site2csv ----------
panel_2 = Panel(site2csv.out)
rectangle_4 = Rectangle(site2csv.B)
line = Line(读取分区.Roads_Axis)
line_2 = Line([Line((6.433782926, 14.0582479, 0), (16.7411913, 14.0582479, 0)), Line((27.16573647, 11.48656727, 0), (27.16573647, 2.051951746, 0))])  # disabled
point = Point(site2csv.A)
# 1-1.Display  SITE
dot_display = DotDisplay(Point=point, Colour=RGB(189, 17, 17), Size=0.4)  # disabled
dash_pattern = DashPattern(Curve=读取分区.Roads_Axis, Pattern=expr("0.8*x", 0.704))  # -> Dashes, Gaps
dash_pattern_2 = DashPattern(Curve=[line, line_2], Pattern=expr("0.8*x", 0.704))  # -> Dashes, Gaps
custom_preview_lineweights = CustomPreviewLineweights(
    Geometry=读取分区.Roads_Axis,
    Shader={diffuse=RGB(234, 234, 234), emission=RGB(0, 0, 0), shine=0, specular=RGB(255, 255, 255), transparency=0},
    Thickness=0.8,
    Absolute=True)  # disabled
custom_preview_lineweights_2 = CustomPreviewLineweights(
    Geometry=dash_pattern.Dashes,
    Shader={diffuse=RGB(217, 0, 0), emission=RGB(0, 0, 0), shine=0, specular=RGB(255, 255, 255), transparency=0},
    Thickness=0.15,
    Absolute=True)  # disabled
custom_preview_lineweights_3 = CustomPreviewLineweights(
    Geometry=dash_pattern_2.Dashes,
    Shader={diffuse=RGB(217, 0, 0), emission=RGB(0, 0, 0), shine=0, specular=RGB(255, 255, 255), transparency=0},
    Thickness=0.3,
    Absolute=True)  # disabled
road_4 = CustomPreviewLineweights(
    Geometry=[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],
    Shader={diffuse=RGB(40, 93, 175), emission=RGB(0, 0, 0), shine=0, specular=RGB(255, 255, 255), transparency=0},
    Thickness=0.4,
    Absolute=True)  # disabled

point_2 = Point(entrance_4)
move = Move(Geometry=point_2, Motion=Vector(0, 0.9854719628, 0))  # -> Geometry, Transform
item_index = ItemIndex(List=point_2, Item=point_2)
text_tag_3d = TextTag3D(Location=move.Geometry, Text=item_index, Size=1.5, Colour=RGB(0, 0, 0), Justification=7)  # disabled
dot_display_2 = DotDisplay(Point=point_2, Colour=RGB(0, 0, 0), Size=0.5)  # disabled

roads = Roads(读取分区.Roads_Axis)
roads_2 = Roads(<roads referenced from the Rhino model>)
roads_3 = Roads(<roads referenced from the Rhino model>)
roads_4 = Roads([<roads referenced from the Rhino model> x2])
custom_preview_lineweights_4 = CustomPreviewLineweights(
    Geometry=[<curve referenced from the Rhino model> x6],
    Shader={diffuse=RGB(234, 234, 234), emission=RGB(0, 0, 0), shine=0, specular=RGB(255, 255, 255), transparency=0},
    Thickness=[1, 1, 1, 1, 1, 1.4],
    Absolute=True)  # disabled
merge = Merge(Data1=roads_2, Data2=roads, Data4=roads_4)  # -> flatten(Result)
boolean = Boolean([False, False, False, False, False, False, False])
road_widths = Road_widths([1.6, 1.3, 1.6, 1, 1])

# ----
# 2-1.Transform
number_slider = Slider(0.4, range=0..1)
site = Curve(<curve referenced from the Rhino model>)
minus_4 = Curve([<curve referenced from the Rhino model> x3])
rectangle_5 = Rectangle(rectangle)
list_length = ListLength(List=rectangle_5)
series = Series(Start=number_slider, Step=0, Count=list_length)  # -> simplify(Series)
number = Number(series)
multiagent = MultiAgent(
    Rects=rectangle_5,
    Site=site,
    Minus=minus_4,
    Roads=merge,
    Road_widths=road_widths,
    Cutters=boolean,
    Radius=number,
    Packing=Toggle(False),
    Resistance=Slider(1, range=0..1.1),
    Run=Toggle(True),
    Reset=Button(),
    Spacing=Slider(1, range=0..1))  # -> PointsTree, PointsList; disabled

fillet = Fillet(Curve=读取分区.Districts, Radius=number)  # -> graft(Curve)

linetype_table = LinetypeTable(Update=True)  # -> Linetypes, LinetypePattern
minus_5 = BoundarySurfaces(Edges=minus_3)
nature_3 = BoundarySurfaces()
buildings = BoundarySurfaces(Edges=blocks)
mainroad = CustomPreviewLineweights(
    Geometry=[<curve referenced from the Rhino model> x3],
    Shader={diffuse=RGB(207, 42, 37), emission=RGB(0, 0, 0), shine=0, specular=RGB(255, 255, 255), transparency=0},
    Thickness=0.8,
    Absolute=True)  # disabled
list_item_2 = ListItem(List=flatten(linetype_table.Linetypes), Index=1, Wrap=True)
multiplication_2 = Multiplication(A=list_item_2, B=Slider(0.88, range=0..2))
custom_preview = CustomPreview(
    Geometry=minus_5,
    Material={diffuse=RGB(225, 225, 225), emission=RGB(76, 76, 76), shine=0.5, specular=RGB(255, 255, 255), transparency=0})  # disabled
custom_preview_2 = CustomPreview(
    Geometry=buildings,
    Material={diffuse=RGB(225, 225, 225), emission=RGB(0, 0, 0), shine=0, specular=RGB(255, 255, 255), transparency=0})
custom_preview_3 = CustomPreview(
    Geometry=nature_3,
    Material={diffuse=RGB(192, 227, 255), emission=RGB(0, 0, 0), shine=0, specular=RGB(255, 255, 255), transparency=0})
dash_pattern_3 = DashPattern(Curve=site, Pattern=multiplication_2)  # -> Dashes, Gaps
custom_preview_lineweights_5 = CustomPreviewLineweights(
    Geometry=dash_pattern_3.Dashes,
    Shader={diffuse=RGB(0, 0, 0), emission=RGB(0, 0, 0), shine=0, specular=RGB(255, 255, 255), transparency=0},
    Thickness=0.5,
    Absolute=True)  # disabled

custom_preview_lineweights_6 = CustomPreviewLineweights(
    Geometry=merge,
    Shader={diffuse=RGB(234, 234, 234), emission=RGB(0, 0, 0), shine=0, specular=RGB(255, 255, 255), transparency=0},
    Thickness=expr("x*0.6", road_widths),
    Absolute=True)  # disabled
trigger_2 = Trigger(Interval=10, TimerInterval=10, Target=multiagent)  # disabled

curve_6 = Curve([<curve referenced from the Rhino model> x2])
subtraction = Subtraction(A=list_length, B=1)
dash_pattern_4 = DashPattern(Pattern=0.88)  # -> Dashes, Gaps
boundary_surfaces = BoundarySurfaces()
range = Range(Domain=Domain(0, 0.9), Steps=subtraction)
circle_2 = Circle(Plane=multiagent.PointsTree, Radius=graft(series))
road_5 = CustomPreviewLineweights(
    Geometry=dash_pattern_4.Dashes,
    Shader={diffuse=RGB(129, 129, 129), emission=RGB(0, 0, 0), shine=0, specular=RGB(255, 255, 255), transparency=0},
    Thickness=expr("0.35", road_widths),
    Absolute=True)
colour_hsl = ColourHSL(Alpha=1, Hue=range, Saturation=0.7, Luminance=0.8)  # -> simplify(graft(Colour))
custom_preview_4 = CustomPreview(
    Geometry=boundary_surfaces,
    Material={diffuse=RGB(199, 233, 189), emission=RGB(0, 0, 0), shine=0, specular=RGB(255, 255, 255), transparency=0})
custom_preview_lineweights_7 = CustomPreviewLineweights(
    Geometry=circle_2,
    Shader={diffuse=RGB(93, 154, 206), emission=RGB(0, 0, 0), shine=0, specular=RGB(255, 255, 255), transparency=0},
    Thickness=2,
    Absolute=False)
dot_display_3 = DotDisplay(Colour=colour_hsl, Size=expr("0*x", graft(series)))

circle_3 = Circle(Plane=multiagent.PointsTree, Radius=number_slider)

# ---- group: 提取轮廓线
number_2 = Number(simplify(graft(series)))
提取轮廓线 = CSharpScript(
    rect=graft(rectangle_5),
    grid=20,
    k=Slider(8, range=0..8),
    radius=number_2,
    tolerance=Slider(0.22, range=0..0.5),
    deleteMin=Slider(0.63, range=0.5..1),
    fillet=Toggle(True),
    scale=Toggle(False),
    Reference=["E:\ONEDRIVE - STU.XMU.EDU.CN\二次布局\ToPmesh\bin\Debug\net48\Plankton.dll", "E:\GRASSHOPPER_C#\Plankton-master\bin\Debug\Plankton.gha"])  # -> out, A, simplify(DistrictCur), simplify(Area); inputs rect: Rectangle3d, grid: Double, points: list of Point3d, k: Double, radius: Double, tolerance: Double, deleteMin: Double, fillet: Boolean, scale: Boolean; disabled
# ---------- 提取轮廓线: C# usings ----------
using Plankton;
using PlanktonGh;
using rd = Rhino.NodeInCode;
# ---------- 提取轮廓线: C# ----------
    //从点建立mesh
    var func = rd.Components.FindComponent("DelaunayMesh");
    var func1 = func.Delegate as dynamic;
    var initialMesh = func1(points, Plane.WorldXY);

    func = rd.Components.FindComponent("FaceBoundaries");
    func1 = func.Delegate as dynamic;
    var polylines = func1(initialMesh);
    //C = polylines;

    //建立Pmesh
    pmesh = new PlanktonMesh();
    pVertices = new List<PlanktonXYZ> ();
    List<List<int>> faces = new List<List<int>>();

    int index = 0;
    foreach (PolylineCurve plC in polylines)
    {
      Polyline pl;
      plC.TryGetPolyline(out pl);
      List<int> face = new List<int>();

      double length = pl.SegmentAt(0).Length;
      for(int i = 0;i < pl.GetSegments().Length;i++){
        if(pl.SegmentAt(i).Length > length)
          length = pl.SegmentAt(i).Length;
      }
      if(length > k * radius){
        continue;
      }
      index++;


      for(int j = 0;j < pl.Count - 1;j++)
      {
        var p = pl[j];
        PlanktonXYZ xYZ = new PlanktonXYZ((float) p.X, (float) p.Y, 0);
        if (!pVertices.Contains(xYZ))
        {
          pVertices.Add(xYZ);
        }
        face.Add(pVertices.IndexOf(xYZ));

      }
      faces.Add(face);
    }

    pmesh.Vertices.AddVertices(pVertices);
    pmesh.Faces.AddFaces(faces);

    //取出边缘
    var mesh = pmesh.ToRhinoMesh();
    A = mesh;

    var bound = new List<PolylineCurve>();
    var districtCurs = new List<PolyCurve>();
    foreach(Polyline p in mesh.GetNakedEdges()){
      p.MergeColinearSegments(tolerance, true);
      p.DeleteShortSegments(deleteMin);
      var boundry = p.ToPolylineCurve();
      boundry.ClosedCurveOrientation();
      bound.Add(boundry);
      var districtCur = new PolyCurve();
      if(fillet){
        districtCur = (PolyCurve) boundry.Offset(new Point3d(0, 0, 0),
          new Vector3d(0, 0, 1), radius, 0.1,
          CurveOffsetCornerStyle.Round)[0];
      }else{
        districtCur = (PolyCurve) boundry.Offset(new Point3d(0, 0, 0),
          new Vector3d(0, 0, 1), radius, 0.1, CurveOffsetCornerStyle.Sharp)[0];
      }
      districtCurs.Add(districtCur);
    }
    double area = 0;
    func = rd.Components.FindComponent("Area");
    func1 = func.Delegate as dynamic;
    var centers = new List<Point3d>();
    foreach(PolyCurve pc in districtCurs){

      //area+= (double)func1(pc)[0][0];
      area += (double) func1(pc)[0][0];
      centers.Add(func1(pc)[1][0]);
    }
    var areaOri = (double) func1(rect)[0][0];
    var sc = areaOri / area;
    if(scale){
      area = 0;
      for(int i = 0;i < centers.Count;i++){
        var trans = Transform.Scale(centers[i], sc);
        districtCurs[i].Transform(trans);
        area += (double) func1(districtCurs[i])[0][0];
      }
    }

    Area = Math.Round(area * grid * grid, 2);
    DistrictCur = districtCurs;
# ---------- 提取轮廓线: C# additional code ----------
  PlanktonMesh pmesh;
  List<PlanktonXYZ> pVertices;
# ---------- end 提取轮廓线 ----------

# ----
custom_preview_lineweights_8 = CustomPreviewLineweights(
    Shader={diffuse=RGB(0, 0, 0), emission=RGB(0, 0, 0), shine=0, specular=RGB(255, 255, 255), transparency=0},
    Thickness=0.1,
    Absolute=True)
smooth_curve = SmoothCurve(Steps=Slider(1, range=0..10), StartType=0, EndType=0, DeviationTolerance=1, AngleTolerance=0.05)
panel_3 = Panel(提取轮廓线.A)

# ---- group: districtLine
linetype_table_2 = LinetypeTable(Update=True)  # -> Linetypes, LinetypePattern
list_item_3 = ListItem(List=flatten(linetype_table_2.Linetypes), Index=1, Wrap=True)
multiplication_3 = Multiplication(A=list_item_3, B=Slider(0.261, range=0..2))

# ---- group: infoList
coldist1 = Slider(-1.7, range=-20..0)
size = Slider(0.69, range=0..2)
coldist2 = Slider(-1.5, range=-20..0)
row_spacing = Slider(6.61, range=0..10)
point_3 = Point(simplify(graft([Point(31.77516518, -19.79454801, 0), Point(31.77516518, -26.8676102, 0), Point(31.77516518, -33.77489749, 0)])))
panel_4 = Panel("Site Area")
panel_5 = Panel("Gross Area")
merge_2 = Merge(Data2=读取分区.BuildingArea)

# ----
unit_y_2 = UnitY(Factor=coldist1)
unit_y_3 = UnitY(Factor=coldist2)
c_script_3 = CSharpScript(x="GA:", y=merge_2)  # -> out, A; inputs x: String, y: String
# ---------- c_script_3: C# ----------
    string a = x + y + "㎡";
    A = a;
# ---------- end c_script_3 ----------

# ---- group: districtColor
integer = Integer(读取分区.Color)
list_item_4 = ListItem(List=integer, Index=-1, Wrap=True)
remap_numbers = RemapNumbers(Value=integer, Source=list_item_4, Target=Domain(0, 0.9))  # -> Mapped, Clipped
colour_hsl_2 = ColourHSL(Alpha=1, Hue=remap_numbers.Mapped, Saturation=0.5, Luminance=0.9)

# ----
colour_hsl_3 = ColourHSL(Alpha=1, Hue=remap_numbers.Mapped, Saturation=0.7, Luminance=0.35)
colour_hsl_4 = ColourHSL(Alpha=1, Hue=remap_numbers.Mapped, Saturation=0.6, Luminance=0.85)

# ----
# 3.Display Districts
分区结果 = Curve(simplify(curve_2))

# ---- group: districtName
area_3 = Area(Geometry=分区结果)  # -> Area, Centroid
text_tag_3d_2 = TextTag3D(Location=area_3.Centroid, Text=text, Size=Slider(0.6, range=0..1), Colour=RGB(0, 0, 0), Justification=5)  # disabled

# ---- group: districtColor (continued)
boundary_surfaces_2 = BoundarySurfaces(Edges=分区结果)
custom_preview_5 = CustomPreview(Geometry=boundary_surfaces_2, Material=graft(colour_hsl_2))  # disabled

# ---- group: districtLine (continued)
dash_pattern_5 = DashPattern(Curve=分区结果, Pattern=multiplication_3)  # -> Dashes, Gaps
custom_preview_lineweights_9 = CustomPreviewLineweights(
    Geometry=dash_pattern_5.Dashes,
    Shader={diffuse=RGB(0, 0, 0), emission=RGB(0, 0, 0), shine=0.5, specular=RGB(255, 255, 255), transparency=0},
    Thickness=0.3,
    Absolute=True)  # disabled

# ----
blue = Index(graft([7, 9, 4]))  # disabled
yellow = Index(graft([10, 11, 13]))  # disabled
purple = Index(graft([0, 1, 2, 8]))  # disabled
orange = Index(graft([7, 9, 4, 6, 8]))  # disabled
lightblue = Index(graft(3))  # disabled
green = Index(graft([10, 11, 13, 12, 14]))  # disabled
highlight = HighLight(relay=分区结果, integer=读取分区.Color, second_number=yellow)  # disabled
highlight_2 = HighLight(relay=分区结果, integer=读取分区.Color, second_number=green)  # disabled
highlight_3 = HighLight(relay=分区结果, integer=读取分区.Color, second_number=purple)  # disabled
highlight_4 = HighLight(relay=分区结果, integer=读取分区.Color, second_number=blue)  # disabled
highlight_5 = HighLight(relay=分区结果, integer=读取分区.Color, second_number=lightblue)  # disabled
highlight_6 = HighLight(relay=分区结果, integer=读取分区.Color, second_number=orange)  # disabled
custom_preview_6 = CustomPreview(
    Geometry=flatten(highlight_4),
    Material={diffuse=RGB(147, 203, 228), emission=RGB(0, 0, 0), shine=0, specular=RGB(255, 255, 255), transparency=0})  # disabled
custom_preview_7 = CustomPreview(
    Geometry=flatten(highlight_2),
    Material={diffuse=RGB(147, 222, 145), emission=RGB(0, 0, 0), shine=0, specular=RGB(255, 255, 255), transparency=0})  # disabled
custom_preview_8 = CustomPreview(
    Geometry=flatten(highlight_5),
    Material={diffuse=RGB(178, 213, 228), emission=RGB(0, 0, 0), shine=0, specular=RGB(255, 255, 255), transparency=0})  # disabled
custom_preview_9 = CustomPreview(
    Geometry=flatten(highlight_6),
    Material={diffuse=RGB(244, 188, 159), emission=RGB(0, 0, 0), shine=0, specular=RGB(255, 255, 255), transparency=0})  # disabled
custom_preview_10 = CustomPreview(
    Geometry=flatten(highlight),
    Material={diffuse=RGB(236, 182, 47), emission=RGB(0, 0, 0), shine=0, specular=RGB(255, 255, 255), transparency=0})  # disabled
custom_preview_11 = CustomPreview(
    Geometry=flatten(highlight_3),
    Material={diffuse=RGB(204, 200, 250), emission=RGB(0, 0, 0), shine=0, specular=RGB(255, 255, 255), transparency=0})  # disabled

# ---- group: infoList (continued)
area_4 = Area(Geometry=分区结果)  # -> Area, Centroid
c_script_4 = CSharpScript(index=integer)  # -> out, Indexes; inputs index: list of Int32
# ---------- c_script_4: C# ----------
    List<String> output = new List<String>();
    int index2 = 0;
    int last = index[0];
    output.Add(index[0].ToString());
    for(int i = 1;i < index.Count;i++){
      if(index[i] == last){
        index2++;
        output.Add(index[i] + "-" + index2);
      }
      else{
        index2 = 0;
        last = index[i];
        output.Add(index[i].ToString());
      }
    }
    Indexes = output;
# ---------- end c_script_4 ----------
multiplication_4 = Multiplication(A=area_4.Area, B=400)
merge_3 = Merge(Data1=simplify(graft(c_script_4.Indexes)), Data2=simplify(graft(text)))
text_join = TextJoin(Text=merge_3)  # -> flatten(Result)
integer_2 = Integer(simplify(flatten(multiplication_4)))
merge_4 = Merge(Data2=flatten(text_join))
merge_5 = Merge(Data2=integer_2)

# ----
c_script_5 = CSharpScript(x="SA:", y=merge_5)  # -> out, A; inputs x: String, y: String; same code as c_script_3
partition_list = PartitionList(List=merge_4, Size=9)  # -> simplify(Chunks)
list_length_2 = ListLength(List=partition_list)
partition_list_2 = PartitionList(List=merge_5, Size=9)  # -> simplify(Chunks)
panel_6 = Panel(c_script_5.A)
text_join_2 = TextJoin(Text=merge_3)  # -> flatten(Result)
panel_7 = Panel(merge_5)

# ---- group: infoList (continued)
series_2 = Series(Start=0, Step=row_spacing, Count=expr("x", list_length_2))

# ----
unit_x = UnitX(Factor=series_2)
panel_8 = Panel(unit_x)

# ---- group: infoList (continued)
move_2 = Move(Geometry=point_3, Motion=unit_x)  # -> Geometry, Transform
move_3 = Move(Geometry=move_2.Geometry, Motion=unit_y_2)  # -> simplify(Geometry), Transform
move_4 = Move(Geometry=move_3.Geometry, Motion=unit_y_3)  # -> simplify(flatten(Geometry)), Transform
text_tag_3d_3 = TextTag3D(Location=move_3.Geometry, Text=partition_list_2, Size=size, Colour=RGB(0, 0, 0), Justification=8)
text_tag_3d_4 = TextTag3D(Location=move_2.Geometry, Text=partition_list, Size=size, Colour=RGB(0, 0, 0), Justification=8)
text_tag_3d_5 = TextTag3D(Location=move_4.Geometry, Text=merge_2, Size=size, Colour=RGB(0, 0, 0), Justification=8)

# ---- group: building
显示体量 = CSharpScript(districtCur=graft(分区结果), height=6, layers=读取分区.Layers, floorAreas=读取分区.FloorAreas, grid=20)  # -> Center, Layer, simplify(A), B; inputs districtCur: Curve, height: Double, layers: list of Int32, floorAreas: list of Double, grid: Double
# ---------- 显示体量: C# usings ----------
using rd = Rhino.NodeInCode;
[ObsoleteAttribute("Use version that takes tolerance as input")]
# ---------- 显示体量: C# ----------
    var func = rd.Components.FindComponent("Area");
    var func1 = func.Delegate as dynamic;

    var area = func1(districtCur)[0][0];
    var center = func1(districtCur)[1][0];

    double floorAll = 0;
    double l = 0;
    for(int i = 0; i < floorAreas.Count;i++){
      floorAll += floorAreas[i];

    }
    if(floorAll > 0){
      for(int i = 0; i < floorAreas.Count;i++){
        l += layers[i] * floorAreas[i] / floorAll;
      }
    }

    int layer = (int) l;
    Layer = layer;

    if(floorAll > 0){
      double k = Math.Sqrt(floorAll / grid / grid / area);
      var a = Transform.Scale(center, k);
      districtCur.Transform(a);


      func = rd.Components.FindComponent("Extrude");
      func1 = func.Delegate as dynamic;
      var breps = func1(districtCur, new Vector3d(0, 0, l * height / grid));


      if(breps != null){

        func = rd.Components.FindComponent("CapHoles");
        func1 = func.Delegate as dynamic;
        var building = func1(breps[0]);
        B = building;
      }
      A = districtCur;
      func = rd.Components.FindComponent("LinearArray");
      func1 = func.Delegate as dynamic;
      var vec = new Vector3d(0, 0, height / grid);
      var curs = func1(districtCur, vec, layer + 1)[0];
      A = curs;

    }
    Center = center;
# ---------- end 显示体量 ----------
custom_preview_lineweights_10 = CustomPreviewLineweights(Geometry=simplify(显示体量.A), Shader=graft(colour_hsl_3), Thickness=0.1, Absolute=True)

# ----
unit_z = UnitZ(Factor=expr("6*x/20+0.2", 显示体量.Layer))
move_5 = Move(Geometry=area_3.Centroid, Motion=unit_z)  # -> Geometry, Transform
text_tag_3d_6 = TextTag3D(Location=move_5.Geometry, Text=graft(c_script_5.A), Size=0.75, Colour=RGB(0, 0, 0), Justification=2)

move_6 = Move(Geometry=move_5.Geometry, Motion=expr("0.9*x", unit_y))  # -> Geometry, Transform
text_2 = Text(simplify(显示体量.Layer))
move_7 = Move(Geometry=move_5.Geometry, Motion=expr("-0.5*x", unit_y))  # -> Geometry, Transform
move_8 = Move(Geometry=move_6.Geometry, Motion=expr("0*x", unit_y))  # -> Geometry, Transform
c_script_6 = CSharpScript(x=text_2)  # -> out, A; inputs x: String
# ---------- c_script_6: C# ----------
    string a = x + "F";
    A = a;
# ---------- end c_script_6 ----------
text_tag_3d_7 = TextTag3D(Location=move_5.Geometry, Text=graft(c_script_4.Indexes), Size=2, Colour=RGB(0, 0, 0), Justification=5)
text_tag_3d_8 = TextTag3D(Location=move_6.Geometry, Text=c_script_6.A, Size=1.5, Colour=RGB(0, 0, 0), Justification=2)  # disabled
list_item_5 = ListItem(List=显示体量.A, Index=0, Wrap=True)
boundary_surfaces_3 = BoundarySurfaces(Edges=list_item_5)

# ---- group: building (continued)
custom_preview_12 = CustomPreview(Geometry=flatten(boundary_surfaces_3), Material=colour_hsl_4)

# ----
text_tag_3d_9 = TextTag3D(Location=move_6.Geometry, Text=graft(c_script_3.A), Size=0.75, Colour=RGB(0, 0, 0), Justification=2)

# ==== cluster HighLight
integer = ClusterInput()
relay = ClusterInput()
integer_2 = Integer(integer)
second_number = ClusterInput()
equality = Equality(FirstNumber=integer_2, SecondNumber=second_number)  # -> Equality, Inequality
item_index = ItemIndex(List=integer_2, Item=integer_2)
dispatch = Dispatch(List=item_index, DispatchPattern=equality.Equality)  # -> ListA, ListB
list_item = ListItem(List=flatten(relay), Index=flatten(dispatch.ListA), Wrap=True)
boundary_surfaces = BoundarySurfaces(Edges=list_item)
surfaces = ClusterOutput(boundary_surfaces)
