# Grasshopper definition 写入分区.gh (Grasshopper 1.0.7)
# plug-ins: Human, MultiAgent

# ---- group: 旋转场地
# 一些没有加入程序的utils
九龙湖 = Curve(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)
九龙湖road = Curve([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])
九龙湖rect = Rectangle(九龙湖)
c_script = CSharpScript(boundry=九龙湖, rectRef=九龙湖rect)  # -> out, A, B; inputs boundry: Polyline, rectRef: Rectangle3d
# ---------- c_script: C# ----------
    Vector3d ax = rectRef.Corner(1) - rectRef.Corner(0);
    Point3d p = rectRef.Corner(0);
    B = p;
    var var1 = Vector3d.Multiply(ax, new Vector3d(0, 1, 0)) / ax.Length;
    //var t = Math.PI * Math.Sqrt(2) / 2;
    double angle;
    angle = Math.Acos(Math.Abs(var1));
    if(angle > Math.PI / 2){
      angle = Math.PI - angle;
    }
    if(angle > Math.PI / 4){
      angle = angle - Math.PI / 2;
    }
    A = angle;
# ---------- end c_script ----------
rotate = Rotate(Geometry=九龙湖road, Angle=c_script.A, Plane=PlaneXY(0, 0, 0))  # -> Geometry, Transform
rotate_2 = Rotate(Geometry=九龙湖, Angle=c_script.A, Plane=c_script.B)  # -> Geometry, Transform

# ----
# 在程序中运行获得location.csv
# 2.Get Layout 读取生成布局中的分区位置信息
resultpath = FilePath("E:\grasshopper_C#\Campus\ghConponent\location.csv")
读取分区 = CSharpScript(file=resultpath, grid=20, result=Slider(1, range=1..5))  # -> out, ZoneNames, Zones, Color, Core_Groups, Roads_Axis, Widths, flatten(BuildingArea), Layers, FloorAreas; inputs file: String, grid: Double, result: Int32
# ---------- 读取分区: C# usings ----------
using System.IO;
# ---------- 读取分区: C# ----------
    floorArea = new DataTree<double>();
    layer = new DataTree<int>();
    nameList = new List<string>();
    infoList = new List<double>();
    buildings = new DataTree<Box>();
    groups = new List<Rectangle3d>();

    var fs = new FileStream(file, FileMode.Open, FileAccess.Read);
    var sr = new StreamReader(fs);
    string strLine = " ";
    var resultList = new List<string>();


    //读取分区
    sr.ReadLine();
    while ((strLine = sr.ReadLine()) != null){
      if(strLine.Contains("Rectangle")){
        break;
      }
      Print(strLine.ToString());
      string[] str = strLine.Split(',');
      nameList.Add(str[0]);
      resultList.Add(str[result]);
    }
    var zones = ExportZone(resultList, grid);


    //读取矩形结构
    while ((strLine = sr.ReadLine()) != null && strLine.Contains("Rectangle")){
      Print(strLine.ToString());
      string[] str = strLine.Split(',');
      var strArray = str[result].Split(new char[3] { '(',';', ')' });
      groups.Add(ReadRectangle(strArray));
      Print("GroupTrue");
    }

    List<double> widthList = new List<double>();
    List<Line> lines = new List<Line>();
    while ((strLine = sr.ReadLine()) != null){
      if(strLine == "Roads"){
        strLine = sr.ReadLine();
      }
      if(strLine == "Axis"){
        break;
      }
      Print(strLine.ToString());
      string[] str = strLine.Split(',');
      widthList.Add(double.Parse(str[0]));
      var strArray = str[result].Split(new char[3] { '(',';', ')' });
      //lines.Add(ReadLine(strArray));
      double x1 = double.Parse(strArray[1]);
      double y1 = double.Parse(strArray[2]);
      double x2 = double.Parse(strArray[3]);
      double y2 = double.Parse(strArray[4]);
      var line = new Line(x1, y1, 0, x2, y2, 0);
      lines.Add(line);

    }

    //color Num
    List<int> color = new List<int>();
    int temp = 0;
    color.Add(temp);
    for(int i = 1;i < nameList.Count;i++){
      if(nameList[i] != nameList[i - 1]){
        temp++;
      }
      color.Add(temp);
    }
    Color = color;



    Zones = zones;
    ZoneNames = nameList;
    Layers = layer;
    FloorAreas = floorArea;
    BuildingArea = infoList;
    //Buildings = buildings;
    Core_Groups = groups;
    Roads_Axis = lines;
    Widths = widthList;
# ---------- 读取分区: C# additional code ----------
  DataTree<double> floorArea;
  DataTree<int> layer;
  List<string> nameList;
  List<double> infoList;
  DataTree<Box> buildings;
  List<Rectangle3d> groups;

  public List<Rectangle3d> ExportZone(List<string> resultList, double grid){
    var zones = new List<Rectangle3d>();
    int index = 0;
    foreach(string str in resultList){


      string[] strArray = str.Split(new char[3] { '(',';', ')' });
      var rect = ReadRectangle(strArray);
      zones.Add(rect);

      try{
        double buildingArea = double.Parse(strArray[7]);
        string area = strArray[6];
        infoList.Add(Math.Round(buildingArea, 0));
      }catch{
        infoList.Add(-1);
      }

      //建筑信息和绘制建筑
      var path = new GH_Path(index);

      if((strArray.Length - 8) > 0){
        int i = 8;
        double height = 4 / grid;
        double deta = 0.4;

        //double y1 = y + deta;
        while(i + 1 < strArray.Length){
          int floor = int.Parse(strArray[i + 1]);
          //double z = 0;
          var f_area = double.Parse(strArray[i]);
          var h1 = f_area / (rect.Width - deta * 2) / grid / grid;

          //for(int f = 0;f < floor;f++){
          //var xRange = new Interval(x + deta, x + w - deta);
          //var yRange = new Interval(y1, y1 + h1);
          //var zRange = new Interval(z, z + height);
          //buildings.Add(new Box(Plane.WorldXY, xRange, yRange, zRange), path);
          //z += height;
          //}
          floorArea.Add(f_area, path);
          layer.Add(floor, path);
          i += 2;
          //y1 += h1 / 2;
        }

      }else{
        layer.Add(0, path);
        floorArea.Add(0, path);
      }
      index++;
    }
    return zones;
  }

  public Rectangle3d ReadRectangle(string[] strArray){

    double x = double.Parse(strArray[1]);
    double y = double.Parse(strArray[2]);
    double w = double.Parse(strArray[3]) - double.Parse(strArray[1]);
    double h = double.Parse(strArray[4]) - double.Parse(strArray[2]);
    Point3d p3d = new Point3d(x, y, 0);
    Plane p = new Plane(p3d, new Vector3d(0, 0, 1));

    return new Rectangle3d(p, w, h);
  }
# ---------- end 读取分区 ----------

# ---- group: 道路和道路的宽度
roadwidth = Number([3, 1, 2, 3.4, 1.2, 1.2, 3, 1.5, 1, 1, 1, 1.6])
road = Line([Line((7.910855233, 17.69792946, 0), (68.84435233, 17.7359531, 0)), Line((19.2061217, 26.25413095, 0), (69.11395639, 26.25413095, 0)), Line((20.53531125, 58.77937601, 0), (71.08892172, 58.77937601, 0)), Line((24.256305, 76.5276315, 0), (68.82125203, 76.52018483, 0)), Line((36.48322593, 94.67944025, 0), (42.13225312, 88.27128398, 0)), Line((42.13225312, 88.27128398, 0), (70.48377705, 88.27128398, 0))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])

# ---- group: 场地轮廓
# rhino图形比例1：20，读取和显示的时候都按比例缩放。
# 1.Set  SITE 读取图形并导出到场地csv
boundary = Curve(<curve referenced from the Rhino model>)

# ---- group: 识别凹多边形被减去的矩形，不一定适用
识别minus = CSharpScript(boundry=boundary)  # -> out, A, B; inputs boundry: Polyline
# ---------- 识别minus: C# usings ----------
using rd = Rhino.NodeInCode;
using Rhino.Geometry.Intersect;
# ---------- 识别minus: C# ----------
    //Flip
    double area = 0;
    for(int i = 0;i < boundry.Count - 1;i++){
      area += boundry[i].X * boundry[i + 1].Y - boundry[i].Y * boundry[i + 1].X;
    }
    if(area < 0){
      Print("Flip");
      var Func = rd.Components.FindComponent("FlipCurve");
      var Func1 = Func.Delegate as dynamic;
      var dry = Func1(boundry, null)[0][0];
      var boundry1 = new Polyline();
      dry.TryGetPolyline(out boundry);

    }
    //oob
    var oob = boundry.BoundingBox;
    var frame = new Rectangle3d(Plane.WorldXY, oob.Corner(false, false, false), oob.Corner(true, true, false));
    A = frame;


    //connexHull
    var pts = new List<Point3d >();
    foreach(Point3d p in boundry){
      pts.Add(p);
    }
    var com = rd.Components.FindComponent("ConvexHull");
    var com1 = com.Delegate as dynamic;
    var convexHull = com1(pts, Plane.WorldXY)[0][0];
    var conH = convexHull.ToPolyline();
    pts.Clear();

    if(conH.Count == boundry.Count){
      Print("凸多边形");
    }else{
      Print("凹多边形");
      GetMinus(boundry, conH, frame);
    }
    B = minus;
# ---------- 识别minus: C# additional code ----------
  List<Rectangle3d> minus = new List<Rectangle3d>();

  void GetMinus(Polyline boundry, Polyline conH, Rectangle3d frame){
    var inside = new List<int>();

    for(int i = 0;i < boundry.Count - 1;i++){
      if(!conH.Contains(boundry[i])){
        inside.Add(i);
      }
    }
    foreach(int i in inside){
      var p1 = boundry[(i - 1 + boundry.Count - 1) % (boundry.Count - 1)];
      var p2 = boundry[(i + 1) % (boundry.Count - 1)];
      Point3d corner = new Point3d();
      for(int j = 0;j < 4;j++){
        corner = frame.Corner(j);
        var line = new Line(corner, boundry[i]);
        var Func = rd.Components.FindComponent("Curve|Line");
        var Func1 = Func.Delegate as dynamic;
        var pt = Func1(boundry.ToPolylineCurve(), line);
        if(pt == null)
          break;
      }


      minus.Add(new Rectangle3d(Plane.WorldXY, boundry[i], corner));

    }
  }
# ---------- end 识别minus ----------

# ---- group: 凹多边形场地被减去的矩形
minus = Rectangle([{Plane=PlaneXY(33.35595017, 68.08720623, 0), Size=Domain2(u=-8.950059937..8.950059937, v=-10.18985263..10.18985263)}, {Plane=PlaneXY(51.14725068, 73.91234073, 0), Size=Domain2(u=-8.837659754..8.837659754, v=-0.8852812543..0.8852812543)}, {Plane=PlaneXY(42.68669827, 24.62233993, 0), Size=Domain2(u=-17.72048125..17.72048125, v=-0.8..0.8)}, {Plane=PlaneXY(41.79168699, 21.70846113, 0), Size=Domain2(u=-0.5671156292..0.5671156292, v=-2.1138788..2.1138788)}, {Plane=PlaneXY(25.10283481, 82.32118163, 0), Size=Domain2(u=-0.7036756231..0.7036756231, v=-4.014447496..4.014447496)}, {Plane=PlaneXY(50.80896994, 90.65006711, 0), Size=Domain2(u=-9.627239879..9.627239879, v=-2.806779349..2.806779349)}])

# ---- group: 场地内的绿地、水面等无法布局的部分
nature = Curve([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])

# ---- group: 场地入口
entrance = Point([Point(41.87951565, 16.1645559, 0), Point(63.77110892, 43.94988921, 0), Point(40.28536735, 69.51255873, 0), Point(22.43847339, 37.15350744, 0)])

# ---- group: 场地周边的街区，目前未加入计算
blocks = Rectangle([{Plane=PlaneXY(15.58970559, 30.9769837, 0), Size=Domain2(u=-5.479972039..5.479972039, v=-4.340960741..4.340960741)}, {Plane=PlaneXY(15.46635498, 39.90547132, 0), Size=Domain2(u=-5.394061434..5.394061434, v=-3.198339497..3.198339497)}, {Plane=PlaneXY(15.38733143, 47.61187569, 0), Size=Domain2(u=-5.339697223..5.339697223, v=-3.706122686..3.706122686)}, {Plane=PlaneXY(15.29205429, 55.18427014, 0), Size=Domain2(u=-5.316620399..5.316620399, v=-3.022311181..3.022311181)}, {Plane=PlaneXY(33.23247366, 12.20766194, 0), Size=Domain2(u=-8.127899482..8.127899482, v=-3.608214316..3.608214316)}, {Plane=PlaneXY(51.37550851, 12.29986195, 0), Size=Domain2(u=-8.977591379..8.977591379, v=-3.564137401..3.564137401)}, {Plane=PlaneXY(66.45157074, 42.42348897, 0), Size=Domain2(u=-2.686097205..2.686097205, v=-15.52104415..15.52104415)}, {Plane=PlaneXY(66.26161725, 66.23487781, 0), Size=Domain2(u=-2.739728261..2.739728261, v=-6.745543067..6.745543067)}])

# ---- group: 文件输出位置
file_path = FilePath("E:\grasshopper_C#\Campus\ghConponent\site.csv")

# ----
分区结果 = Curve(simplify(Tree({0}: [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], {1}: [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], {2}: [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], {3}: [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], {4}: [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], {5}: [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]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)))

# ---- group: 显示布局结构（如果有）
# 3.Display Layout 显示“形”
rectangle = Rectangle(读取分区.Core_Groups)
custom_preview_lineweights = CustomPreviewLineweights(
    Geometry=rectangle,
    Shader={diffuse=RGB(128, 128, 128), emission=RGB(0, 0, 0), shine=0, specular=RGB(255, 255, 255), transparency=0},
    Thickness=0.4,
    Absolute=True)
custom_preview_lineweights_2 = CustomPreviewLineweights(
    Geometry=读取分区.Roads_Axis,
    Shader={diffuse=RGB(128, 128, 128), emission=RGB(0, 0, 0), shine=0, specular=RGB(255, 255, 255), transparency=0},
    Thickness=expr("0.8*x", 读取分区.Widths),
    Absolute=True)

# ----
分区结果_2 = Curve(simplify(分区结果))
index = Integer(读取分区.Color)
list_item = ListItem(List=index, Index=-1, Wrap=True)
实际中心点和面积 = CSharpScript(districtCurs=分区结果_2)  # -> out, Area, Centers; inputs districtCurs: list of Curve
# ---------- 实际中心点和面积: C# usings ----------
using rd = Rhino.NodeInCode;
# ---------- 实际中心点和面积: C# ----------
    double area = 0;
    var func = rd.Components.FindComponent("Area");
    var func1 = func.Delegate as dynamic;
    var centers = new List<Point3d>();
    foreach(PolyCurve pc in districtCurs){

      //area+= (double)func1(pc)[0][0];
      area += (double) func1(pc)[0][0];
      centers.Add(func1(pc)[1][0]);
    }
    Area = area;
    Centers = centers;
# ---------- end 实际中心点和面积 ----------
remap_numbers = RemapNumbers(Value=index, Source=list_item, Target=Domain(0, 0.8))  # -> Mapped, Clipped
生成序号 = CSharpScript(index=index)  # -> out, Indexes; inputs index: list of Int32
# ---------- 生成序号: C# ----------
    List<String> output = new List<String>();
    int index2 = 0;
    int last = index[0];
    output.Add(index[0].ToString());
    for(int i = 1;i < index.Count;i++){
      if(index[i] == last){
        index2++;
        output.Add(index[i] + "-" + index2);
      }
      else{
        index2 = 0;
        last = index[i];
        output.Add(index[i].ToString());
      }
    }
    Indexes = output;
# ---------- end 生成序号 ----------

trigger = Trigger(Interval=-1000, TimerInterval=1000, Target=site2csv)  # disabled
site2csv = CSharpScript(boundry=boundary, minus=minus, blocks=blocks, road=road, roadWidth=roadwidth, entrance=entrance, fileName=file_path)  # -> out, Point, Minus, Frame; inputs boundry: Polyline, minus: list of Rectangle3d, blocks: list of Rectangle3d, edge: list of Curve, road: list of Line, roadWidth: list of Double, entrance: list of Point3d, fileName: String
# ---------- site2csv: C# ----------
    var oob = boundry.BoundingBox;
    frame = new Rectangle3d(Plane.WorldXY, oob.Corner(false, false, false), oob.Corner(true, true, false));
    Frame = frame;
    int digit = 2;//保留位数
    ToMinus(minus, blocks);
    Minus = minus;

    if (fileName != null)
    {
      FileStream fs = new FileStream(fileName, FileMode.Create, FileAccess.Write);
      StreamWriter sw = new StreamWriter(fs, System.Text.Encoding.UTF8);

      var strLine = string.Empty;
      var index = 0;

      //写入Boundry
      sw.WriteLine("Boundry");
      foreach(Point3d p in boundry){
        strLine += "(" + Math.Round(p.X, digit) + ";" +
          Math.Round(p.Y, digit) + "),";
      }
      sw.WriteLine(strLine);

      //写入Frame
      sw.WriteLine("Frame");
      sw.WriteLine("(" + Math.Round(frame.Corner(0).X, digit) + ";" +
        Math.Round(frame.Corner(0).Y, digit) + ";" +
        Math.Round(frame.Corner(2).X, digit) + ";" +
        Math.Round(frame.Corner(2).Y, digit) + ")");

      //写入Minus
      WriteRects("Minus", sw, minus, digit);
      //写入block
      if(blocks != null)
        WriteRects("Block", sw, blocks, digit);


      //写入entrance
      WritePoints("Entrance", sw, entrance, digit);

      //写入outsidePoints
      if(edge != null){
        List<Point3d> inside = new List<Point3d>();

        var origin = new Point3d((int) (frame.Corner(0).X ), (int) (frame.Corner(0).Y), 0);

        for(int i = 0;i <= (int) frame.Width;i++){
          for(int j = 0;j <= (int) frame.Height;j++)
          {
            foreach(Curve e in edge){
              var p = origin + new Vector3d(i, j, 0);
              var isInside = e.Contains(p, Plane.WorldXY, 0.01) == PointContainment.Inside;
              //Print(isInside.ToString());
              if(isInside){
                inside.Add(p);

              }
            }
          }
        }
        Minus = inside;
        WritePoints("OutsidePoints", sw, inside, digit);
      }

      //写入Road
      sw.WriteLine("Road");
      strLine = "";
      index = 0;

      var tempPoiList = new List<Point3d>();//
      foreach(Line l in road){

        strLine += "(" + Math.Round(l.FromX, digit) + ";"
          + Math.Round(l.FromY, digit)
          + ";" + Math.Round(l.ToX, digit) + ";" +
          Math.Round(l.ToY, digit) + ")" + roadWidth[index] + ";";

        ///直线与场地是否相交
        var bo = Rhino.Geometry.Intersect.Intersection.
          CurveLine(boundry.ToPolylineCurve(), l, 0, 0);
        var bo1 = Rhino.Geometry.Intersect.Intersection.
          CurveLine(frame.ToNurbsCurve(), l, 0, 0);

        //线段是否相交
        bool inter = false;
        int n = 5;
        var dx = (l.ToX - l.FromX) / n;
        var dy = (l.ToY - l.FromY) / n;
        for(int i = 0;i < n;i++){
          var p = new Point3d(l.FromX + i * dx, l.FromY + i * dy, l.FromZ);
          tempPoiList.Add(p);
          if(boundry.ToPolylineCurve().Contains(p) == PointContainment.Inside){
            inter = true;
            break;
          }
        }

        string strTemp = "";
        //完全不相交
        if(bo1.Count < 2){
          strTemp = "0";
        }
          //道路存在部分在边界内，需避开=2
        else if(bo.Count == 2 && inter ){

          Print("道路" + index + "与场地相交");
          strTemp = "2";
          strTemp += "(" + Math.Round(bo[0].PointA.X, digit)
            + ";" + Math.Round(bo[0].PointA.Y, digit)
            + ";" + Math.Round(bo[0].PointA.X, digit)
            + ";" + Math.Round(bo[0].PointA.Y, digit) + ")";
        }
        else{
          //道路切割一部分=+1/-1
          var x1 = l.FromX;
          var x2 = l.ToX;
          var y1 = l.FromY;
          var y2 = l.ToY;
          double a,b,c;
          if(x1 != x2){
            a = (y2 - y1) / (x2 - x1);
            b = -1;
          }else{
            b = 0;
            a = -1;
          }
          c = -b * y1 - a * x1;

          //直线相交但线段不相交的情况,做切割线
          //找最近点
          Point3d testPoi = boundry.CenterPoint();
          if(bo.Count == 2){
            var mid = new Point3d((l.FromX + l.ToX) / 2, (l.FromY + l.ToY) / 2, l.ToZ);
            testPoi = boundry.ClosestPoint(mid);
          }
          //判断在上or下
          if(a * testPoi.X + b * testPoi.Y + c < 0){
            strTemp = "-1";//线在点上方，去除下方
            Print("道路" + index + "=-1，切割下方");
          }
          if(a * testPoi.X + b * testPoi.Y + c > 0){
            strTemp = "1";//线在点下方，去除上方
            Print("道路" + index + "=1，切割上方");
          }
        }

        strLine += strTemp + ",";
        index++;
      }
      sw.WriteLine(strLine);

      sw.Close();
      fs.Close();
      //A = tempPoiList;
    }
# ---------- site2csv: C# additional code ----------
  Rectangle3d frame;

  public void WritePoints(string name, StreamWriter sw, List<Point3d > points, int digit){
    sw.WriteLine(name);
    var strLine = "";
    foreach(Point3d p in points){
      strLine += "(" + Math.Round(p.X, digit) + ";"
        + Math.Round(p.Y, digit) + "),";
    }
    sw.WriteLine(strLine);
  }

  public void WriteLines(string name, StreamWriter sw, List<Line > lines, int digit){

  }
  public void WriteRects(string name, StreamWriter sw, List<Rectangle3d > rects, int digit){
    sw.WriteLine(name);
    var strLine = "";
    foreach(Rectangle3d r in rects){
      double x1 = Math.Round(r.Corner(0).X, digit);
      double y1 = Math.Round(r.Corner(0).Y, digit);
      double x2 = Math.Round(r.Corner(2).X, digit);
      double y2 = Math.Round(r.Corner(2).Y, digit);
      double temp;
      if(x1 > x2){
        temp = x1;
        x1 = x2;
        x2 = temp;
      }
      if(y1 > y2){
        temp = y1;
        y1 = y2;
        y2 = temp;
      }
      strLine += "(" + x1 + ";" + y1 + ";" + x2 + ";" + y2 + "),";
    }
    sw.WriteLine(strLine);
  }

  //与场地相交的block列入minus
  private void ToMinus(List < Rectangle3d > minus, List<Rectangle3d> blocks){

    List<Point3d> points;
    foreach(Rectangle3d rect in blocks){
      var region = Curve.CreateBooleanIntersection
        (rect.ToNurbsCurve(), frame.ToNurbsCurve(), 0.1);

      if(region.Length > 0){
        var a = region[0].ToPolyline(0.1, 0.1, 0.1, 100);
        points = new List<Point3d>();
        for(int i = 0;i < a.PointCount;i++){
          points.Add(a.Point(i));
        }
        var r = Rectangle3d.CreateFromPolyline(points);
        minus.Add(r);
      }
    }
  }
# ---------- end site2csv ----------
自动判断道路与场地的关系 = Panel(site2csv.out)
point = Point(site2csv.Point)
rectangle_2 = Rectangle(site2csv.Frame)
curve = Curve(分区结果_2)

# ---- group: 显示分区
linetype_table = LinetypeTable(Update=True)  # -> Linetypes, LinetypePattern
multiplication = Multiplication(A=读取分区.Layers, B=4.8)
unit_z = UnitZ(Factor=expr("0.05*x", multiplication))
list_item_2 = ListItem(List=flatten(linetype_table.Linetypes), Index=1, Wrap=True)
boundary_surfaces = BoundarySurfaces(Edges=curve)
colour_hsl = ColourHSL(Alpha=0.9, Hue=remap_numbers.Mapped, Saturation=0.6, Luminance=0.8)
area = Area(Geometry=分区结果_2)  # -> Area, Centroid
multiplication_2 = Multiplication(A=list_item_2, B=Slider(0.2, range=0..2))
move = Move(Geometry=area.Centroid, Motion=unit_z)  # -> Geometry, Transform
custom_preview = CustomPreview(Geometry=flatten(boundary_surfaces), Material=colour_hsl)
dash_pattern = DashPattern(Curve=curve, Pattern=multiplication_2)  # -> Dashes, Gaps
text_tag_3d = TextTag3D(Location=move.Geometry, Text=graft(生成序号.Indexes), Size=Slider(1.3, range=0..2), Colour=RGB(0, 0, 0), Justification=5)
custom_preview_lineweights_3 = CustomPreviewLineweights(
    Geometry=dash_pattern.Dashes,
    Shader={diffuse=RGB(0, 0, 0), emission=RGB(0, 0, 0), shine=0.5, specular=RGB(255, 255, 255), transparency=0},
    Thickness=2,
    Absolute=False)

# ----
rectangle_3 = Rectangle([{Plane=PlaneXY(42.315, 35.195, 0), Size=Domain2(u=0..9.07, v=0..5.05)}, {Plane=PlaneXY(35.23145026, 30.47, 0), Size=Domain2(u=-4.84..4.84, v=-3.725..3.725)}, {Plane=PlaneXY(43.61948039, 30.47, 0), Size=Domain2(u=-2.84..2.84, v=-3.725..3.725)}, {Plane=PlaneXY(52.38, 34.8, 0), Size=Domain2(u=0..7.46, v=0..8.7)}, {Plane=PlaneXY(35.10688782, 50.84679426, 0), Size=Domain2(u=-2.69188782..2.69188782, v=-2.515..2.515)}, {Plane=PlaneXY(42.315, 40.85, 0), Size=Domain2(u=0..4.35, v=0..8.48)}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])
minus_2 = Minus([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])
road_widths = Road_widths([1, 1, 1, 1, 0.6, 0.6, 0.6, 0.8])
boolean = Boolean([False, False, False, True, False, False, False, False])

# ---- group: 显示建筑
c_script_2 = CSharpScript(
    zoneCur=curve,
    floorAreas=读取分区.FloorAreas,
    layers=读取分区.Layers,
    area=实际中心点和面积.Area,
    centers=实际中心点和面积.Centers,
    grid=20,
    height=4.8)  # -> out, Layers, Buildings; inputs zoneCur: list of Curve, floorAreas: list of Double, layers: list of Int32, area: Double, centers: list of Point3d, grid: Double, height: Double
# ---------- c_script_2: C# ----------
    double floorAll = 0;
    double l = 0;
    for(int i = 0; i < floorAreas.Count;i++){
      floorAll += floorAreas[i];

    }
    for(int i = 0; i < floorAreas.Count;i++){
      l += layers[i] * floorAreas[i] / floorAll;
    }
    int layer = (int) l;
    if(floorAll > 0){
      var building = new List<Brep>();
      var curs = new List<Curve>();
      double k = Math.Sqrt(floorAll / grid / grid / area);

      for(int i = 0;i < zoneCur.Count;i++){
        var a = Transform.Scale(centers[i], k);
        zoneCur[i].Transform(a);//scale

        var func = rd.Components.FindComponent("Extrude");
        var func1 = func.Delegate as dynamic;
        var breps = func1(zoneCur[i], new Vector3d(0, 0, l * height / grid));
        if(breps != null){

          func = rd.Components.FindComponent("CapHoles");
          func1 = func.Delegate as dynamic;
          Brep b = func1(breps[0])[0];
          building.Add(b);
          func = rd.Components.FindComponent("LinearArray");
          func1 = func.Delegate as dynamic;
          var vec = new Vector3d(0, 0, height / grid);
          var layerCur = func1(zoneCur[i], vec, layer + 1)[0];
          Layers = layerCur;
          foreach(Curve c in layerCur){
            curs.Add(c);
          }
        }

      }
      Buildings = building;
      Layers = curs;

    }
# ---------- end c_script_2 ----------
colour_hsl_2 = ColourHSL(Alpha=0.9, Hue=remap_numbers.Mapped, Saturation=0.8, Luminance=0.5)
custom_preview_lineweights_4 = CustomPreviewLineweights(Geometry=c_script_2.Layers, Shader=simplify(graft(colour_hsl_2)), Thickness=2, Absolute=False)
custom_preview_2 = CustomPreview(
    Geometry=flatten(c_script_2.Buildings),
    Material={diffuse=RGB(255, 255, 255), emission=RGB(0, 0, 0), shine=0, specular=RGB(255, 255, 255), transparency=0})

# ----
custom_preview_lineweights_5 = CustomPreviewLineweights(
    Geometry=[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],
    Shader={diffuse=RGB(128, 128, 128), emission=RGB(0, 0, 0), shine=0, specular=RGB(255, 255, 255), transparency=0},
    Thickness=expr("0.8*x", [0.4, 0.4]),
    Absolute=True)
curve_2 = Curve(blocks)
# 1-1.Display   在rhino中显示场地
line = Line(road)
point_2 = Point(entrance)
curve_3 = Curve(boundary)
curve_4 = Curve(nature)
road_2 = CustomPreviewLineweights(
    Geometry=line,
    Shader={diffuse=RGB(128, 128, 128), emission=RGB(0, 0, 0), shine=0, specular=RGB(255, 255, 255), transparency=0},
    Thickness=expr("x*0.5", roadwidth),
    Absolute=True)
point_on_curve = PointOnCurve(line, parameter=0.441)
item_index = ItemIndex(List=line, Item=line)
linetype_table_2 = LinetypeTable(Update=True)  # -> Linetypes, LinetypePattern
item_index_2 = ItemIndex(List=point_2, Item=point_2)
dot_display = DotDisplay(Point=point_2, Colour=RGB(0, 0, 0), Size=0.5)
move_2 = Move(Geometry=point_on_curve, Motion=expr("x*0.7", Vector(1.675772371, 1.990857762, 0)))  # -> Geometry, Transform
boolean_toggle = BooleanToggle(True)
road_3 = CustomPreviewLineweights(
    Geometry=line,
    Shader={diffuse=RGB(255, 255, 255), emission=RGB(0, 0, 0), shine=0, specular=RGB(255, 255, 255), transparency=0},
    Thickness=expr("x*0.05", roadwidth),
    Absolute=True)
nature_2 = BoundarySurfaces(Edges=curve_4)
list_item_3 = ListItem(List=flatten(linetype_table_2.Linetypes), Index=1, Wrap=True)
move_3 = Move(Geometry=point_2, Motion=Vector(0, 0.9854719628, 0))  # -> Geometry, Transform
text_tag_3d_2 = TextTag3D(Location=move_2.Geometry, Text=item_index, Size=1.5, Justification=7)
multiplication_3 = Multiplication(A=list_item_3, B=Slider(0.88, range=0..2))
dash_pattern_2 = DashPattern(Curve=curve_3, Pattern=multiplication_3)  # -> Dashes, Gaps
buildings = BoundarySurfaces(Edges=curve_2)
text_tag_3d_3 = TextTag3D(Location=move_3.Geometry, Text=item_index_2, Size=1.5, Colour=RGB(0, 0, 0), Justification=7)
custom_preview_3 = CustomPreview(
    Geometry=nature_2,
    Material={diffuse=RGB(192, 227, 255), emission=RGB(0, 0, 0), shine=0, specular=RGB(255, 255, 255), transparency=0})
custom_preview_lineweights_6 = CustomPreviewLineweights(
    Geometry=dash_pattern_2.Dashes,
    Shader={diffuse=RGB(0, 0, 0), emission=RGB(0, 0, 0), shine=0.5, specular=RGB(255, 255, 255), transparency=0},
    Thickness=3,
    Absolute=False)
custom_preview_4 = CustomPreview(
    Geometry=buildings,
    Material={diffuse=RGB(225, 225, 225), emission=RGB(0, 0, 0), shine=0, specular=RGB(255, 255, 255), transparency=0})
index_2 = Text(生成序号.Indexes)
buildingarea = Number(读取分区.BuildingArea)
area_2 = Number(实际中心点和面积.Area)

# ---- group: infoList--竖向列表
number_slider = Slider(1.24, range=0..2)
# 3-1.Display Infomation 显示“量”信息
origin = Point(Point(74.39165824, 87.78098243, 0))
list_length = ListLength(List=index)
merge = Merge(Data1=simplify(graft(index_2)), Data2=simplify(graft(读取分区.ZoneNames)))
series = Series(Start=0, Step=Slider(2.5, range=0..10), Count=expr("x+1", list_length))
multiplication_4 = Multiplication(A=area_2, B=400)
text_join = TextJoin(Text=merge)  # -> flatten(Result)
unit_y = UnitY(Factor=expr("-x", series))
unit_x = UnitX(Factor=Slider(8, range=0..10))
integer = Integer(simplify(flatten(multiplication_4)))
unit_x_2 = UnitX(Factor=Slider(20, range=0..100))
move_4 = Move(Geometry=origin, Motion=unit_y)  # -> Geometry, Transform
move_5 = Move(Geometry=move_4.Geometry, Motion=unit_x_2)  # -> simplify(Geometry), Transform
move_6 = Move(Geometry=move_5.Geometry, Motion=unit_x)  # -> simplify(Geometry), Transform
merge_2 = Merge(Data1="用地面积", Data2=integer)
merge_3 = Merge(Data1="建筑面积", Data2=buildingarea)
merge_4 = Merge(Data1="分区", Data2=text_join)
text_tag_3d_4 = TextTag3D(Location=move_6.Geometry, Text=merge_3, Size=number_slider, Colour=RGB(0, 0, 0), Justification=7)
text_tag_3d_5 = TextTag3D(Location=move_5.Geometry, Text=merge_2, Size=number_slider, Colour=RGB(0, 0, 0), Justification=7)
text_tag_3d_6 = TextTag3D(Location=move_4.Geometry, Text=merge_4, Size=number_slider, Colour=RGB(0, 0, 0), Justification=7)

# ----
# 2-1.Transform
number_slider_2 = Slider(0.4, range=0..1)
site = Curve(boundary)
curve_5 = Curve([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])
rectangle_4 = Rectangle(rectangle_3)
list_length_2 = ListLength(List=rectangle_4)
series_2 = Series(Start=number_slider_2, Step=0, Count=list_length_2)  # -> simplify(Series)
number = Number(series_2)
trigger_2 = Trigger(Interval=20, TimerInterval=20, Target=multiagent)  # disabled

multiagent = MultiAgent(
    Rects=rectangle_4,
    Site=site,
    Minus=minus_2,
    Roads=curve_5,
    Road_widths=road_widths,
    Cutters=boolean,
    Radius=number,
    Packing=Toggle(False),
    Resistance=Slider(0.99, range=0..1.2),
    Run=Toggle(True),
    Reset=Button(),
    Spacing=Slider(0.7, range=0..1))  # -> PointsTree, PointsList

circle = Circle(Plane=multiagent.PointsTree, Radius=graft(series_2))

# ---- group: 提取轮廓线
number_slider_3 = Slider(0.7, range=0..1)
number_slider_4 = Slider(5.53, range=0..6)
number_slider_5 = Slider(0.35, range=0..0.5)
boolean_toggle_2 = BooleanToggle(True)
number_2 = Number(simplify(graft(series_2)))

# ----
提取轮廓线 = CSharpScript(
    rect=graft(rectangle_4),
    grid=20,
    points=multiagent.PointsTree,
    k=number_slider_4,
    radius=number_2,
    tolerance=number_slider_5,
    deleteMin=number_slider_3,
    fillet=boolean_toggle_2,
    Reference=["E:\ONEDRIVE - STU.XMU.EDU.CN\二次布局\ToPmesh\bin\Debug\net48\Plankton.dll", "E:\GRASSHOPPER_C#\Plankton-master\bin\Debug\Plankton.gha"])  # -> out, A, simplify(DistrictCur), simplify(Area); inputs rect: Rectangle3d, grid: Double, points: list of Point3d, k: Double, radius: Double, tolerance: Double, deleteMin: Double, fillet: Boolean, scale: Boolean
# ---------- 提取轮廓线: C# usings ----------
using Plankton;
using PlanktonGh;
using rd = Rhino.NodeInCode;
# ---------- 提取轮廓线: C# ----------
    //从点建立mesh
    var func = rd.Components.FindComponent("DelaunayMesh");
    var func1 = func.Delegate as dynamic;
    var initialMesh = func1(points, Plane.WorldXY);

    func = rd.Components.FindComponent("FaceBoundaries");
    func1 = func.Delegate as dynamic;
    var polylines = func1(initialMesh);
    //C = polylines;

    //建立Pmesh
    pmesh = new PlanktonMesh();
    pVertices = new List<PlanktonXYZ> ();
    List<List<int>> faces = new List<List<int>>();

    int index = 0;
    foreach (PolylineCurve plC in polylines)
    {
      Polyline pl;
      plC.TryGetPolyline(out pl);
      List<int> face = new List<int>();

      double length = pl.SegmentAt(0).Length;
      for(int i = 0;i < pl.GetSegments().Length;i++){
        if(pl.SegmentAt(i).Length > length)
          length = pl.SegmentAt(i).Length;
      }
      if(length > k * radius){
        continue;
      }
      index++;


      for(int j = 0;j < pl.Count - 1;j++)
      {
        var p = pl[j];
        PlanktonXYZ xYZ = new PlanktonXYZ((float) p.X, (float) p.Y, 0);
        if (!pVertices.Contains(xYZ))
        {
          pVertices.Add(xYZ);
        }
        face.Add(pVertices.IndexOf(xYZ));

      }
      faces.Add(face);
    }

    pmesh.Vertices.AddVertices(pVertices);
    pmesh.Faces.AddFaces(faces);

    //取出边缘
    var mesh = pmesh.ToRhinoMesh();
    A = mesh;

    var bound = new List<PolylineCurve>();
    var districtCurs = new List<PolyCurve>();
    foreach(Polyline p in mesh.GetNakedEdges()){
      p.MergeColinearSegments(tolerance, true);
      p.DeleteShortSegments(deleteMin);
      var boundry = p.ToPolylineCurve();
      boundry.ClosedCurveOrientation();
      bound.Add(boundry);
      var districtCur = new PolyCurve();
      if(fillet){
        districtCur = (PolyCurve) boundry.Offset(new Point3d(0, 0, 0),
          new Vector3d(0, 0, 1), radius, 0.1,
          CurveOffsetCornerStyle.Round)[0];
      }else{
        districtCur = (PolyCurve) boundry.Offset(new Point3d(0, 0, 0),
          new Vector3d(0, 0, 1), radius, 0.1, CurveOffsetCornerStyle.Sharp)[0];
      }
      districtCurs.Add(districtCur);
    }
    double area = 0;
    func = rd.Components.FindComponent("Area");
    func1 = func.Delegate as dynamic;
    var centers = new List<Point3d>();
    foreach(PolyCurve pc in districtCurs){

      //area+= (double)func1(pc)[0][0];
      area += (double) func1(pc)[0][0];
      centers.Add(func1(pc)[1][0]);
    }
    var areaOri = (double) func1(rect)[0][0];
    var sc = areaOri / area;
    if(scale){
      area = 0;
      for(int i = 0;i < centers.Count;i++){
        var trans = Transform.Scale(centers[i], sc);
        districtCurs[i].Transform(trans);
        area += (double) func1(districtCurs[i])[0][0];
      }
    }

    Area = Math.Round(area * grid * grid, 2);
    DistrictCur = districtCurs;
# ---------- 提取轮廓线: C# additional code ----------
  PlanktonMesh pmesh;
  List<PlanktonXYZ> pVertices;
# ---------- end 提取轮廓线 ----------
curve_6 = Curve(提取轮廓线.DistrictCur)
